# Grasshopper definition design_wall_file.gh (Grasshopper 1.0.7)

test_01_same_size = Curve([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])
test_02_same_size = Curve([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])

# ---- group: mutil-polyline
test_01 = Curve(flatten([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]))

# ----
crv_different_layerhight = Curve(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)

# ---- group: mutil-polyline
test_02 = Curve(flatten([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]))

# ----
bottom_crv = Curve(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)
# input_curves
top_crv = Curve(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)

# ---- group: prototype size
number_slider = Slider(600, range=0..1000)
number_slider_2 = Slider(120, range=0..1000)
model_size = GhPythonScript(view=Toggle(True), width=number_slider, length=number_slider_2)  # inputs view: Boolean
# ---------- model_size: Python ----------
__author__ = "WeiTingChen"

import Rhino.Geometry as rg
import Rhino as rc
import scriptcontext as sc
import System


# Create a custom display
st = sc.sticky

if 'display' not in st:  
    st['display'] = rc.Display.CustomDisplay(True)
st['display'].Clear()



if view:
    boundary = rg.Rectangle3d(rg.Plane.WorldXY, width, length).ToNurbsCurve()
    color = System.Drawing.Color.Red
    st['display'].AddCurve(boundary, color, 1)
else:
    st['display'].Dispose()
    del st['display']
# ---------- end model_size ----------

# ----
bottom_crv_2 = Curve(bottom_crv)
# Mesh Wall shaping
top_crv_2 = Curve(top_crv)

top_crv_3 = Curve()
bottom_crv_3 = Curve()

merge = Merge(
    Data1=Slider(0.026, range=0..1),
    Data2=Slider(0.237, range=0..1),
    Data3=Slider(0.531, range=0..1),
    Data4=Slider(0.914, range=0..1))
create_surface = GhPythonScript(top_crv_a=top_crv_2, bot_crv_a=bottom_crv_2, top_crv_b=top_crv_3, bot_crv_b=bottom_crv_3)  # -> out, surface_a, surface_b; inputs top_crv_a: Curve, bot_crv_a: Curve, top_crv_b: Curve, bot_crv_b: Curve
# ---------- create_surface: Python ----------
__author__ = "WeiTingChen"


import Rhino.Geometry as rg
import Rhino as rc
import compas

def loft_from_crv (crvA, crvB):
    return rg.NurbsSurface.CreateRuledSurface(crvA, crvB)


surface_a = loft_from_crv(top_crv_a, bot_crv_a)
# surface_b = loft_from_crv(bot_crv_b, top_crv_b)
# ---------- end create_surface ----------
crv = Curve(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)
glass_section = Curve()
glass_place_area = Geometry()
plane = Plane()
python = GhPythonScript(attractor_crvs=crv, params=merge)  # -> out, att_pts; inputs attractor_crvs: list of Curve, params: list
# ---------- python: Python ----------
__author__ = "WeiTingChen"

import Rhino.Geometry as rg


pts = []
params.sort()
for i, crv in enumerate(attractor_crvs):
    crv.Domain = rg.Interval(0.0, 1.0)
    for param in params:
        pt = crv.PointAt(param)
        pts.append(pt)

att_pts = pts[:]
# ---------- end python ----------
radias = Slider(10, range=0..100)
radias_2 = Slider(10, range=0..100)
wall_surface = Geometry(create_surface.surface_a)
python_2 = GhPythonScript(pts=python.att_pts, ref_planes=plane, glass_place_area=glass_place_area)  # -> out, frames_on_surface, new_glass_area; inputs surface: Surface, pts: list of Point3d, ref_planes: list of Plane, glass_place_area: list of Brep
# ---------- python_2: Python ----------
__author__ = "WeiTingChen"

import Rhino.Geometry as rg



frames_on_surface = []
for pt in pts:
    bool, u_param, v_param = surface.ClosestPoint(pt)
    frame = surface.FrameAt(u_param, v_param)[1]
    frames_on_surface.append(frame)


new_glass_area = []
for plane, glass_area, frame in zip(ref_planes, glass_place_area, frames_on_surface):
    T = rg.Transform.PlaneToPlane(plane, frame)
    glass_area.Transform(T)
    new_glass_area.append(glass_area)
# ---------- end python_2 ----------
surfacetomesh = GhPythonScript(wall_surface=wall_surface, x_size=radias_2, y_size=radias)  # -> out, oMesh, pts_grid; inputs wall_surface: Surface, x_size: Int32, y_size: Int32
# ---------- surfacetomesh: Python ----------
__author__ = "WeiTingChen"

import Rhino.Geometry as rg
import Rhino as rc
import ghpythonlib.components as gh



def srf2mesh(surface, u_size, v_size):
    """
    """
    # reparameterize surface
    surface.SetDomain(0,rg.Interval(0,1))
    surface.SetDomain(1,rg.Interval(0,1))
    
    pts_grid = []
    # set grid pts
    for i in range(0, u_size+1):
        pts_column = []
        for j in range(0, v_size+1):
            
            u = 1/u_size *i
            v = 1/v_size *j
            pts_column.append(surface.PointAt(u, v))
        pts_grid.append(pts_column)
    
    # create surface and center points
    meshes = rg.Mesh()
    for i in range(len(pts_grid)-1):
        for j in range(len(pts_grid[i])-1):
            mesh = rg.Mesh()
            points = [pts_grid[i][j], pts_grid[i+1][j], pts_grid[i+1][j+1], pts_grid[i][j+1]]
            pointsList = rc.Collections.Point3dList(points)
            mesh.Vertices.AddVertices(pointsList)
            mesh.Faces.AddFace(0,1,2,3)
            meshes.Append(mesh)
    meshes.Weld(100)
    return meshes, pts_grid

oMesh, pts_grid = srf2mesh(wall_surface, x_size, y_size)
# ---------- end surfacetomesh ----------
pt = Point(python.att_pts)
python_3 = GhPythonScript(pts=pt)  # -> out, add_on_glass, add_on_glass_area; inputs pts: list of Point3d
# ---------- python_3: Python ----------
__author__ = "WeiTingChen"

import Rhino.Geometry as rg
import ghpythonlib.components as gh
import compas
import os 
import sys

# add path of libraries
HERE = ghenv.LocalScope.ghdoc.Path

library_path = os.path.abspath(os.path.join(HERE, "..",))
print(library_path)

if not library_path in sys.path:
    sys.path.append(library_path)



def create_hexBycircle(plane, radius):
    
    circle = rg.Circle(plane, radius).ToNurbsCurve(3, 6) # only for visulzation
    circle_hex = rg.Circle(plane, radius).ToNurbsCurve(1, 6)
    return circle_hex
#
plane = rg.Plane.WorldZX
arr_circles =[]

dist = pts[0].DistanceTo(pts[1])
cir1 = rg.Circle(plane, pts[0], dist/2)
cir2 = rg.Circle(plane, pts[1], dist/2)
arr_circles.extend((cir1, cir2))


for i in range(2, len(pts)):
    min = float('inf')
    for j in range(len(arr_circles)):
        temp_pt = arr_circles[j].ClosestPoint(pts[i])
        dist = pts[i].DistanceTo(temp_pt)
        if dist < min:
            min = dist
    new_circle = rg.Circle(plane, pts[i], min)
    arr_circles.append(new_circle)

add_on_glass = arr_circles
add_on_glass_area = [ create_hexBycircle(cir.Plane, cir.Radius) for cir in arr_circles]
print(arr_circles)
# ---------- end python_3 ----------
ghpython_script = GhPythonScript(mesh=surfacetomesh.oMesh)  # -> out, out_mesh; inputs mesh: Mesh
# ---------- ghpython_script: Python ----------
__author__ = "WeiTingChen"

import sys
import os

# add path of libraries
HERE = ghenv.LocalScope.ghdoc.Path

library_path = os.path.abspath(os.path.join(HERE, "..",".."))
print(library_path)
if not library_path in sys.path:
    sys.path.append(library_path)


#from compas_rhino import unload_modules
#unload_modules('cSlicer')
# load the library 
import imp
from utilities import util
imp.reload(util)

from compas.datastructures import Mesh

c_mesh = util.rMesh2cMesh(mesh)

out_mesh = util.cMesh2rMesh(c_mesh)
# ---------- end ghpython_script ----------
geo = Geometry([python_3.add_on_glass, python_3.add_on_glass_area])

# ---- group: Glass_maker
top_section_01 = Slider(17, range=0..100)
# Glass Information (mm)
bottom_section_01 = Slider(35, range=0..100)
bottom_section_01_2 = Slider(40, range=0..100)
place_length = Slider(103, range=0..1000)
tolerance = Panel("38")
simple_glass_maker = Simple_glass_maker(R_2=bottom_section_01, R_3=bottom_section_01_2, F_2=place_length, F=tolerance, R=top_section_01)  # -> section_crv_2, L

# ----
list = ValueList({"glass_30*108": 0, "glass_41.5*150": 1, "glass_46*180": 2, "glass_64*223": 3, "000": 4}, selected="glass_30*108")

glass_30_108 = Geometry(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)
section_crv = Curve([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])

glass_41_5_150 = Geometry(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)
section_crv_2 = Curve([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])

glass_46_180 = Geometry(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)
section_crv_3 = Curve([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])

glass_64_223 = Geometry(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)
section_crv_4 = Curve([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])

filter = StreamFilter(Gate=list, Stream0=section_crv, Stream1=section_crv_2, Stream2=section_crv_3, Stream3=section_crv_4)
section_crv_5 = Curve(filter)
item = ListItem(List=section_crv_5, Index=0, Wrap=True)  # -> Item, Item1, Item2, Item3, Item4

# ---- group: Glass_maker / BAKE HERE
section_crv_6 = Curve(simple_glass_maker.section_crv_2)
glass_flasks = Geometry(simple_glass_maker.L)

# ----
crv_2 = Curve([item.Item1, item.Item2])
area = Area(Geometry=crv_2)  # -> Area, Centroid
darc = DeconstructArc(Arc=crv_2)  # -> BasePlane, Radius, Angle
item_2 = ListItem(List=darc.Radius, Index=0, Wrap=True)  # -> Item, Item1
item_3 = ListItem(List=area.Centroid, Index=0, Wrap=True)  # -> Item, Item1
multiplication = Multiplication(A=[item_2.Item, item_2.Item1], B="2")
dist = Distance(PointA=item_3.Item, PointB=item_3.Item1)

length = Panel(dist)
diameter = Panel(multiplication)

raduis_big = Slider(30, range=0..100)  # disabled
raduis_small = Slider(10, range=0..100)  # disabled
number_slider_3 = Slider(70, range=0..1000)  # disabled
merge_2 = Merge(Data1=raduis_big, Data2=raduis_small)  # disabled
attractor_crvs = Curve([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])  # disabled

raduis_big_2 = Slider(30, range=0..100)  # disabled
paths = Curve()  # disabled
layer_adjust = GhPythonScript(curves=paths, pts=python.att_pts, raduis=raduis_big_2)  # -> out, layer_key, add_on_glass, add_on_glass_area, area_extrusion, intersect_two_pts, adjust_path_pts; inputs curves: list of Curve, layer_points: list, pts: list of Point3d; disabled
# ---------- layer_adjust: Python ----------
__author__ = "WeiTingChen"

import Rhino.Geometry as rg
import ghpythonlib.components as gh
import os 
import sys

# add path of libraries
HERE = ghenv.LocalScope.ghdoc.Path

library_path = os.path.abspath(os.path.join(HERE, "..",))
print(library_path)

if not library_path in sys.path:
    sys.path.append(library_path)



from copy import deepcopy
from itertools import chain

def create_hexBycircle(plane, raduis):
    
    circle = rg.Circle(plane,raduis).ToNurbsCurve(3, 6) # only for visulzation
    circle_hex = rg.Circle(plane,raduis + 18).ToNurbsCurve(1, 6)
    return circle, circle_hex


dists = []
cls_curve_indices = []
cls_pts = []
for pt in pts:
    min_pt = rg.Point3d(0,0,0)
    min_dist = float('inf')
    cls_curve_index = 0
    for i, curve in enumerate(curves):
        cls_param = curve.ClosestPoint(pt)[1]
        cls_pt = curve.PointAt(cls_param)
        dist = pt.DistanceTo(cls_pt)
        if dist < min_dist :
            min_dist = dist
            min_pt = cls_pt
            cls_curve_index = i
    cls_pts.append(min_pt)
    dists.append(min_dist)
    cls_curve_indices.append(cls_curve_index)


pts_on_curve = cls_pts[:]
crvs_ID = cls_curve_indices[:]

planes = []
for i, pt in enumerate(pts_on_curve):
    curve = curves[crvs_ID[i]]
    param = curve.ClosestPoint(pt)[1]
    tan_vec = curve.TangentAt(param)
    plane = rg.Plane(pt, tan_vec, rg.Vector3d(0,0,1))
    planes.append(plane)


add_on_glass = []
add_on_glass_area = []
for plane in planes: 
    add_on_glass.append(create_hexBycircle(plane, raduis)[0])
    add_on_glass_area.append(create_hexBycircle(plane, raduis)[1])


# intersect
pts = []
intersect_pts = [] 
for plane, area in zip (planes, add_on_glass_area):
    normal_p = plane.ZAxis
    normal_n = -normal_p
    area_extrusion_p = rg.Surface.CreateExtrusion(area, normal_p*5).ToBrep()
    area_extrusion_n = rg.Surface.CreateExtrusion(area, normal_n*5).ToBrep()
    area_extrusion = area_extrusion_p
    
    area_extrusion.Join(area_extrusion_n, 0.1, True)
    
    for i, curve in enumerate(curves):
        cutting_plane = curve.FrameAt(0.5)[1]
        event = rg.Intersect.Intersection.CurveBrep(curve, area_extrusion, 0.0)
        if event[0] is True:
            intersect_pts.append(event[2])




def average_pt(points):
    """ create the average pt of inputs points """
    new_points = points[:]
    count = len(new_points)
    
    if count != 0:
        pt_X = sum([pt.X for pt in new_points])/count
        pt_Y = sum([pt.Y for pt in new_points])/count
        pt_Z = sum([pt.Z for pt in new_points])/count
    
    average_pt = rg.Point3d(pt_X, pt_Y, pt_Z)
    return average_pt



intersect_two_pts = []
layer_key = []

for i, pts in enumerate(intersect_pts):
    clean_pts = rg.Point3d.CullDuplicates(pts, 0.01)
    if clean_pts is None:
        clean_pts = []
    else:
        layer_key.append(i)
    clean_pts = list(clean_pts) # change the wired Array tyep in rhino 
    clean_pts.sort() 
    intersect_two_pts.append(clean_pts)




adjust_path_pts = []
intersect_layer_key = {} # sort key

center_plane_glass = planes[:]

for i, crv in enumerate(curves):
    points_count = crv.ToNurbsCurve().Points.Count
    adjust_layer_pts = []
    for j in range(points_count):
        control_pt = crv.ToNurbsCurve().Points.Item[j].Location
        moved_pt_on_curve = None
        for k, pt in enumerate(intersect_two_pts[i]):
            
            cls_param = crv.ClosestPoint(pt)[1]
            tan_vec = crv.TangentAt(cls_param)
            pt_on_curve = crv.PointAt(cls_param)
            # find closest control points for new path
            dist = pt_on_curve.DistanceTo(control_pt)
            scale_side = 10
            if dist < raduis + 8:
                control_pt = pt_on_curve
                if k == 0:
                    moved_pt_on_curve = control_pt.Clone() - tan_vec*scale_side
                    
                else:
                    moved_pt_on_curve = control_pt.Clone() + tan_vec*scale_side
                
                if control_pt.Z < center_plane_glass[0].Origin.Z:
                    control_pt = control_pt - rg.Vector3d.ZAxis*2.5
                else:
                    control_pt = control_pt + rg.Vector3d.ZAxis*2.5
                
        if moved_pt_on_curve == None:
            adjust_layer_pts.extend([control_pt])
        else:
            
            
            
            adjust_layer_pts.extend([control_pt,moved_pt_on_curve])
        adjust_layer_pts.sort()
    
    
    
    
    
    
    adjust_path_pts.append(adjust_layer_pts)
# ---------- end layer_adjust ----------
python_4 = GhPythonScript(x=layer_adjust.adjust_path_pts)  # -> out, simplify(a); disabled
# ---------- python_4: Python ----------
a =x
# ---------- end python_4 ----------
test = Curve(layer_adjust.add_on_glass_area)  # disabled
pline = PolyLine(Vertices=python_4.a, Closed=False)  # disabled

# ---- group: old
panel = Panel(number_slider)  # disabled
panel_2 = Panel(number_slider_2)  # disabled
# TODO
# organize it this week
rectangle = Rectangle(Plane=PlaneXY(0, 0, 0), XSize=panel, YSize=panel_2, Radius=0)  # -> Rectangle, Length; disabled
divded_length = Slider(150, range=0..1000)  # disabled
infill_pattern = GhPythonScript(boundary=rectangle.Rectangle, divded_length=divded_length)  # -> out, pts_a, pts_b, pts; inputs boundary: Curve; disabled
# ---------- infill_pattern: Python ----------
__author__ = "WeiTingChen"

import Rhino.Geometry as rg
import ghpythonlib.components as gh
import compas
from compas.geometry import Point, Polyline 


def divideCrv(curve, length):
    
    """
    ## divde curve by certain length ##
    input parameters:
        rhino geometry curves
        
    return:
        rhino geometry points
    """
    
    params = curve.DivideByLength(length, True)
    pt_on_curve = [ curve.PointAt(param) for param in params]
    return pt_on_curve


segment_a = boundary.DuplicateSegments()[0]
segment_b = boundary.DuplicateSegments()[2]
segment_b.Reverse() # check the direction 

pts_a = divideCrv(segment_a, divded_length/2)
pts_b = divideCrv(segment_b, divded_length/2)



# create the triangle infill path
pts = []
pts_triangle_bot = []
pts_triangle_top = []
for i, pt in enumerate(zip(pts_a, pts_b)):
    if i > 0 and i <len(pts_a)-1:
        pts_triangle_bot.append([pts_b[i], pts_a[i-1], pts_a[i+1], pts_b[i]])
        pts_triangle_top.append([pts_a[i], pts_b[i-1], pts_b[i+1], pts_a[i]])
for j in range(len(pts_triangle_bot)):
    if j % 2 == 0:
        pts.append(pts_triangle_bot[j])
    elif j % 2 == 1 and j < len(pts_triangle_bot):
        pts.append(pts_triangle_top[j])
# ---------- end infill_pattern ----------
python_5 = GhPythonScript(pts=infill_pattern.pts)  # -> out, line; inputs pts: list; disabled
# ---------- python_5: Python ----------
import Rhino.Geometry as rg
import ghpythonlib.treehelpers as th 

line = [rg.Polyline(pt) for pt in pts]
# ---------- end python_5 ----------
python_6 = GhPythonScript(pts_lst=infill_pattern.pts)  # -> out, vec_L, vec_R; inputs pts_lst: list; disabled
# ---------- python_6: Python ----------
__author__ = "WeiTingChen"

import Rhino.Geometry as rg
import ghpythonlib.components as gh
import compas


def vec_opposite_direction(points):
    """
    create two Rhino vector by on three points orthogonally
    """
    vec_left = points[1] - points[2] 
    rg.Vector3d.Unitize(vec_left)
    vec_right = -vec_left
    
    return vec_left, vec_right

vec_L, vec_R = vec_opposite_direction(pts_lst[0])
# ---------- end python_6 ----------
number_slider_4 = Slider(6, range=0..100)  # disabled
item_4 = ListItem(List=python_5.line, Index=0, Wrap=True)  # disabled
explode = Explode(Curve=item_4, Recursive=True)  # -> Segments, Vertices; disabled
multiplication_2 = Multiplication(A=python_6.vec_L, B=number_slider_4)  # disabled
number_slider_5 = Slider(10, range=0..10)  # disabled
item_5 = ListItem(List=explode.Vertices, Index=0, Wrap=True)  # -> Item, Item1, Item2; disabled
item_6 = ListItem(List=explode.Vertices, Index=0, Wrap=True)  # -> Item, Item1, Item2, Item3; disabled
move = Move(Geometry=item_5.Item1, Motion=multiplication_2)  # -> Geometry, Transform; disabled
points = PointList(Points=explode.Vertices, Size=number_slider_5)  # disabled

# ----
distrbution = GhPythonScript(raduis=merge_2, length=number_slider_3, attractor_crvs=attractor_crvs)  # -> out, glass_bot; inputs planesList: list, raduis: list, attractor_crvs: list of Curve; disabled
# ---------- distrbution: Python ----------
__author__ = "WeiTingChen"

import Rhino.Geometry as rg
import ghpythonlib.components as gh
import compas

def cloest_pts_curves(crvs, pts):
    """
    """
    dists = []
    cls_pts = []
    
    for pt in pts:
        min_dist = float('inf')
        min_pt = rg.Point3d(0,0,0)
        for i in range(len(crvs)):
            # find the cloest point for crvs
            cls_param = crvs[i].ClosestPoint(pt)[1]
            cls_pt = crvs[i].PointAt(cls_param)
            dist = pt.DistanceTo(cls_pt)
            if min_dist > dist:
                min_dist = dist
                min_pt = cls_pt
        cls_pts.append(min_pt)  
        dists.append(min_dist)
    return dists, cls_pts

def projecti2plane(pointslist, referencePlane):
    """
    """
    projected_points = []
    transform = rg.Transform.PlanarProjection(referencePlane)
    for point in pointslist:
        point.Transform(transform)
        projected_points.append(point)
    return projected_points

def create_hexBycircle(plane, raduis):
    
    circle = rg.Circle(plane,raduis).ToNurbsCurve(3, 6) # only for visulzation
    circle_hex = rg.Circle(plane,raduis).ToNurbsCurve(1, 6)
    return circle, circle_hex


# bottle glass
glass_pos = [plane for planes in planesList for plane in planes]

# moved glass postion 
moved_glass_pos = []
for i in range(len(glass_pos)):
    
    normal = glass_pos[i].ZAxis
    normal.Unitize()
    new_origin = glass_pos[i].Origin - normal*length 
    moved_glass_pl = rg.Plane(new_origin, glass_pos[i].XAxis, glass_pos[i].YAxis)
    moved_glass_pos.append(moved_glass_pl)

# simple pattern
disturbuted_glass_bot = {}
for i, pl in enumerate(glass_pos):
    if i%2 == 0: # simple pattern
        f_glass_circle = create_hexBycircle(glass_pos[i], raduis[0])[1]
        b_glass_circle = create_hexBycircle(moved_glass_pos[i], raduis[1])[1]
        disturbuted_glass_bot[i] = []
        disturbuted_glass_bot[i].append(f_glass_circle)
        disturbuted_glass_bot[i].append(b_glass_circle)

glass_bot = [disturbuted_glass_bot[key] for key in disturbuted_glass_bot.Keys]





# using attractor crv create pattern 

"""
glass_bot_pt = [plane.Origin for planes in planesList for plane in planes]
projected_glass_bot_pt = projecti2plane(glass_bot_pt, rg.Plane.WorldZX)


dists, cls_pts = cloest_pts_curves(attractor_crvs, projected_glass_bot_pt)

for dist in dists:
    if dist > 10:
        print dist
"""
# ---------- end distrbution ----------
paths_2 = Curve()
support = GhPythonScript()  # -> out, glass_bots, supports_area; inputs glass_bottle_list: list of Brep, surfacesList: list
# ---------- support: Python ----------
__author__ = "WeiTingChen"

import Rhino.Geometry as rg
import ghpythonlib.components as gh
import compas

# create the geometry for glass_bot

glass_bots = [ rg.NurbsSurface.CreateRuledSurface(glass_bottle[0].ToPolyline(0,0,0,0), glass_bottle[1].ToPolyline(0,0,0,0)) for \
glass_bottle in glass_bottle_list]



# create a str list to compare /alternative way is distance
front_cir_cpts = [glass_bottle[0].Points.ControlPolygon().CenterPoint() for glass_bottle in glass_bottle_list]
glass_bots_cpts = [rg.AreaMassProperties.Compute(glass_bot).Centroid for glass_bot in glass_bots]
front_cir_cpts_str = [cir_cpts.ToString() for cir_cpts in front_cir_cpts]

selected_pts = []
for srfs in surfacesList:
    pts_row = []
    for srf in srfs:
        srf_cpt = srf.PointAt(0.5,0.5)
        if srf_cpt.ToString() in front_cir_cpts_str:
            for i, glass_bots_cpt in enumerate(glass_bots_cpts):
                dist = srf_cpt.DistanceTo(front_cir_cpts[i])
                if dist < 0.1:
                    pts_row.append(glass_bots[i])
    selected_pts.append(pts_row[0])


supports_area = []
for i, glass_bot in enumerate(glass_bots):
    front_crv = glass_bots[i].ToBrep().Edges.Item[0].EdgeCurve.DuplicateSegments()[4]
    back_crv = glass_bots[i].ToBrep().Edges.Item[2].EdgeCurve.DuplicateSegments()[4]
    
    
    
    # project to XY plane
    f_crv_spt = front_crv.PointAtStart # front_crv_spt
    f_crv_ept = front_crv.PointAtEnd # front_crv_ept
    b_crv_spt = back_crv.PointAtStart # back_crv_spt
    b_crv_ept = back_crv.PointAtEnd # back_crv_ept
    
    new_front_crv = rg.Line(rg.Point3d(f_crv_spt.X, f_crv_spt.Y,0), rg.Point3d(f_crv_ept.X, f_crv_ept.Y,0)).ToNurbsCurve()
    new_back_crv = rg.Line(rg.Point3d(b_crv_spt.X, b_crv_spt.Y,0), rg.Point3d(b_crv_ept.X, b_crv_ept.Y,0)).ToNurbsCurve()
    
    support_area = rg.NurbsSurface.CreateRuledSurface(new_front_crv, new_back_crv)
    supports_area.append(support_area)

# create the supports
# ---------- end support ----------
python_7 = GhPythonScript(curves=paths_2)  # -> out, a, bottom_crv; inputs curves: list of Curve, place_frames: list of Plane, brep: Brep
# ---------- python_7: Python ----------
__author__ = "WeiTingChen"

import Rhino.Geometry as rg
import Rhino as rc

def closest_ptsOncurves(crvs, pts):
    """
    """
    closest_dict = {'dist':[], 'cls_pt':[], 'crv_key':[]}
    
    for pt in pts:
        min_dist = float('inf')
        min_pt = rg.Point3d(0,0,0)
        for i in range(len(crvs)):
            # find the cloest point for crvs
            cls_param = crvs[i].ClosestPoint(pt)[1]
            cls_pt = crvs[i].PointAt(cls_param)
            dist = pt.DistanceTo(cls_pt)
            if min_dist > dist:
                min_dist = dist
                min_pt = cls_pt
                crv_key = i
        closest_dict['cls_pt'].append(min_pt)  
        closest_dict['dist'].append(min_dist)  
        closest_dict['crv_key'].append(crv_key)  
    return closest_dict
    

def intersect_with_brep(curves, brep):
    
    intersect_pts = [] 
    for curve in curves:
        event = rg.Intersect.Intersection.CurveBrep(curve, brep, 0.0)
        if event[0] is True:
            intersect_pts.append(event[2])
    # clean unused []
    intersect_pts = [pts for pts in intersect_pts]
    return intersect_pts

center_pt = [frame.Origin for frame in place_frames]
closest_dict = closest_ptsOncurves(curves, center_pt)





upper_crv =[]
bottom_crv =[]

for i in range(len(closest_dict['crv_key'])):
    
    for j, curve in enumerate(curves):
        print j 
        if j > i:
            bottom_crv.append(curve)


# intersect_with_brep(curves, brep)
# ---------- end python_7 ----------
python_8 = GhPythonScript(x=python_7.a)  # -> out, simplify(flatten(a)); same code as python_4

# ==== cluster Simple_glass_maker
F = ClusterInput()
F_2 = ClusterInput()
Z = UnitZ(Factor=F)
Z_2 = UnitZ(Factor=F_2)
R = ClusterInput()
R_2 = ClusterInput()
R_3 = ClusterInput()
pt = Point(Point(0, 0, 0))
move = Move(Geometry=pt, Motion=Vector(0, 0, 10))  # -> Geometry, Transform
move_2 = Move(Geometry=pt, Motion=Z_2)  # -> Geometry, Transform
move_3 = Move(Geometry=move_2.Geometry, Motion=Z)  # -> Geometry, Transform
cir = Circle(Plane=pt, Radius=R_2)
cir_2 = Circle(Plane=move.Geometry, Radius=R_3)
cir_3 = Circle(Plane=move_2.Geometry, Radius=R)
cir_4 = Circle(Plane=move_3.Geometry, Radius=R)
merge = Merge(Data1=cir, Data2=cir_2, Data3=cir_3, Data4=cir_4)
section_crv = Curve(merge)
loft = Loft(Curves=section_crv, Options={Adjust=True, Closed=False, LoftEnds=0, LoftSimp=0, LoftType=3, Rebuild=10, Refit=0.01})
section_crv_2 = ClusterOutput(section_crv)
L = ClusterOutput(loft)
