# Grasshopper definition design_wall_file_W.gh (Grasshopper 1.0.7)
# plug-ins: Lumbricid Info, MeshEdit Components, Human, Kangaroo Components, Kangaroo2 Components

bottom_crv = Curve(<curve referenced from the Rhino model>)
top_crv = Curve(<curve referenced from the Rhino model>)
merge = Merge(Data1=bottom_crv, Data2=top_crv)
radias = Slider(60, range=0..100)
radias_2 = Slider(30, range=0..100)
loft = Loft(Curves=merge, Options={Adjust=False, Closed=False, LoftEnds=0, LoftSimp=0, LoftType=0, Rebuild=10, Refit=0.01})
surfacetomesh = GhPythonScript(wall_surface=loft, x_size=radias_2, y_size=radias)  # -> out, oMesh, pts_grid; inputs wall_surface: Surface, x_size: Int32, y_size: Int32
# ---------- surfacetomesh: Python ----------
__author__ = "WeiTingChen"

import Rhino.Geometry as rg
import Rhino as rc
import ghpythonlib.components as gh



def srf2mesh(surface, u_size, v_size):
    """
    """
    # reparameterize surface
    surface.SetDomain(0,rg.Interval(0,1))
    surface.SetDomain(1,rg.Interval(0,1))
    
    pts_grid = []
    # set grid pts
    for i in range(0, u_size+1):
        pts_column = []
        for j in range(0, v_size+1):
            
            u = 1/u_size *i
            v = 1/v_size *j
            pts_column.append(surface.PointAt(u, v))
        pts_grid.append(pts_column)
    
    # create surface and center points
    meshes = rg.Mesh()
    for i in range(len(pts_grid)-1):
        for j in range(len(pts_grid[i])-1):
            mesh = rg.Mesh()
            points = [pts_grid[i][j], pts_grid[i+1][j], pts_grid[i+1][j+1], pts_grid[i][j+1]]
            pointsList = rc.Collections.Point3dList(points)
            mesh.Vertices.AddVertices(pointsList)
            mesh.Faces.AddFace(0,1,2,3)
            meshes.Append(mesh)
    meshes.Weld(100)
    return meshes, pts_grid

oMesh, pts_grid = srf2mesh(wall_surface, x_size, y_size)
# ---------- end surfacetomesh ----------
ghpython_script = GhPythonScript(mesh=surfacetomesh.oMesh)  # -> out, out_mesh; inputs mesh: Mesh
# ---------- ghpython_script: Python ----------
__author__ = "WeiTingChen"

import sys
import os

# add path of libraries
HERE = ghenv.LocalScope.ghdoc.Path

library_path = os.path.abspath(os.path.join(HERE, "..",".."))
print(library_path)
if not library_path in sys.path:
    sys.path.append(library_path)


#from compas_rhino import unload_modules
#unload_modules('cSlicer')
# load the library 
import imp
from utilities import util
imp.reload(util)

from compas.datastructures import Mesh

c_mesh = util.rMesh2cMesh(mesh)

out_mesh = util.cMesh2rMesh(c_mesh)
# ---------- end ghpython_script ----------

# ---- group: size
length = Slider(1100, range=0..10000)
height = Slider(1900, range=0..3000)

# ---- group: resolution
number_slider = Slider(30, range=0..100)
height_count = Slider(60, range=0..100)

# ----
# Define Wall Dimensions
pt = Point(Point(0, 0, 0))
xz = XZPlane(Origin=pt)
rectangle = Rectangle(Plane=xz, XSize=length, YSize=height, Radius=0)  # -> Rectangle, Length
division = Division(A=height, B=height_count)
mplane = MeshPlane(Boundary=rectangle.Rectangle, WidthCount=number_slider, HeightCount=division)  # -> Mesh, Area

number_slider_2 = Slider(5, range=0..10)  # disabled
number_slider_3 = Slider(800, range=0..10000)  # disabled
number_slider_4 = Slider(600, range=0..1000)  # disabled
number_slider_5 = Slider(8, range=0..10)  # disabled
pt_2 = Point(Point(1004.032465, 0, 0))  # disabled
xz_2 = XZPlane(Origin=pt_2)  # disabled
rectangle_2 = Rectangle(Plane=xz_2, XSize=number_slider_3, YSize=number_slider_4, Radius=0)  # -> Rectangle, Length; disabled
division_2 = Division(A=number_slider_4, B=number_slider_2)  # disabled
list = ValueList({"flat_wall": 0, "curved_wall": 1}, selected="flat_wall")
eye_level = Curve(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)
curvature_type = Curve(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)
mesh = Mesh(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)
filter = StreamFilter(Gate=list, Stream0=mplane.Mesh, Stream1=ghpython_script.out_mesh)
mplane_2 = MeshPlane(Boundary=rectangle_2.Rectangle, WidthCount=number_slider_5, HeightCount=division_2)  # -> Mesh, Area; disabled

# ---- group: Wall_surface
mesh_2 = Geometry(filter)

# ----
number_slider_6 = Slider(100, range=0..1000)  # disabled
number_slider_7 = Slider(351, range=0..1000)  # disabled

# ---- group: Wall_surface
geo = Geometry(mplane_2.Mesh)  # disabled

# ----
guilde_crvs = Curve([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])
guilde_crvs_2 = Curve(guilde_crvs)
crv = Curve(<curve referenced from the Rhino model>)  # disabled
pop3d = Populate3D(Region=geo, Count=number_slider_6, Seed=number_slider_7)  # disabled
list_2 = ValueList({"type_01": 0, "type_02": 1}, selected="type_01")
filter_2 = StreamFilter(Gate=list_2, Stream0=eye_level, Stream1=curvature_type)
number_slider_8 = Slider(100, range=0..1000)  # disabled
divide = DivideCurve(Curve=guilde_crvs_2, Count=Slider(30, range=0..1000), Kinks=False)  # -> Points, Tangents, Parameters
pull = PullPoint(Point=pop3d, Geometry=crv, ClosestOnly=True)  # -> ClosestPoint, Distance; disabled
pt_3 = Point(flatten(divide.Points))
mesh_3 = Geometry(mesh_2)
number_slider_9 = Slider(50, range=0..100)  # disabled
smaller = SmallerThan(FirstNumber=pull.Distance, SecondNumber=number_slider_8)  # -> SmallerThan, OrEqualTo; disabled
cull = CullPattern(List=pop3d, CullPattern=smaller.SmallerThan)  # disabled
shpae_mesh = GhPythonScript(input=mesh_3, points=pt_3, factor=Slider(0.4, range=-1..1))  # -> out, offset_mesh, port, out_mesh, flat_mesh, distances, cls_pts; inputs points: list of Point3d
# ---------- shpae_mesh: Python ----------
import compas
import rhinoscriptsyntax as rs
import Rhino.Geometry as rg
from compas_rhino.geometry import RhinoMesh
from compas.geometry import add_vectors
from compas.geometry import scale_vector
from compas_ghpython.artists import MeshArtist
from compas.datastructures import mesh_flip_cycles, meshes_join

mesh = RhinoMesh.from_guid(input).to_compas()
offset_mesh = mesh.copy()

#calculate offsets based on distance from curves
offsets = []
dist_pts = []

distances = []
cls_pts = []
for vertex in rs.MeshVertices(input):
    vertex = rg.Point3d(vertex[0], vertex[1], vertex[2])
    minDist = float('inf')
    minIdx = 0
    minPt = rg.Point3d(0,0,0)
    for idx, p in enumerate(points): 
        dist = p.DistanceTo(vertex)
        if dist < minDist :
            minDist = dist
            minIdx = idx
            minPt = p
    dist = vertex.DistanceTo(points[minIdx])
    print(dist)
    distances.append(dist)
    cls_pts.append(minPt)
    offsets.append(dist)

max_offset = max(offsets)
for i,key in enumerate(offset_mesh.vertices()):
    normal = mesh.vertex_normal(key)
    
    xyz = mesh.vertex_coordinates(key)
    
    distance = offsets[i]
    offset_mesh.vertex_attributes(key, 'xyz', add_vectors(xyz, scale_vector(normal, distance*factor)))
    
# flip bottom part
mesh_flip_cycles(offset_mesh)

out_mesh = MeshArtist(offset_mesh).draw()
flat_mesh = input
# ---------- end shpae_mesh ----------
pdecon = Deconstruct(Point=cull)  # -> XComponent, YComponent, ZComponent; disabled
number_slider_10 = Slider(599, range=0..1000)  # disabled
curve = Curve([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])  # disabled
demesh = DeconstructMesh(Mesh=mplane_2.Mesh)  # -> Vertices, Faces, Colours, Normals; disabled
bnd = Bounds(Numbers=pull.Distance)  # disabled
number_slider_11 = Slider(1500, range=0..10000)  # disabled
number_slider_12 = Slider(1000, range=0..1000)  # disabled
number_slider_13 = Slider(39, range=0..100)  # disabled
number_slider_14 = Slider(800, range=0..1000)  # disabled
bnd_2 = Bounds(Numbers=pdecon.XComponent)  # disabled
divide_curve = DivideCurve(Curve=curve, Count=number_slider_9, Kinks=False)  # -> flatten(Points), Tangents, Parameters; disabled
number_slider_15 = Slider(2, range=0..10)  # disabled
curved_mesh = Geometry(shpae_mesh.out_mesh)
filter_3 = StreamFilter(Gate=list_2, Stream0=curved_mesh, Stream1=mesh)
dam = DataDam(DataA=filter_3, BufferDelay=10000000, BufferMode=0)
mesh_4 = Geometry(dam)

Y = UnitY(Factor=Slider(500, range=0..1000))
divide_2 = DivideCurve(Curve=filter_2, Count=Slider(60, range=0..100), Kinks=False)  # -> Points, Tangents, Parameters
move = Move(Geometry=divide_2.Points, Motion=Y)  # -> Geometry, Transform
ln = Line(StartPoint=move.Geometry, EndPoint=divide_2.Points)
mcx = MeshCurve(Mesh=mesh_4, Curve=ln)  # -> Points, Faces
pshift = ShiftPaths(Data=mcx.Points, Offset=-2)
intcrv = Interpolate(Vertices=pshift, Degree=3, Periodic=False, KnotStyle=1)  # -> flatten(Curve), Length, Domain

medges = MeshEdges(Mesh=mesh_4)  # -> NakedEdges, InteriorEdges, NonManifoldEdges
mesh_5 = Mesh(mesh_4)
crv_2 = Curve(medges.NakedEdges)
demesh_2 = DeconstructMesh(Mesh=mesh_5)  # -> Vertices, Faces, Colours, Normals
crv_cp = CurveClosestPoint(Point=demesh_2.Vertices, Curve=intcrv.Curve)  # -> Point, Parameter, Distance
item = ListItem(List=demesh.Vertices, Index=0, Wrap=True)  # disabled
panel = Panel(bnd)  # disabled
data = Data(crv_cp.Distance)
random = Random(Range=Domain(0, 1), Number=number_slider_6, Seed=number_slider_10)  # disabled
remap = RemapNumbers(Value=pdecon.XComponent, Source=bnd_2, Target=Domain(0, 1))  # -> Mapped, Clipped; disabled
number_slider_16 = Slider(400, range=0..1000)
demesh_3 = DeconstructMesh(Mesh=curved_mesh)  # -> Vertices, Faces, Colours, Normals; disabled
bnd_3 = Bounds(Numbers=data)
larger = LargerThan(FirstNumber=remap.Mapped, SecondNumber=random)  # -> LargerThan, OrEqualTo; disabled
pdecon_2 = Deconstruct(Point=demesh_3.Vertices)  # -> XComponent, YComponent, ZComponent; disabled
remap_2 = RemapNumbers(Value=data, Source=bnd_3, Target="0 to 1")  # -> Mapped, Clipped
plane_surface = PlaneSurface(Plane=PlaneXY(0, 0, 0), XSize=number_slider_14, YSize=number_slider_11)  # disabled
number_slider_17 = Slider(1, range=-1..1)  # disabled
number_slider_18 = Slider(100, range=0..100)  # disabled
cull_2 = CullPattern(List=cull, CullPattern=larger.LargerThan)  # disabled
popgeo = PopulateGeometry(Geometry=mesh_5, Count=Slider(400, range=0..1000), Seed=1)

# ---- group: delete if too close to boundary
number_slider_19 = Slider(47, range=0..100)  # disabled
crv_3 = Curve(rectangle_2.Rectangle)  # disabled
crv_cp_2 = CurveClosestPoint(Point=cull_2, Curve=crv_3)  # -> Point, Parameter, Distance; disabled
larger_2 = LargerThan(FirstNumber=crv_cp_2.Distance, SecondNumber=number_slider_19)  # -> LargerThan, OrEqualTo; disabled
cull_3 = CullPattern(List=cull_2, CullPattern=larger_2.LargerThan)  # disabled

# ----
number_slider_20 = Slider(5, range=0..10)  # disabled
hsl = ColourHSL(Alpha=1, Hue=0, Saturation=1, Luminance=remap_2.Mapped)
bnd_4 = Bounds(Numbers=pdecon_2.YComponent)  # disabled
populate_3d = Populate3D(Region=plane_surface, Count=number_slider_15, Seed=1)  # disabled
conmesh = ConstructMesh(Vertices=demesh_2.Vertices, Faces=demesh_2.Faces, Colours=hsl)
pt_4 = Point(popgeo)
remap_3 = RemapNumbers(Value=pdecon_2.YComponent, Source=bnd_4, Target=Domain(0, 1))  # -> Mapped, Clipped; disabled
hsl_2 = ColourHSL(Alpha=1, Hue=remap_3.Mapped, Saturation=1, Luminance=0.5)  # disabled
ghpython_script_2 = GhPythonScript(
    brep=plane_surface,
    attractors=divide_curve.Points,
    num=number_slider_12,
    ite=number_slider_13,
    attractor_rad=number_slider_18,
    attractor_pow=number_slider_17)  # -> out, a, points; inputs brep: Brep, attractors: list of Point3d, num: Int32, ite: Int32; disabled
# ---------- ghpython_script_2: Python ----------
"""
https://www.youtube.com/watch?v=7fPxQd7nUV0&ab_channel=JunichiroHorikawa
"""

import Rhino.Geometry as rg
import random as rnd
from Rhino.Collections import Point3dList
import math

def remap(val, smin, smax, tmin, tmax):
    
    return (val - smin) / (smax - smin) * (tmax - tmin) + tmin

def create_random_point(brep, bbox):
    #get a random coordinate inside bbox
    x = remap(rnd.random(), 0.0, 1.0, bbox.Min.X, bbox.Max.X)
    y = remap(rnd.random(), 0.0, 1.0, bbox.Min.Y, bbox.Max.Y)
    z = remap(rnd.random(), 0.0, 1.0, bbox.Min.Z, bbox.Max.Z)

    return brep.ClosestPoint(rg.Point3d(x, y, z))
    
points = Point3dList()
attractors = Point3dList(attractors)
bbox = brep.GetBoundingBox(True)
for i in range(num):
    
    if points.Count == 0:
        first_point = create_random_point(brep, bbox)
        points.Add(first_point)
    else:
        max_dist = - 1
        for t in range(ite):
            temp = create_random_point(brep, bbox)
            
            nindex = points.ClosestIndex(temp)
            pos = points[nindex]
            
            #attractor points
            
            attract_id = attractors.ClosestIndex(temp)
            attract_pos = attractors[attract_id]
            
            weight = math.pow( min(attract_pos.DistanceTo(temp),attractor_rad), attractor_pow)
            dist = pos.DistanceTo(temp) * weight
            
            if dist> max_dist:
                
                max_dist = dist
                max_pos = temp
                
        points.Add(max_pos)
# ---------- end ghpython_script_2 ----------
onmesh = OnMesh(Points=pt_4, Mesh=conmesh, Strength=1)
sphere = Sphere(Base=populate_3d, Radius=number_slider_18)  # disabled
imgcircles = ImageCircles(Points=pt_4, Mesh=conmesh, Min=Slider(35, range=0..100), Max=Slider(58, range=0..100), Strength=1)
conmesh_2 = ConstructMesh(Vertices=demesh_3.Vertices, Faces=demesh_3.Faces, Colours=hsl_2)  # disabled
contour = Contour(Shape=geo, Point=item, Direction=Vector(0, 0, 1), Distance=number_slider_20)  # -> flatten(Contours); disabled
entwine = Entwine(Branch00=imgcircles, Branch01=onmesh, FlattenInputs=True)  # -> simplify(Result)
mesh_6 = Mesh(conmesh_2)  # disabled
point = Point(ghpython_script_2.points)  # disabled
solver = Solver(GoalObjects=entwine, Reset=Button(), Threshold=Slider(0.394, range=0..1), Tolerance=0.0001, On=Toggle(False))  # -> I, V, O

# ---- group: make sure center point is on a layer
python = GhPythonScript(points=cull_3, layer_height=number_slider_20, contours=contour)  # -> out, new_points; inputs points: list of Point3d, contours: list of Curve; disabled
# ---------- python: Python ----------
import Rhino.Geometry as rg

point_on_ground = contours[0].PointAtStart
first_layer_height = point_on_ground.Z
print first_layer_height

new_points = []
for p in points:
    
    newZ = (  (p.Z-first_layer_height) // layer_height) * (layer_height)
    
    new_points.append(rg.Point3d(p.X, p.Y,newZ + first_layer_height))
# ---------- end python ----------

# ----
shpae_mesh_2 = GhPythonScript()  # -> out, offset_mesh, port, out_mesh_back, out_mesh_front; disabled
# ---------- shpae_mesh_2: Python ----------
import compas
import rhinoscriptsyntax as rs
import Rhino.Geometry as rg
from compas_rhino.geometry import RhinoMesh
from compas.geometry import add_vectors
from compas.geometry import scale_vector
from compas_ghpython.artists import MeshArtist
from compas.datastructures import mesh_flip_cycles, meshes_join, mesh_offset


mesh = RhinoMesh.from_guid(input).to_compas()
offset_mesh = mesh.copy()

#calculate offsets based on distance from curves
offsets = []
dist_pts = []


offset_mesh_back = mesh_offset(offset_mesh, 50)
offset_mesh_front = mesh_offset(offset_mesh, -50)
mesh_flip_cycles(offset_mesh_back)
mesh_flip_cycles(offset_mesh_front)
out_mesh_back = MeshArtist(offset_mesh_back).draw()
out_mesh_front = MeshArtist(offset_mesh_front).draw()
# ---------- end shpae_mesh_2 ----------
branch = TreeBranch(Tree=solver.O, Path="{0}", MaintainPaths=True)
meshcp = MeshClosestPoint(Point=solver.V, Mesh=conmesh)  # -> Point, Index, Parameter
meval = MeshEval(Mesh=conmesh, Parameter=meshcp.Parameter)  # -> Point, Normal, Colour
curved_mesh_2 = Geometry(shpae_mesh_2.out_mesh_back)  # disabled
curved_mesh_3 = Geometry(shpae_mesh_2.out_mesh_front)  # disabled
number_slider_21 = Slider(38, range=0..100)  # disabled
circle = CircleCNR(Center=meshcp.Point, Normal=meval.Normal, Radius=branch)
type = ValueList({"One": 1, "Two": 2, "Three": 3, "Four": 4}, selected="One")  # disabled
Y_2 = UnitY(Factor=expr("-x", number_slider_21))  # disabled
dam_2 = DataDam(DataA=branch, DataB=meshcp.Point, BufferDelay=10000000, BufferMode=0)  # -> DataA, DataB
pt_5 = Point(python.new_points)  # disabled
move_2 = Move(Geometry=pt_5, Motion=Y_2)  # -> Geometry, Transform; disabled
lng = ListLength(List=pt_5)  # disabled
python_2 = GhPythonScript(points=move_2.Geometry, type=type)  # -> out, glass; inputs points: list of Point3d; disabled
# ---------- python_2: Python ----------
import rhinoscriptsyntax as rs
import Rhino.Geometry as rg

def glass_mk(centroid, type):
    
    if type == 1 :
        diameters = [20, 20, 20, 50, 60]
        length = [108, 98, 80, 20, 0]
    elif type ==2 :
        diameters = [32, 32, 32, 73, 83]
        length = [150, 140, 108, 20, 0]
    elif type ==3:
        diameters = [32, 32, 32, 82, 92]
        length = [180, 170, 142, 20, 0]
    else :
        diameters = [49, 49, 49, 118, 118]
        length = [223, 213, 170, 20, 0]

    circles = []
    
    for d in diameters:
        cir = rg.Circle(rg.Plane.WorldZX,d/2)
        circles.append(cir)
    
    
    for cr, l in zip(circles,length):
        t = rg.Transform.Translation(rg.Vector3d.YAxis*l)
        cr.Transform(t)
    
    center_point = 0.5 * (circles[0].Center + circles[-1].Center)
    
    
    curves = [c.ToNurbsCurve(1, 20) for c in circles]
    loft = rg.Brep.CreateFromLoft(curves, rg.Point3d.Unset, rg.Point3d.Unset, rg.LoftType.Straight, False)[0]
    
    vec = centroid - center_point
    trans = rg.Transform.Translation(vec)
    loft.Transform(trans)
    
    return loft

glass = []

for p in points:
    
    gl = glass_mk(p, type)
    glass.append(gl)
# ---------- end python_2 ----------
brep = Brep(python_2.glass)  # disabled
swatch = ColourSwatch(SwatchColor=RGB(255, 255, 255))  # disabled
panel_2 = Panel(lng)  # disabled
preview = CustomPreview(Geometry=brep, Material=swatch)  # disabled
data_2 = Data(dam_2.DataA)
pt_6 = Point(dam_2.DataB)

mesh_7 = Mesh(mesh_4)
medges_2 = MeshEdges(Mesh=mesh_7)  # -> NakedEdges, InteriorEdges, NonManifoldEdges
pt_7 = Point(pt_6)
join = JoinCurves(Curves=medges_2.NakedEdges, Preserve=False)
pull_2 = PullPoint(Point=pt_7, Geometry=join, ClosestOnly=True)  # -> ClosestPoint, Distance
smaller_2 = SmallerThan(FirstNumber=pull_2.Distance, SecondNumber=Slider(45, range=0..100))  # -> SmallerThan, OrEqualTo
dispatch = Dispatch(List=pt_7, DispatchPattern=smaller_2.SmallerThan)  # -> ListA, ListB

mesh_8 = Mesh(geo)  # disabled
python_3 = GhPythonScript(input=mesh_8)  # -> out, a; disabled
# ---------- python_3: Python ----------
import compas
import rhinoscriptsyntax as rs
from compas_rhino.geometry import RhinoMesh
from compas.geometry import add_vectors
from compas.geometry import scale_vector
from compas_ghpython.artists import MeshArtist
from compas.datastructures import mesh_flip_cycles, meshes_join

mesh = RhinoMesh.from_guid(input).to_compas()

offset = mesh.copy()

#calculate offsets based on distance from glass
offsets = []

for vertex in rs.MeshVertices(input):
    
    offsets.append(length)
    
print offsets

for i,key in enumerate(offset.vertices()):
    normal = mesh.vertex_normal(key)
    xyz = mesh.vertex_coordinates(key)
    
    distance = offsets[i]
    offset.vertex_attributes(key, 'xyz', add_vectors(xyz, scale_vector(normal, distance)))
    
# flip bottom part
mesh_flip_cycles(offset)

# join parts
thickened_mesh = meshes_join([mesh, offset])

# close boundaries
n = thickened_mesh.number_of_vertices() / 2

edges_on_boundary = [edge for boundary in list( thickened_mesh.edges_on_boundaries() ) for edge in boundary]

for u, v in edges_on_boundary:
    if u < n and v < n:
        key = thickened_mesh.add_face([u, v, v + n, u + n])
        
        #delete top + btm
        if thickened_mesh.face_normal(key) == [0,0,1] or thickened_mesh.face_normal(key) == [0,0,-1]:
            thickened_mesh.delete_face(key)

a = MeshArtist(thickened_mesh).draw()
# ---------- end python_3 ----------
mesh_9 = Mesh(python_3.a)  # disabled

dispatch_2 = Dispatch(List=data_2, DispatchPattern=smaller_2.SmallerThan)  # -> ListA, ListB
data_3 = Data(dispatch_2.ListB)
geo_2 = Geometry(dispatch.ListB)
pt_8 = Point(geo_2)
demesh_4 = DeconstructMesh(Mesh=mesh_9)  # -> Vertices, Faces, Colours, Normals; disabled
pdecon_3 = Deconstruct(Point=pt_8)  # -> XComponent, YComponent, ZComponent
item_2 = ListItem(List=demesh_4.Vertices, Index=0, Wrap=True)  # disabled
smaller_3 = SmallerThan(FirstNumber=pdecon_3.ZComponent, SecondNumber=Slider(700, range=0..10000))  # -> SmallerThan, OrEqualTo
pts = GhPythonScript(pts=pt_8, max_z=Slider(1.713, range=0..2000), min_z=Slider(150, range=0..2000))  # -> out, new_pts, ran_pts; inputs pts: list of Point3d
# ---------- pts: Python ----------
__author__ = "WeiTingChen"

import Rhino.Geometry as rg
import ghpythonlib.components as gh


K = 1 # based on y
new_pts = sorted(pts, key = lambda pt: pt[K])

ran_pts = []
for pt in new_pts:
    if abs(pt[K])>max_z and abs(pt[K])<min_z:
        ran_pts.append(pt)
# ---------- end pts ----------
dispatch_3 = Dispatch(List=pt_8, DispatchPattern=smaller_3.SmallerThan)  # -> ListA, ListB
pdecon_4 = Deconstruct(Point=dispatch_3.ListB)  # -> XComponent, YComponent, ZComponent
geo_3 = Geometry(pts.ran_pts)
number_slider_22 = Slider(5, range=0..10)  # disabled
larger_3 = LargerThan(FirstNumber=pdecon_4.ZComponent, SecondNumber=Slider(1400, range=0..10000))  # -> LargerThan, OrEqualTo
geo_4 = Geometry(dispatch_3.ListB)
geo_5 = Geometry(dispatch_3.ListA)

number_slider_23 = Slider(-0.133, range=-1..1)
seed = Slider(503, range=0..1000)
number_slider_24 = Slider(0.195, range=-1..1)
seed_2 = Slider(650, range=0..1000)

seed_3 = Slider(623, range=0..1000)
seed_4 = Slider(798, range=0..1000)

contour_2 = Contour(Shape=mesh_9, Point=item_2, Direction=Vector(0, 0, 1), Distance=number_slider_22)  # -> flatten(Contours); disabled
dispatch_4 = Dispatch(List=dispatch_3.ListB, DispatchPattern=larger_3.LargerThan)  # -> ListA, ListB
geo_6 = Geometry(dispatch_4.ListA)
explode = Explode(Curve=contour_2, Recursive=True)  # -> Segments, Vertices; disabled
type_2 = ValueList({"One": 1, "Two": 2, "Three": 3, "Four": 4}, selected="One")  # disabled
number_slider_25 = Slider(2, range=0..10)  # disabled
pt_9 = Point(move_2.Geometry)  # disabled
gradient_points = GhPythonScript(pts=flatten(geo_5), value=Slider(0.289, range=-1..1), seed=seed_3)  # -> out, new_pts; inputs pts: list
# ---------- gradient_points: Python ----------
__author__ = "WeiTingChen"

import Rhino.Geometry as rg
import random as r 
r.seed(seed)

def reMap(val, smin, smax, tmin, tmax):
    return (val - smin) / (smax - smin) * (tmax - tmin) + tmin
    
def create_radom_list(lst):
    o_max = max(lst)
    o_min = min(lst)
    
    new_lst = []
    r_lst = []
    for i in range(len(lst)):
        
        lst[i] = reMap(lst[i], o_min, o_max, 0.0, 1.0)
        new_lst.append(lst[i])
        r_lst.append(r.random())
        print(lst[i], r.random())
    return new_lst, r_lst


sorted_pts = sorted(pts, key=lambda pt:pt[2]) # sorted by z
z_pts = [pt[2] for pt in sorted_pts] 
# print z_pts
remap_list, r_lst = create_radom_list(z_pts)

new_pts =[]
for i, pt in enumerate(sorted_pts):
    if remap_list[i] > r_lst[i] + value:
        new_pts.append(pt)
# ---------- end gradient_points ----------
gradient_points_2 = GhPythonScript(pts=flatten(geo_6), value=Slider(0.043, range=-1..1), seed=seed_4)  # -> out, new_pts; inputs pts: list
# ---------- gradient_points_2: Python ----------
__author__ = "WeiTingChen"

import Rhino.Geometry as rg
import random as r 
r.seed(seed)

def reMap(val, smin, smax, tmin, tmax):
    return (val - smin) / (smax - smin) * (tmax - tmin) + tmin
    
def create_radom_list(lst):
    o_max = max(lst)
    o_min = min(lst)
    
    new_lst = []
    r_lst = []
    for i in range(len(lst)):
        
        lst[i] = reMap(lst[i], o_min, o_max, 0.0, 1.0)
        new_lst.append(lst[i])
        r_lst.append(r.random())
        print(lst[i], r.random())
    return new_lst, r_lst


sorted_pts = sorted(pts, key=lambda pt:pt[2]) # sorted by z
z_pts = [pt[2] for pt in sorted_pts] 
# print z_pts
remap_list, r_lst = create_radom_list(z_pts)

new_pts =[]
for i, pt in enumerate(sorted_pts):
    if remap_list[i] < r_lst[i] + value:
        new_pts.append(pt)
# ---------- end gradient_points_2 ----------

number_slider_26 = Slider(0.289, range=-1..1)
seed_5 = Slider(623, range=0..1000)
number_slider_27 = Slider(0.043, range=-1..1)
seed_6 = Slider(798, range=0..1000)

geo_7 = Geometry(dispatch_4.ListB)
python_4 = GhPythonScript(points=pt_9, type=type_2)  # -> out, glass; inputs points: list of Point3d; disabled; same code as python_2
panel_3 = Panel("""-1
8""")  # disabled
item_3 = ListItem(List=explode.Segments, Index=panel_3, Wrap=True)  # disabled
merge_2 = Merge(Data1=gradient_points.new_pts, Data2=geo_7, Data3=gradient_points_2.new_pts)
pt_10 = Point(merge_2)
offset = OffsetSurface(Surface=python_4.glass, Distance=number_slider_25, Retrim=True)  # disabled
cull_i = CullIndex(List=explode.Segments, Indices=panel_3, Wrap=True)  # disabled
fsim = FindSimilarMember(Data=pt_10, Set=pt_8)  # -> Hit, Index
item_4 = ListItem(List=data_3, Index=fsim.Index, Wrap=True)
item_5 = ListItem(List=pt_8, Index=fsim.Index, Wrap=True)
cull_i_2 = CullIndex(List=pt_8, Indices=fsim.Index, Wrap=True)
join_2 = JoinCurves(Curves=cull_i, Preserve=False)  # disabled
xz_3 = XZPlane(Origin=item_5)
pt_11 = Point(item_5)
item_6 = ListItem(List=join_2, Index=0, Wrap=True)  # -> flatten(Item), flatten(Item1); disabled
larger_4 = LargerThan(FirstNumber=item_4, SecondNumber=Slider(40, range=0..100))  # -> LargerThan, OrEqualTo
cir = Circle(Plane=xz_3, Radius=item_4)
crv_4 = Curve(item_6.Item)  # disabled
crv_5 = Curve(item_6.Item1)  # disabled
number_slider_28 = Slider(50, range=0..100)
python_5 = GhPythonScript(front_polys=crv_5, back_polys=crv_4, bottle=offset)  # -> out, print_points, new_front_polys, port, betweens_b, print_points_b, new_back_polys; inputs front_polys: list of Polyline, back_polys: list of Polyline, bottle: list of Brep; disabled
# ---------- python_5: Python ----------
import Rhino.Geometry as rg
import math
from itertools import chain
import Rhino as rc 

number_of_between_points = 4
step = 1.0 / ( number_of_between_points + 1 )
allowed_distance_based_on_overhang = 5.0 / math.tan(0.25*math.pi) # 45 degree overhang
# print(allowed_distance_based_on_overhang)
bottle_length = 68


points = []
betweens = []
print_points = [] 
new_front_polys =[]
total_count = [0 for _ in range(len(bottle))]

lines =[] 

# front_polys
for k,p in enumerate(front_polys):
    
    betweens_per_layer = [] 
    print_points_per_layer =[]
    removed_pts_per_layer = []
    
    for i, b in enumerate(bottle):
        crv = p.ToNurbsCurve()
        event = rg.Intersect.Intersection.CurveBrep(crv, b, 0.1)
        
        # find the intersect with layer line
        if len(event[2]) != 0:
            # create counter 
            total_count[i] += 1
            # create points for overhang
            p1 = event[2][1]
            p2 = event[2][0]
            points.append(p1)
            line = rg.Line(p1,p2)
            
            between = [line.PointAt(bz*step) for bz in range(1, number_of_between_points+1) if line.Length >1]
            bbox_center = b.GetBoundingBox(rg.Plane.WorldXY).Center
            
            #move the point to meet with geo
            if line.PointAt(0.5)[2] > bbox_center[2] + 5*2: # add more two layers
                print(total_count[i])
                #event2 = rg.Intersect.Intersection.ProjectPointsToBreps([b], between, rg.Vector3d(0,1,0), 0)
                vec = rg.Vector3d(0, (bottle_length/1.5)/(total_count[i]-7),0)
                trans = rg.Transform.Translation(vec)
                _ = [b.Transform(trans) for b in between]
                between = [p1] + between + [p2]
            #move as allowed by overhang
            else:
                vec = rg.Vector3d(0, allowed_distance_based_on_overhang*total_count[i], 0)
                trans = rg.Transform.Translation(vec)
                mid_between = (between[1] + between[2])/2
                mid_between.Transform(trans)
                between = [ between[0], mid_between, between[3]]
                
            # if print point in between
            for j, pt in enumerate(p):
                distance = line.DistanceTo(pt, 0.1)
                if distance < 0.1:  
                    removed_pts_per_layer.append(j)
            betweens_per_layer.extend(between)
    for i in range(len(p)):
        if i not in removed_pts_per_layer:
            print_points_per_layer.append(p[i])
    print_points_per_layer.extend(betweens_per_layer)
    print_pts_per_layer = sorted(print_points_per_layer, key = lambda pt :pt[0])
    print_points.append(print_pts_per_layer)
    new_front_polys.append(rg.Polyline(print_pts_per_layer))


# back_polys
betweens_b = []
print_points_b = [] 
new_back_polys = []
for k,p in enumerate(back_polys):
    
    betweens_per_layer = [] 
    print_points_per_layer =[]
    removed_pts_per_layer = []
    
    for i, b in enumerate(bottle):
        crv = p.ToNurbsCurve()
        event = rg.Intersect.Intersection.CurveBrep(crv, b, 0.1)
        
        # find the intersect with layer 
        if len(event[2]) != 0:
            # create counter 
            total_count[i] +=1
            
            # create points for overhang
            p1 = event[2][1]
            p2 = event[2][0]
            points.append(p1)
            line = rg.Line(p1,p2)
            between = [line.PointAt(bz*step) for bz in range(1, number_of_between_points+1)] 
            bbox_center = b.GetBoundingBox(rg.Plane.WorldXY).Center
            
            # move as allowed by overhang
            vec = rg.Vector3d(0, -allowed_distance_based_on_overhang*2, 0)
            trans = rg.Transform.Translation(vec)
            
            mid_between = (between[1] + between[2])/2
            mid_between.Transform(trans)
            
            between = [p1] + [mid_between] + [p2]
            betweens_per_layer.extend(between)
            
            # if print point in between
            for j, pt in enumerate(p):
                distance = line.DistanceTo(pt, 0.1)
                if distance < 0.1:  
                    removed_pts_per_layer.append(j)
    for i in range(len(p)):
        if i not in removed_pts_per_layer:
            print_points_per_layer.append(p[i])
            
    print_points_per_layer.extend(betweens_per_layer)
    print_pts_per_layer = sorted(print_points_per_layer, key = lambda pt :pt[0])
    print_points_b.append(print_pts_per_layer)
    new_back_polys.append(rg.Polyline(print_pts_per_layer))
# ---------- end python_5 ----------

dispatch_5 = Dispatch(List=item_5, DispatchPattern=larger_4.LargerThan)  # -> ListA, ListB
xz_4 = XZPlane(Origin=dispatch_5.ListA)
xz_5 = XZPlane(Origin=dispatch_5.ListB)
cir_2 = Circle(Plane=xz_4, Radius=Slider(9, range=0..10))
cir_3 = Circle(Plane=xz_5, Radius=Slider(12.25, range=0..100))
pt_12 = Point(cull_i_2)

mesh_10 = Mesh(mesh_4)
Y_3 = UnitY(Factor=number_slider_28)
Y_4 = UnitY(Factor=expr("-x", number_slider_28))
move_3 = Move(Geometry=mesh_10, Motion=Y_3)  # -> Geometry, Transform
move_4 = Move(Geometry=mesh_10, Motion=Y_4)  # -> Geometry, Transform
back = Geometry(move_3.Geometry)
front = Geometry(move_4.Geometry)
geo_8 = Geometry(pt_11)

back_2 = Geometry(move_3.Geometry)
front_2 = Geometry(move_4.Geometry)
geo_9 = Geometry(cull_i_2)
meshcp_2 = MeshClosestPoint(Point=geo_9, Mesh=back_2)  # -> Point, Index, Parameter
meshcp_3 = MeshClosestPoint(Point=geo_9, Mesh=front_2)  # -> Point, Index, Parameter
ln_2 = Line(StartPoint=meshcp_2.Point, EndPoint=meshcp_3.Point)
midpt = CurveMiddle(Curve=ln_2)

meshcp_4 = MeshClosestPoint(Point=geo_8, Mesh=back)  # -> Point, Index, Parameter
meshcp_5 = MeshClosestPoint(Point=geo_8, Mesh=front)  # -> Point, Index, Parameter
ln_3 = Line(StartPoint=meshcp_4.Point, EndPoint=meshcp_5.Point)
midpt_2 = CurveMiddle(Curve=ln_3)
number_slider_29 = Slider(5, range=0..10)
number_slider_30 = Slider(5, range=0..10)
height_2 = Data(height)
height_3 = Data(height)
pt_13 = Point(midpt_2)
division_3 = Division(A=height_2, B=number_slider_29)
division_4 = Division(A=height_3, B=number_slider_30)
back_3 = Geometry(back)
front_3 = Geometry(front)
Y_5 = UnitY(Factor=expr("-x", Slider(100, range=0..100)))
pt_14 = Point(midpt_2)
move_5 = Move(Geometry=pt_14, Motion=Y_5)  # -> Geometry, Transform
meshcp_6 = MeshClosestPoint(Point=pt_13, Mesh=back_3)  # -> Point, Index, Parameter
series = Series(Start=0, Step=number_slider_29, Count=expr("x+1", division_3))
series_2 = Series(Start=0, Step=number_slider_30, Count=expr("x+1", division_4))
pdecon_5 = Deconstruct(Point=pt_13)  # -> XComponent, YComponent, ZComponent
ln_4 = Line(StartPoint=pt_14, EndPoint=move_5.Geometry)
pdecon_6 = Deconstruct(Point=meshcp_6.Point)  # -> XComponent, YComponent, ZComponent
pt_15 = ConstructPoint(XCoordinate=0, YCoordinate=0, ZCoordinate=series)
pt_16 = ConstructPoint(XCoordinate=0, YCoordinate=0, ZCoordinate=series_2)
mcx_2 = MeshCurve(Mesh=front_3, Curve=ln_4)  # -> flatten(Points), Faces
pt_17 = ConstructPoint(XCoordinate=pdecon_6.XComponent, YCoordinate=pdecon_6.YComponent, ZCoordinate=pdecon_5.ZComponent)
xy = XYPlane(Origin=pt_15)
xy_2 = XYPlane(Origin=pt_16)
# front
python_6 = GhPythonScript(input_mesh=front_3, planes=xy)  # -> out, section_crvs, selected_curves, selected_curves_ID; inputs input_mesh: Mesh, planes: list, pattern_crvs: list of Curve
# ---------- python_6: Python ----------
__author__ = "WeiTingChen"

import Rhino.Geometry as rg
import ghpythonlib.components as gh


section_crvs = rg.Intersect.Intersection.MeshPlane(input_mesh, planes)

dists =[]
cls_pts = []
for i, crv in enumerate(section_crvs):
    pts = crv.ToArray()
    cls_pts_layer = [] 
    for j, p_crv in enumerate(pattern_crvs):
        # create the intersect points with plane
        event = rg.Intersect.Intersection.CurvePlane(p_crv, planes[i], 0.0)
        pts_layer =[] 
        if event != None:
            interset_pt = event.Item[j].PointA
            for k, pt in enumerate(pts):
                min_dist = float('inf')
                dist = pt.DistanceTo(interset_pt)
                if dist < min_dist:
                    min_dist = dist
                    min_pt = interset_pt
            cls_pts_layer.append(min_pt)
    
    cls_pts.append(cls_pts_layer)

selected_curves = []
selected_curves_ID = []
for i, crv in enumerate(section_crvs):
    if i % 5 == 0:
        selected_curves.append(crv)
        selected_curves_ID.append(i)
# ---------- end python_6 ----------
# back
python_7 = GhPythonScript(input_mesh=back_3, planes=xy_2)  # -> out, section_crvs, selected_curves, selected_curves_ID; inputs input_mesh: Mesh, planes: list, pattern_crvs: list of Curve; same code as python_6
pt_18 = Point(pt_17)
pt_19 = Point(mcx_2.Points)
section_crv = Curve(python_6.section_crvs)
python_8 = GhPythonScript(input_pts=pt_19, curves=section_crv)  # -> out, new_pts, cls_pts, dists, curve_indices; inputs input_pts: list of Point3d, curves: list of Curve
# ---------- python_8: Python ----------
__author__ = "WeiTingChen"

import Rhino.Geometry as rg
import ghpythonlib.components as gh

def cloestest_pt(pts, curves):
    dists = []
    curve_indices = []
    cls_pts = []
    for pt in pts:
        min_pt = rg.Point3d(0,0,0)
        min_dist = float('inf')
        cls_curve_index = 0
        for i, curve in enumerate(curves):
            cls_param = curve.ClosestPoint(pt)[1]
            cls_pt = curve.PointAt(cls_param)
            dist = pt.DistanceTo(cls_pt)
            if dist < min_dist :
                min_dist = dist
                min_pt = cls_pt
                cls_curve_index = i
        cls_pts.append(min_pt)
        dists.append(min_dist)
        curve_indices.append(cls_curve_index)
    return cls_pts, dists, curve_indices

cls_pts, dists, curve_indices = cloestest_pt(input_pts, curves)

new_pts = list(input_pts)

for i, pt in enumerate(new_pts):
    if i in curve_indices:
        pt = cls_pts
    else:
        pt = pt
# ---------- end python_8 ----------
section_crv_2 = Curve(python_7.section_crvs)
ghpython_script_3 = GhPythonScript(points=pt_18, layer_height=Slider(5, range=0..10), contours=section_crv_2)  # -> out, new_points; inputs points: list of Point3d, contours: list of Curve; same code as python
ghpython_script_4 = GhPythonScript(points=pt_19, layer_height=Slider(5, range=0..10), contours=section_crv)  # -> out, new_points; inputs points: list of Point3d, contours: list of Curve; same code as python
back_4 = Geometry(back_3)
front_4 = Geometry(front_3)
pt_20 = Point(ghpython_script_3.new_points)
pt_21 = Point(ghpython_script_4.new_points)

ln_5 = Line(StartPoint=pt_20, EndPoint=pt_21)
vec2pt = Vector2Pt(PointA=pt_21, PointB=pt_20, Unitize=False)  # -> unitize(Vector), Length

crv_6 = Curve(ln_5)
midpt_3 = CurveMiddle(Curve=crv_6)
vec = Vector(vec2pt.Vector)
dispatch_6 = Dispatch(List=midpt_3, DispatchPattern=larger_4.LargerThan)  # -> ListA, ListB
dispatch_7 = Dispatch(List=vec, DispatchPattern=larger_4.LargerThan)  # -> ListA, ListB
type_3 = ValueList({"One": 1, "Two": 2, "Three": 3, "Four": 4, "Five": 5, "Six": 6, "Seven": 7, "Eight": 8, "Nine": 9, "Ten": 10}, selected="Ten")
python_9 = GhPythonScript(points=dispatch_6.ListA, normal=dispatch_7.ListA, type=type_3)  # -> out, glass, planes, a, b; inputs points: list of Point3d, normal: list of Vector3d
# ---------- python_9: Python ----------
import rhinoscriptsyntax as rs
import Rhino.Geometry as rg

def glass_mk(centroid, type):
    
    if type == 1 :
        diameters = [20, 20, 20, 50, 60]
        length = [108, 98, 80, 20, 0]
    elif type ==2 :
        diameters = [32, 32, 32, 73, 83]
        length = [150, 140, 108, 20, 0]
    elif type ==3:
        diameters = [32, 32, 32, 82, 92]
        length = [180, 170, 142, 20, 0]
    elif type ==4 :
        diameters = [49, 49, 49, 118, 118]
        length = [223, 213, 170, 20, 0]
    elif type ==6 :
        diameters = [29, 29, 29, 125, 115]
        length = [300, 266, 131, 60, 0]   
    elif type ==8:
        diameters = [26, 26, 26, 102, 92]
        length = [250, 223, 108, 66, 0]
    elif type ==9 :
        diameters = [24.50, 24.50, 24.50, 24.50, 14.50]
        length = [150, 100, 80, 20, 0]   
    else :
        diameters = [17.50, 17.50, 17.50, 17.50, 7.50]
        length = [180, 150, 100, 20, 0]

    circles = []
    
    for d in diameters:
        cir = rg.Circle(rg.Plane.WorldZX,d/2)
        circles.append(cir)
    
    for cr, l in zip(circles,length):
        t = rg.Transform.Translation(rg.Vector3d.YAxis*l)
        cr.Transform(t)
    
    center_point = 0.5 * (circles[0].Center + circles[-1].Center)
    
    
    curves = [c.ToNurbsCurve(1, 20) for c in circles]
    loft = rg.Brep.CreateFromLoft(curves, rg.Point3d.Unset, rg.Point3d.Unset, rg.LoftType.Straight, False)[0]
    
    vec = centroid - center_point
    trans = rg.Transform.Translation(vec)
    loft.Transform(trans)
    
    return loft, length[0], diameters[-1]

glass = []

planes = []
for i, p in enumerate(points):
    plane_on_srf = rg.Plane(p, normal[i])
    base = rg.Plane(p, rg.Plane.WorldZX.ZAxis)
    t = rg.Transform.PlaneToPlane(base, plane_on_srf)
    gl, a, b = glass_mk(p, type)
    
    planes.append(plane_on_srf)
    gl.Transform(t)
    glass.append(gl)
# ---------- end python_9 ----------
type_4 = ValueList({"One": 1, "Two": 2, "Three": 3, "Four": 4, "Five": 5, "Six": 6, "Seven": 7, "Eight": 8, "Nine": 9, "Ten": 10}, selected="Nine")
python_10 = GhPythonScript(points=dispatch_6.ListB, normal=dispatch_7.ListB, type=type_4)  # -> out, glass, planes, a, b; inputs points: list of Point3d, normal: list of Vector3d; same code as python_9
geo_10 = Geometry([python_9.planes, python_10.planes])
geo_11 = Geometry(python_9.glass)
lng_2 = ListLength(List=geo_11)
geo_12 = Geometry(python_10.glass)
lng_3 = ListLength(List=geo_12)
geo_13 = Geometry([python_9.planes, python_10.planes])
number_slider_31 = Slider(1.25, range=0..10)
repeat = RepeatData(Data="9", Length=lng_3)
repeat_2 = RepeatData(Data="10", Length=lng_2)
geo_14 = Geometry([geo_11, geo_12])
bbox = BoundingBox(Content=graft(geo_14), Plane=graft(geo_10), UnionBox=False)  # -> Box, Box_2
area = Area(Geometry=bbox.Box)  # -> Area, Centroid
deplane = DeconstructPlane(Plane=geo_13)  # -> Origin, XAxis, YAxis, ZAxis
data_4 = Data([repeat_2, repeat])
scale_nu = ScaleNU(
    Geometry=geo_14,
    Plane=flatten(area.Centroid),
    ScaleX=number_slider_31,
    ScaleY=Slider(1, range=0..10),
    ScaleZ=number_slider_31)  # -> Geometry, Transform
vec_2 = Vector(flatten(deplane.ZAxis))
geo_15 = Geometry(geo_14)
geo_16 = Geometry(deplane.Origin)
# back
python_11 = GhPythonScript(bottle_type=data_4, bottle_center=geo_16, front_polys=section_crv_2, bottle=flatten(geo_15), vec=vec_2)  # -> out, print_points, new_front_polys, port, lines, moved_betweens, print_points_per_layer, print_points_2; inputs bottle_type: list of Int32, bottle_center: list of Point3d, front_polys: list of Polyline, bottle: list of Brep, vec: list of Vector3d
# ---------- python_11: Python ----------
import Rhino.Geometry as rg
import math
import itertools as iter

import compas
from compas_ghpython.utilities import list_to_ghtree
from compas.utilities import flatten

def flatten_list(data):
    flat_list =[]
    # iterating over the data
    for element in data:
        # checking for list
        if type(element) == list:
            # calling the same function with current element as new argument
            flatten_list(element)
        else:
            flat_list.append(element)
    return flat_list


number_of_between_points = 4
step = 1.0 / ( number_of_between_points + 1 )
allowed_distance_based_on_overhang = -25

points = []
betweens = []
print_points = [] 
lines =[] 


moved_betweens =[] 
 
for k,p in enumerate(front_polys):
    
    betweens_per_layer = [] 
    print_points_per_layer =[]
    removed_pts_per_layer = []
    events = []
    total_count = [0 for _ in bottle]
    for i, b in enumerate(bottle):
        # bottle 10
        if bottle_type[i] == 10:
            
            crv = p.ToPolylineCurve()
            event = rg.Intersect.Intersection.CurveBrep(crv, b, 0.0)
            
            # find the intersect with layer 
            if len(event[2]) != 0 :
                # create points for overhang
                p1 = event[2][0]
                p2 = event[2][1]
                points.append(p1)
                line = rg.Line(p1,p2)
                between =[]
                for bz in range(1, number_of_between_points+1):
                    between.append(line.PointAt(bz*step))
                    
                betweens.append(between)
                
                # move as allowed by overhang
                mid_between = (between[0] + between[3])/2
                vec[i].Unitize()
                
                # move inside on last layer for bottle
                if mid_between[2] == bottle_center[i][2] :
                    vec_overhang = vec[i]*(allowed_distance_based_on_overhang-5)
                else:
                    vec_overhang = -vec[i]*allowed_distance_based_on_overhang
                    
                trans = rg.Transform.Translation(vec_overhang)
                mid_between.Transform(trans)
                new_between = [p1, mid_between, p2]
                new_between = sorted(new_between, key= lambda pt:pt[0])
                moved_betweens.append(new_between)
                betweens_per_layer.extend(new_between)
                
                # remove the short path
                for j, pt in enumerate(p):
                    distance = line.DistanceTo(pt, 0.1)
                    if distance < 10:  
                        removed_pts_per_layer.append(j)
                events.append(line)
                
        # bottle 9
        if bottle_type[i] == 9:
            
            crv = p.ToPolylineCurve()
            event = rg.Intersect.Intersection.CurveBrep(crv, b, 0.0)
            
            # find the intersect with layer 
            if len(event[2]) != 0 :
                # create points for overhang
                p1 = event[2][0]
                p2 = event[2][1]
                points.append(p1)
                line = rg.Line(p1,p2)
                between =[]
                for bz in range(1, number_of_between_points+1):
                    between.append(line.PointAt(bz*step))
                    
                betweens.append(between)
                
                # move as allowed by overhang
                mid_between = (between[0] + between[3])/2
                vec[i].Unitize()
                
                
                # move inside on last layer for bottle
                if mid_between[2] <= (bottle_center[i][2]-5*2):
                    vec_overhang = -vec[i]*0
                elif mid_between[2] == (bottle_center[i][2]+5):
                    vec_overhang = vec[i]*(allowed_distance_based_on_overhang-5)
                else:
                    vec_overhang = -vec[i]*allowed_distance_based_on_overhang
                    
                trans = rg.Transform.Translation(vec_overhang)
                mid_between.Transform(trans)
                new_between = [p1, mid_between, p2]
                new_between = sorted(new_between, key= lambda pt:pt[0])
                moved_betweens.append(new_between)
                betweens_per_layer.extend(new_between)
                
                # remove the short path
                for j, pt in enumerate(p):
                    distance = line.DistanceTo(pt, 0.1)
                    if distance < 10:  
                        removed_pts_per_layer.append(j)
                events.append(line)
    
    lines.append(events)
    print_points_per_layer.extend(betweens_per_layer)
    # list the pt in section 
    for i in range(len(p)):
        if i not in removed_pts_per_layer:
            print_points_per_layer.append(p[i])
    
    print_points_per_layer = sorted(print_points_per_layer, key= lambda pt: pt[0])
    print_points.append(print_points_per_layer)

print_points = list_to_ghtree(print_points)
# ---------- end python_11 ----------
# front
python_12 = GhPythonScript(bottle_type=data_4, bottle_center=geo_16, front_polys=section_crv, bottle=flatten(geo_15), vec=vec_2)  # -> out, print_points, new_front_polys, port, lines, moved_betweens, print_points_per_layer, print_points_2; inputs bottle_type: list of Int32, bottle_center: list of Point3d, front_polys: list of Polyline, bottle: list of Brep, vec: list of Vector3d
# ---------- python_12: Python ----------
import Rhino.Geometry as rg
import math
import itertools as iter

import compas
from compas_ghpython.utilities import list_to_ghtree
from compas.utilities import flatten

def flatten_list(data):
    flat_list =[]
    # iterating over the data
    for element in data:
        # checking for list
        if type(element) == list:
            # calling the same function with current element as new argument
            flatten_list(element)
        else:
            flat_list.append(element)
    return flat_list


number_of_between_points = 4
step = 1.0 / ( number_of_between_points + 1 )
allowed_distance_based_on_overhang = 25

points = []
betweens = []
print_points = [] 
lines =[] 


moved_betweens =[] 
 
for k,p in enumerate(front_polys):
    
    betweens_per_layer = [] 
    print_points_per_layer =[]
    removed_pts_per_layer = []
    events = []
    total_count = [0 for _ in bottle]
    for i, b in enumerate(bottle):
        # bottle 10
        if bottle_type[i] == 10:
            
            crv = p.ToPolylineCurve()
            event = rg.Intersect.Intersection.CurveBrep(crv, b, 0.0)
            
            # find the intersect with layer 
            if len(event[2]) != 0 :
                # create points for overhang
                p1 = event[2][0]
                p2 = event[2][1]
                points.append(p1)
                line = rg.Line(p1,p2)
                between =[]
                for bz in range(1, number_of_between_points+1):
                    between.append(line.PointAt(bz*step))
                    
                betweens.append(between)
                
                # move as allowed by overhang
                mid_between = (between[0] + between[3])/2
                vec[i].Unitize()
                
                # move inside on last layer for bottle
                if mid_between[2] == bottle_center[i][2]:
                    vec_overhang = vec[i]*(allowed_distance_based_on_overhang-5)
                else:
                    vec_overhang = -vec[i]*allowed_distance_based_on_overhang
                    
                trans = rg.Transform.Translation(vec_overhang)
                mid_between.Transform(trans)
                new_between = [p1, mid_between, p2]
                new_between = sorted(new_between, key= lambda pt:pt[0])
                moved_betweens.append(new_between)
                betweens_per_layer.extend(new_between)
                
                # remove the short path
                for j, pt in enumerate(p):
                    distance = line.DistanceTo(pt, 0.1)
                    if distance < 10:  
                        removed_pts_per_layer.append(j)
                events.append(line)
                
        # bottle 9
        if bottle_type[i] == 9:
            
            crv = p.ToPolylineCurve()
            event = rg.Intersect.Intersection.CurveBrep(crv, b, 0.0)
            
            # find the intersect with layer 
            if len(event[2]) != 0 :
                # create points for overhang
                p1 = event[2][0]
                p2 = event[2][1]
                points.append(p1)
                line = rg.Line(p1,p2)
                between =[]
                for bz in range(1, number_of_between_points+1):
                    between.append(line.PointAt(bz*step))
                    
                betweens.append(between)
                
                # move as allowed by overhang
                mid_between = (between[0] + between[3])/2
                vec[i].Unitize()
                
                
                # move inside on last layer for bottle
                if mid_between[2] <= (bottle_center[i][2]-5*2):
                    vec_overhang = -vec[i]*0
                elif mid_between[2] == (bottle_center[i][2]+5):
                    vec_overhang = vec[i]*(allowed_distance_based_on_overhang-5)
                else:
                    vec_overhang = -vec[i]*allowed_distance_based_on_overhang
                    
                trans = rg.Transform.Translation(vec_overhang)
                mid_between.Transform(trans)
                new_between = [p1, mid_between, p2]
                new_between = sorted(new_between, key= lambda pt:pt[0])
                moved_betweens.append(new_between)
                betweens_per_layer.extend(new_between)
                
                # remove the short path
                for j, pt in enumerate(p):
                    distance = line.DistanceTo(pt, 0.1)
                    if distance < 10:  
                        removed_pts_per_layer.append(j)
                events.append(line)
    
    lines.append(events)
    print_points_per_layer.extend(betweens_per_layer)
    # list the pt in section 
    for i in range(len(p)):
        if i not in removed_pts_per_layer:
            print_points_per_layer.append(p[i])
    
    print_points_per_layer = sorted(print_points_per_layer, key= lambda pt: pt[0])
    print_points.append(print_points_per_layer)

print_points = list_to_ghtree(print_points)
# ---------- end python_12 ----------
geo_17 = Geometry(simplify(python_12.print_points_2))
geo_18 = Geometry(simplify(python_11.print_points_2))
number_slider_32 = Slider(20, range=0..20)  # disabled
number_slider_33 = Slider(0, range=0..10)  # disabled
number_slider_34 = Slider(1.5, range=0..10)  # disabled
pline = PolyLine(Vertices=geo_18, Closed=False)  # -> flatten(Polyline)
pline_2 = PolyLine(Vertices=geo_17, Closed=False)  # -> flatten(Polyline)
geo_19 = Geometry()  # disabled
curve_2 = Curve(reparameterize(<curve referenced from the Rhino model>))  # disabled
number_slider_35 = Slider(20, range=0..100)  # disabled
python_13 = GhPythonScript(pts=geo_19, min_dist=number_slider_35)  # -> out, dists, selected_pts, selected_pts_ID; inputs pts: list of Point3d; disabled
# ---------- python_13: Python ----------
__author__ = "WeiTingChen"

import Rhino.Geometry as rg
import ghpythonlib.components as gh
import compas


dists = []
selected_pts = []
selected_pts_ID = []
for i, pt in enumerate(pts):
    dist = abs(pt[1])
    dists.append(dist)
    if dist > min_dist:
        selected_pts.append(pt)
        selected_pts_ID.append(i)
# ---------- end python_13 ----------
ghpython_script_5 = GhPythonScript(c=curve_2, k=number_slider_34, count=number_slider_32, seam_param=number_slider_33)  # -> out, a, points; inputs c: Curve, count: Int32; disabled
# ---------- ghpython_script_5: Python ----------
import Rhino.Geometry as rg
import math

curve_domain = c.Domain
print curve_domain
curve_domain_length = curve_domain[1] - curve_domain[0]

step =  (curve_domain_length - 2 * seam_param )/ (count - 2)
points = []

t_vals = [i * step for i in range(count-1)]
points = [c.PointAt(val) for val in t_vals]

a = t_vals
# ---------- end ghpython_script_5 ----------
pt_22 = Point()  # disabled
geo_20 = Geometry()  # disabled
pt_23 = Point(python_13.selected_pts)  # disabled
data_5 = Data(python_13.selected_pts_ID)  # disabled
geo_21 = Geometry()  # disabled
geo_22 = Geometry()  # disabled
pdecon_7 = Deconstruct(Point=geo_21)  # -> XComponent, YComponent, ZComponent; disabled
pdecon_8 = Deconstruct(Point=geo_22)  # -> XComponent, YComponent, ZComponent; disabled
geo_23 = Geometry(geo_15)
number_slider_36 = Slider(0.3, range=0..1)  # disabled
number_slider_37 = Slider(1.5, range=0..10)  # disabled
pt_24 = ConstructPoint(XCoordinate=pdecon_7.XComponent, YCoordinate=0, ZCoordinate=pdecon_7.ZComponent)  # disabled
pt_25 = ConstructPoint(XCoordinate=pdecon_8.XComponent, YCoordinate=0, ZCoordinate=pdecon_8.ZComponent)  # disabled
crv_7 = Curve(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)  # disabled
bnd_5 = Bounds(Numbers=pdecon_8.ZComponent)  # disabled
number_slider_38 = Slider(50, range=0..1000)  # disabled
number_slider_39 = Slider(180, range=0..1000)  # disabled
number_slider_40 = Slider(0.01, range=0..0.01)  # disabled
geo_24 = Geometry()  # disabled
number_slider_41 = Slider(30, range=0..1000)  # disabled
dom = ConstructDomain(DomainStart=number_slider_36, DomainEnd=number_slider_37)  # disabled
number_slider_42 = Slider(60, range=0..100)  # disabled
number_slider_43 = Slider(100, range=0..1000)  # disabled
reb = RebuildCurve(Curve=crv_7, Count=10, Tangents=False)  # disabled
remap_4 = RemapNumbers(Value=pdecon_8.ZComponent, Source=bnd_5, Target=dom)  # -> Mapped, Clipped; disabled
Y_6 = UnitY(Factor=expr("-x", number_slider_42))  # disabled
lng_4 = ListLength(List=geo_24)  # disabled
move_6 = Move(Geometry=geo_24, Motion=Y_6)  # -> Geometry, Transform; disabled
number_slider_44 = Slider(60, range=0..1000)  # disabled
number_slider_45 = Slider(125, range=0..200)  # disabled
number_slider_46 = Slider(78, range=0..100)  # disabled
# front and back curves
# create the front and back mesh
mesh_11 = Geometry(mesh_2)  # disabled
toggle = BooleanToggle(False)  # disabled
trigger = Trigger(Interval=100, TimerInterval=100, Target=python_16)  # disabled
repeat_3 = RepeatData(Data=number_slider_39, Length=lng_4)  # disabled
toggle_2 = BooleanToggle(True)  # disabled
timer = Timer(Interval=20, TimerInterval=20, Target=counter)  # disabled
python_14 = GhPythonScript(tol=number_slider_40)  # -> out, pts_projected, pts_in_crv; inputs pts: list of Point3d, boundary_crv: Curve; disabled
# ---------- python_14: Python ----------
__author__ = "WeiTingChen"

import Rhino.Geometry as rg
import ghpythonlib.components as gh



pts_in_crv = []
for pt in pts:
    
    pts_projected = rg.Point3d(pt[0], 0, pt[2])
    pt_contain = boundary_crv.Contains(pts_projected, rg.Plane.WorldZX, tol)
    
    if pt_contain == rg.PointContainment.Inside:
        pts_in_crv.append(pt)
# ---------- end python_14 ----------
python_15 = GhPythonScript(
    boundaryCurve=reb,
    time=number_slider_43,
    basicCollisionDistance=number_slider_38,
    numPoints=number_slider_41,
    factors=remap_4.Mapped,
    points=pt_25,
    centers=pt_24)  # -> out, totalPoints, centers; inputs boundaryCurve: Curve, time: Int32, numPoints: Int32, factors: list, points: list of Point3d, centers: list of Point3d; disabled
# ---------- python_15: Python ----------
def SearchCallback(sender, data):
    sData = data.Tag
    sData.points.add(data.Id)

class SearchData:
    
    # make a SearchData object with two attributes (a set of vertices and a boolean addedVert)
    def __init__(self):
        self.points = set() #initialize vertices as an empty set


totalPoints = []

import Rhino.Geometry as rg
from copy import deepcopy

pointCloud = rg.PointCloud(points)
boundaryCurve.Domain = rg.Interval(0,1)

for t in range(time):
    
    totalMoves = []
    collisionCounts = []
    
    #i am making a new RTree for every moment
    tree = rg.RTree()
    #make a list  of 0.0 and zero Vectors 
    for k in range( len(centers)):
        totalMoves.append(rg.Vector3d(0,0,0))
        collisionCounts.append(0.0)
        
        #i am inserting all the points
        tree.Insert(centers[k], k)
        
    for i in range(len(centers)):
        
        closestIdx = pointCloud.ClosestPoint(centers[i])
        collisionDistance = basicCollisionDistance * factors[closestIdx]
        
        #i don't want to look in Aaaalll the centers
        
        radius = collisionDistance
        sphere = rg.Sphere(centers[i], radius)
        sData = SearchData()
            
        #if intersection is found, SearchCallback is called, data.Id is added to sData.vertices
        tree.Search(sphere, SearchCallback, sData) #sData = data.Tag
        intersect = sData.points #intersections for every vertice
        
        
        for j in intersect:
            d = centers[i].DistanceTo(centers[j])
            if (d > collisionDistance):
                continue
            move = centers[i] - centers[j]
            if (move.Length < 0.001):
                 continue
            move.Unitize();
            move *= (collisionDistance - d)
            totalMoves[i] += move
            totalMoves[j] -= move
            collisionCounts[i] += 1.0
            collisionCounts[j] += 1.0
            
    
    #average all moving vectors
    for i in range(len(centers)):
        
     
        if (collisionCounts[i] != 0.0):
            
            vec = 0.5*(totalMoves[i] / collisionCounts[i])
            centers[i] += vec
        
        closestIdx = pointCloud.ClosestPoint(centers[i])
        collisionDistance = 0.25*basicCollisionDistance * factors[closestIdx]
        
        #checking for boundaries
        if centers[i].X < collisionDistance:
            centers[i] += rg.Vector3d(collisionDistance,0,0)
        
        if centers[i].X > 1750 - collisionDistance:
            centers[i] -= rg.Vector3d(collisionDistance,0,0)
        
        if centers[i].Y < collisionDistance:
            centers[i] += rg.Vector3d(0,collisionDistance,0)
        
        if centers[i].Y > 875 - 10:
            centers[i] -= rg.Vector3d(0,collisionDistance,0)
        
            
    
        
    temp = deepcopy(centers)    
    totalPoints.append(temp)
# ---------- end python_15 ----------
python_16 = GhPythonScript(reset=toggle)  # -> out, a, b; inputs reset: Boolean; disabled
# ---------- python_16: Python ----------
import rhinoscriptsyntax as rs
import Rhino
import Rhino.Geometry as rg
import random as rnd
import scriptcontext as sc
 
class Agents:
    def __init__(self):
        self.p = rg.Point3d(rnd.uniform(-100,100),rnd.uniform(-100,100),0)
        self.v = rs.VectorUnitize(rs.VectorCreate(targetPt,self.p))
 
    def update(self):
        self.detect()
        self.p = self.p + self.v
        if self.p.X == 100:
            self.p.X = rnd.uniform(-100,100)
            self.p.Y = rnd.uniform(-100,100)
        elif self.p.X == -100:
            self.p.X = rnd.uniform(-100,100)
            self.p.Y = rnd.uniform(-100,100)
        elif self.p.Y ==100:
            self.p.X = rnd.uniform(-100,100)
            self.p.Y = rnd.uniform(-100,100)
        elif self.p.Y ==-100:
            self.p.X = rnd.uniform(-100,100)
            self.p.Y = rnd.uniform(-100,100)
     
        if rs.VectorLength(self.v) ==1.5:
            self.v = rs.VectorUnitize(self.v)/2
     
        self.v = self.v + rs.VectorUnitize(rs.VectorCreate(targetPt,self.p))/3
     
    def detect(self):
        for i in pts:
            if rs.Distance(i.p,self.p) == 0:
                if rs.Distance(i.p,self.p) == 10:
                    self.v = self.v + rs.VectorUnitize(rs.VectorCreate(self.p,i.p))
     


def setup():
    global pts
    global targetPt
    pts = []
    targetPt = rg.Point3d(0,0,0)
    numOfPts = 30
    for i in range(numOfPts):
        pts.append(Agents())
 
    glbCenterPts = []
    glbPtsVelocity = []
 
    for pt in pts:
        pt.update()
        glbCenterPts.append(pt.p)
        glbPtsVelocity.append(pt.v)
 
    a = glbCenterPts
    b = glbPtsVelocity
    return a, b 

if reset:
    setup()

a, b = setup()
# ---------- end python_16 ----------
number_slider_47 = Slider(13, range=0..100)  # disabled
ghpython_script_6 = GhPythonScript(input=mesh_11, points=move_6.Geometry, lengths=repeat_3, lmax=number_slider_44, lmin=number_slider_45)  # -> out, a, points; inputs points: list of Point3d, lengths: list; disabled
# ---------- ghpython_script_6: Python ----------
import compas
import rhinoscriptsyntax as rs
import Rhino.Geometry as rg
from compas_rhino.geometry import RhinoMesh
from compas.geometry import add_vectors
from compas.geometry import scale_vector
from compas_ghpython.artists import MeshArtist
from compas.datastructures import mesh_flip_cycles, meshes_join

def remap(OldValue, OldMin, OldMax, NewMin, NewMax):
    return (((OldValue - OldMin) * (NewMax - NewMin)) / (OldMax - OldMin)) + NewMin


mesh = RhinoMesh.from_guid(input).to_compas()

offset = mesh.copy()

#calculate offsets based on distance from glass
offsets = []
dist_pts = []

oldmin = min(lengths)
oldmax = max(lengths)

distances = []

for idx,p in enumerate(points):
    length = abs(800 - 0.5*lengths[idx])
    vec = rg.Vector3d(0,  0.5* length,0 )
    trans = rg.Transform.Translation(vec)
    p.Transform(trans)

# to find the domain of values to remap later
for vertex in rs.MeshVertices(input):
    vertex = rg.Point3d(vertex[0], vertex[1], vertex[2])
    
    minDist = 99999999999999
    minIdx = 0
    for idx,p in enumerate(points): 
        
        dist = p.DistanceTo(vertex)
        if dist < minDist :
            minDist = dist
            minIdx = idx
    
    dist = vertex.DistanceTo(points[minIdx])
    distances.append( dist)

oldmin = min(distances)
oldmax = max(distances)


# actual moving
for vertex in rs.MeshVertices(input):
    vertex = rg.Point3d(vertex[0], vertex[1], vertex[2])
    
    minDist = 99999999999999
    minIdx = 0
    for idx,p in enumerate(points):
        dist = p.DistanceTo(vertex)
        if dist < minDist :
            minDist = dist
            minIdx = idx
    
    dist = vertex.DistanceTo(points[minIdx])
    value = remap(dist, oldmin, oldmax, lmin,lmax)
    offsets.append( value)
    


for i,key in enumerate(offset.vertices()):
    normal = mesh.vertex_normal(key)
    xyz = mesh.vertex_coordinates(key)
    
    distance = offsets[i]
    offset.vertex_attributes(key, 'xyz', add_vectors(xyz, scale_vector(normal, distance)))
    
# flip bottom part
mesh_flip_cycles(offset)

# join parts
thickened_mesh = meshes_join([mesh, offset])

# close boundaries
n = thickened_mesh.number_of_vertices() / 2

edges_on_boundary = [edge for boundary in list( thickened_mesh.edges_on_boundaries() ) for edge in boundary]

for u, v in edges_on_boundary:
    if u < n and v < n:
        key = thickened_mesh.add_face([u, v, v + n, u + n])
        
        #delete top + btm
        if thickened_mesh.face_normal(key) == [0,0,1] or thickened_mesh.face_normal(key) == [0,0,-1]:
            thickened_mesh.delete_face(key)

a = MeshArtist(thickened_mesh).draw()
# ---------- end ghpython_script_6 ----------
# grid and gradinat points
# remove the points if them are too close to boundary
panel_4 = Panel("distrubtion ")  # disabled
vec_3 = Vector(python_16.b)  # disabled
counter = Counter(Reset=toggle_2)  # disabled
panel_5 = Panel(counter)  # disabled
circle_2 = CircleCNR(Center=python_16.a, Normal=Vector(0, 0, 1), Radius=number_slider_47)  # disabled
mesh_12 = Geometry(ghpython_script_6.a)  # disabled
ghpython_script_7 = GhPythonScript(x=python_15.totalPoints)  # -> out, a; disabled
# ---------- ghpython_script_7: Python ----------
a=x
# ---------- end ghpython_script_7 ----------
tree_statistics = TreeStatistics(Tree=ghpython_script_7.a)  # -> Paths, Length, Count; disabled
item_7 = ListItem(List=tree_statistics.Paths, Index=counter, Wrap=True)  # disabled
tree_branch = TreeBranch(Tree=ghpython_script_7.a, Path=item_7, MaintainPaths=True)  # disabled
number_slider_48 = Slider(5, range=0..10)  # disabled

# ---- group: Moving Points Down
list_length = ListLength()  # disabled
panel_6 = Panel("1")  # disabled
number_slider_49 = Slider(2, range=0..10)  # disabled
repeat_data = RepeatData(Data=panel_6, Length=list_length)  # disabled
flip = FlipCurve()  # -> Curve, Flag; disabled
mesh_13 = Mesh(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)  # disabled
ghpython_script_8 = GhPythonScript(back=flip.Curve, mesh=mesh_13, fac=number_slider_49, front_s=repeat_data, back_s=repeat_data)  # -> scaled, intersection, out, test, front_polys, back_polys; inputs front: list of Polyline, back: list of Polyline, mesh: Mesh, breps: list of Brep, points: list of Point3d, diameters: list, front_s: list, back_s: list; disabled
# ---------- ghpython_script_8: Python ----------
import Rhino.Geometry as rg
import math
from copy import deepcopy

lines = []
intersection = []

def deform_path(front_polys, back_polys, y, center, fac, number_of_between_points ):
    index = []
    inter = []
    test = []
    test2 = []
    step = 1.0 / ( number_of_between_points + 1 )
    length = len(front_polys)
    plane = rg.Plane.WorldXY
    plane.Origin = center
    trans = rg.Transform.Scale(plane,1,1,fac)
    scaled = deepcopy(y)
    scaled.Transform(trans)
    

#   front 
    for k,p in enumerate(front_polys):
        
        c = p.ToNurbsCurve()
        
        c.Domain = rg.Interval(0,1)
        event = rg.Intersect.Intersection.CurveBrep(c, scaled, 0.1)

        p1 = event[2][0]
        points.append(p1)
        p2 = event[2][1]
        points.append(p2)
        #if there is a point between them
        paraA = c.ClosestPoint(p1)[1]
        paraB = c.ClosestPoint(p2)[1]
        
        for px in p:
            paraC = c.ClosestPoint(px)[1]
            if (paraC >paraA and paraC<paraB) or (paraC >paraB and paraC<paraA):
                index .append( p.ClosestIndex(px))
                #print (k, index, "reomoved", paraA, paraB, paraC)
                
        index.reverse()
        for x in index:
            p.RemoveAt(x)
            
        index = []
        
        line = rg.Line(p1,p2)
        
        flo = 1.0 / (number_of_between_points-1)
        betweens = [line.PointAt(i*flo) for i in range(1, number_of_between_points-1)]
        
        #if under the bottle
        if k<(0.5*length):
            vec = rg.Vector3d(0,0, -(k)*2.5)
            trans = rg.Transform.Translation(vec)
            for b in betweens:
                b.Transform(trans)
        else:
            vec = rg.Vector3d(0,0, (length-1-k)*2.5)
            trans = rg.Transform.Translation(vec)
            for b in betweens:
                b.Transform(trans)
                
        #project the points back on the mesh to avoid problems due to deleting points
        help = [rg.Line(rg.Point3d(px.X, px.Y + 1000, px.Z), rg.Point3d(px.X, px.Y - 1000, px.Z)) for px in betweens]
        temp = [rg.Intersect.Intersection.MeshLine(mesh, li)[0][0] for li in help]
        betweens = temp
        
        closestp1 = p.ClosestIndex(p1)
        closestp2 = p.ClosestIndex(p2)
        
        inter.extend(betweens)
        
        #print closestp1, closestp2
        if closestp1!=closestp2:
            new_polyline = list(p)[:closestp1+1] + [p1] + betweens + [p2] + list(p)[closestp2:]
        else:
            new_polyline = list(p)[:closestp1+1] + [p1] + betweens + [p2] + list(p)[closestp2+1:]
            
        
                
        test.append(rg.Polyline(new_polyline))
    
    
   #back
    for k,p in enumerate(back_polys):
        c = p.ToNurbsCurve()          
        event = rg.Intersect.Intersection.CurveBrep(c, scaled, 0.1) 
        p1 = event[2][0]
        points.append(p1)
        p2 = event[2][1]
        points.append(p2)
        
        #if there is a point between them
        paraA = c.ClosestPoint(p1)[1]
        paraB = c.ClosestPoint(p2)[1]
        
        for px in p:
            paraC = c.ClosestPoint(px)[1]
            if (paraC >paraA and paraC<paraB) or (paraC >paraB and paraC<paraA):
                index .append( p.ClosestIndex(px))
                #print (k, index, "reomoved", paraA, paraB, paraC)
                
        index.reverse()
        for x in index:
            p.RemoveAt(x)
            
        index = []

        line = rg.Line(p1,p2)
        
        flo = 1.0 / (number_of_between_points-1)
        betweens = [line.PointAt(i*flo) for i in range(1, number_of_between_points-1)]
        
       #if under the bottle
        if k<(0.5*len(back_polys)):
            vec = rg.Vector3d(0,0, -(k)*2.5)
            trans = rg.Transform.Translation(vec)
            for b in betweens:
                b.Transform(trans)
        #if above the bottle
        else:
            vec = rg.Vector3d(0,0, (len(back_polys)-1-k)*2.5)
            trans = rg.Transform.Translation(vec)
            for b in betweens:
                b.Transform(trans)    
        closestp1 = p.ClosestIndex(p1)
        closestp2 = p.ClosestIndex(p2)
        
        
        inter.extend(betweens)
        
        #print len(betweens)
        if closestp1!=closestp2:
            new_polyline = list(p)[:closestp1+1] + [p1] + betweens + [p2] + list(p)[closestp2:]
        else:
            new_polyline = list(p)[:closestp1] + [p1] + betweens + [p2] + list(p)[closestp2+1:]
            
        test2.append(rg.Polyline(new_polyline))
        
        
    
    return test , test2, inter

vertical_shift_front = 12
vertical_shift_back = 3

for idx, (brep, point, diam) in enumerate(zip(breps, points, diameters)):
    
    if diam != 14.5:
    
        if diam == 14.5:
            vertical_shift_front = 3
            vertical_shift_back = 3
            p_num = 3
        elif diam == 83:
            vertical_shift_front = 14
            vertical_shift_back = 3
            p_num = 4
        elif diam == 92:
            vertical_shift_front = 16
            vertical_shift_back = 3
            p_num = 4
        else:
            vertical_shift_front = 19
            vertical_shift_back = 3
            p_num = 4
        
        
    #find where is the center and then decide which pols are relevant
        
        #print diam
    
        for num, poli in enumerate(front):
            if point.Z - poli[0].Z == 2.5:
                t = num
                
        front_polys = front[t - vertical_shift_front + 1 : t + vertical_shift_front + 1]
        back_polys = back[t - vertical_shift_back + 1 : t + vertical_shift_back + 1]
        
        
        f_polys, b_polys, all_inter = deform_path(front_polys, back_polys, brep, point, fac, p_num )
        
        front_polys =  front[ : t - vertical_shift_front + 1] + f_polys + front[t + vertical_shift_front + 1 :]
        back_polys = back[ : t - vertical_shift_back + 1 ] + b_polys + back[t + vertical_shift_back + 1:]
    
        
        front = front_polys
        back = back_polys
        
        intersection.extend(all_inter)
# ---------- end ghpython_script_8 ----------

# ----
ghpython_script_9 = GhPythonScript(layer_height=number_slider_48)  # -> out, new_points; inputs points: list of Point3d, contours: list of Curve; disabled; same code as python
xz_6 = XZPlane(Origin=tree_branch)  # disabled
panel_7 = Panel("path optimzation ")  # disabled
panel_8 = Panel("1")  # disabled
cir_4 = Circle(Plane=xz_6, Radius=1)  # disabled
python_17 = GhPythonScript(k=panel_8)  # -> out, sub_mesh, vertrtex_curvature, rg_pts; inputs k: Int32; disabled
# ---------- python_17: Python ----------
__author__ = "WeiTingChen"

import Rhino.Geometry as rg
import ghpythonlib.components as gh
import compas

from compas.datastructures import Mesh
from compas.datastructures import mesh_subdivide_catmullclark

vertrtex_curvature = []
vertices = [] 
v_on_bounday = [] 
for key, attr in mesh.vertices(True):
    v_curvature = mesh.vertex_curvature(key)
    vertrtex_curvature.append(v_curvature)
    
    vertices.append(attr)
#    if key in mesh.vertices_on_boundaries()[0]:
#        v_on_bounday.append(attr)


# sub_mesh = mesh_subdivide_catmullclark(mesh=mesh, k=k, fixed=v_on_bounday)

rg_pts = [ rg.Point3d(v['x'], v['y'], v['z']) for v in vertices]
# ---------- end python_17 ----------
python_18 = GhPythonScript()  # -> out, print_points, new_front_polys, port, betweens_b, print_points_b, new_back_polys; inputs front_polys: list of Polyline, back_polys: list of Polyline, bottle: list of Brep; disabled
# ---------- python_18: Python ----------
import Rhino.Geometry as rg
import math
from itertools import chain
import Rhino as rc 

number_of_between_points = 4
step = 1.0 / ( number_of_between_points + 1 )
allowed_distance_based_on_overhang = 5.0 / math.tan(0.25*math.pi) # 45 degree overhang
# print(allowed_distance_based_on_overhang)
bottle_length = 68


points = []
betweens = []
print_points = [] 
new_front_polys =[]
total_count = [0 for _ in range(len(bottle))]

lines =[] 

# front_polys
for k,p in enumerate(front_polys):
    
    betweens_per_layer = [] 
    print_points_per_layer =[]
    removed_pts_per_layer = []
    
    for i, b in enumerate(bottle):
        crv = p.ToNurbsCurve()
        event = rg.Intersect.Intersection.CurveBrep(crv, b, 0.1)
        
        # find the intersect with layer line
        if len(event[2]) != 0:
            # create counter 
            total_count[i] += 1
            # create points for overhang
            p1 = event[2][1]
            p2 = event[2][0]
            points.append(p1)
            line = rg.Line(p1,p2)
            
            between = [line.PointAt(bz*step) for bz in range(1, number_of_between_points+1) if line.Length >1]
            bbox_center = b.GetBoundingBox(rg.Plane.WorldXY).Center
            
            #move the point to meet with geo
            if line.PointAt(0.5)[2] > bbox_center[2] + 5*2: # add more two layers
                print(total_count[i])
                #event2 = rg.Intersect.Intersection.ProjectPointsToBreps([b], between, rg.Vector3d(0,1,0), 0)
                vec = rg.Vector3d(0, (bottle_length/1.5)/(total_count[i]-8),0)
                trans = rg.Transform.Translation(vec)
                _ = [b.Transform(trans) for b in between]
                between = [p1] + between + [p2]
                print(between)
            #move as allowed by overhang
            else:
                vec = rg.Vector3d(0, allowed_distance_based_on_overhang*total_count[i], 0)
                trans = rg.Transform.Translation(vec)
                print(between)
                mid_between = (between[1] + between[2])/2
                mid_between.Transform(trans)
                between = [ between[0], mid_between, between[3]]
                
            # if print point in between
            for j, pt in enumerate(p):
                distance = line.DistanceTo(pt, 0.1)
                if distance < 0.1:  
                    removed_pts_per_layer.append(j)
            betweens_per_layer.extend(between)
    for i in range(len(p)):
        if i not in removed_pts_per_layer:
            print_points_per_layer.append(p[i])
    print_points_per_layer.extend(betweens_per_layer)
    print_pts_per_layer = sorted(print_points_per_layer, key = lambda pt :pt[0])
    print_points.append(print_pts_per_layer)
    new_front_polys.append(rg.Polyline(print_pts_per_layer))


# back_polys
betweens_b = []
print_points_b = [] 
new_back_polys = []
for k,p in enumerate(back_polys):
    
    betweens_per_layer = [] 
    print_points_per_layer =[]
    removed_pts_per_layer = []
    
    for i, b in enumerate(bottle):
        crv = p.ToNurbsCurve()
        event = rg.Intersect.Intersection.CurveBrep(crv, b, 0.1)
        
        # find the intersect with layer 
        if len(event[2]) != 0:
            # create counter 
            total_count[i] +=1
            
            # create points for overhang
            p1 = event[2][1]
            p2 = event[2][0]
            points.append(p1)
            line = rg.Line(p1,p2)
            between = [line.PointAt(bz*step) for bz in range(1, number_of_between_points+1)] 
            bbox_center = b.GetBoundingBox(rg.Plane.WorldXY).Center
            
            # move as allowed by overhang
            vec = rg.Vector3d(0, -allowed_distance_based_on_overhang*2, 0)
            trans = rg.Transform.Translation(vec)
            
            mid_between = (between[1] + between[2])/2
            mid_between.Transform(trans)
            
            between = [p1] + [mid_between] + [p2]
            betweens_per_layer.extend(between)
            
            # if print point in between
            for j, pt in enumerate(p):
                distance = line.DistanceTo(pt, 0.1)
                if distance < 0.1:  
                    removed_pts_per_layer.append(j)
    for i in range(len(p)):
        if i not in removed_pts_per_layer:
            print_points_per_layer.append(p[i])
            
    print_points_per_layer.extend(betweens_per_layer)
    print_pts_per_layer = sorted(print_points_per_layer, key = lambda pt :pt[0])
    print_points_b.append(print_pts_per_layer)
    new_back_polys.append(rg.Polyline(print_pts_per_layer))
# ---------- end python_18 ----------
ghpython_script_10 = GhPythonScript(mesh=python_17.sub_mesh)  # -> out, out_mesh; disabled
# ---------- ghpython_script_10: Python ----------
__author__ = "WeiTingChen"

import sys
import os

# add path of libraries
HERE = ghenv.LocalScope.ghdoc.Path

library_path = os.path.abspath(os.path.join(HERE, "..",".."))
print(library_path)
if not library_path in sys.path:
    sys.path.append(library_path)


#from compas_rhino import unload_modules
#unload_modules('cSlicer')
# load the library 
import imp
from utilities import util
imp.reload(util)

from compas.datastructures import Mesh

# c_mesh = util.rMesh2cMesh(mesh)

out_mesh = util.cMesh2rMesh(mesh)
# ---------- end ghpython_script_10 ----------
sort = SortList(Keys=python_17.vertrtex_curvature, ValuesA=python_17.rg_pts)  # -> Keys, ValuesA; disabled
crv_8 = Curve(graft(ghpython_script_8.front_polys))  # disabled
crv_9 = Curve(graft(ghpython_script_8.back_polys))  # disabled
brep_2 = Brep(ghpython_script_8.scaled)  # disabled
curve_3 = Curve(ghpython_script_8.test)  # disabled
number_slider_50 = Slider(72, range=0..100)  # disabled
number_slider_51 = Slider(6.229, range=0..10)  # disabled
number_slider_52 = Slider(10, range=0..10)  # disabled
number_slider_53 = Slider(0.346, range=0..1)  # disabled
geo_25 = Geometry(<curve referenced from the Rhino model>)  # disabled
crv_10 = Curve([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])  # disabled
swatch_2 = ColourSwatch(SwatchColor=RGB(255, 255, 255))  # disabled
swatch_3 = ColourSwatch(SwatchColor=RGB(255, 255, 255))  # disabled
geo_26 = Geometry()  # disabled
number_slider_54 = Slider(4, range=0..10)  # disabled
geo_27 = Geometry()  # disabled
swatch_4 = ColourSwatch(SwatchColor=RGB(56, 56, 56))  # disabled
geo_28 = Geometry([<curve referenced from the Rhino model> x3])  # disabled
wires = BrepWireframe(Brep=geo_26, Density=-1)  # disabled
number_slider_55 = Slider(3, range=0..10)  # disabled
dash = DashPattern(Curve=geo_25, Pattern=number_slider_51)  # -> Dashes, Gaps; disabled
swatch_5 = ColourSwatch(SwatchColor=RGB(0, 0, 0))  # disabled
number_slider_56 = Slider(0, range=0..10)  # disabled
swatch_6 = ColourSwatch(SwatchColor=RGB(255, 0, 0))  # disabled
dash_2 = DashPattern(Curve=crv_10, Pattern=number_slider_52)  # -> Dashes, Gaps; disabled
number_slider_57 = Slider(2, range=0..10)  # disabled
material = CreateMaterial(Diffuse=swatch_2, Specular=RGB(255, 255, 255), Emission=swatch_3, Transparency=number_slider_53, Shine=number_slider_50)  # disabled
swatch_7 = ColourSwatch(SwatchColor=RGB(255, 0, 0))  # disabled
previewlw = CustomPreviewLineweights(Geometry=flatten(geo_27), Shader=swatch_6, Thickness=number_slider_56, Absolute=False)  # disabled
previewlw_2 = CustomPreviewLineweights(Geometry=flatten(geo_28), Shader=swatch_5, Thickness=number_slider_55, Absolute=False)  # disabled
previewlw_3 = CustomPreviewLineweights(Geometry=flatten(wires), Shader=swatch_7, Thickness=number_slider_57, Absolute=False)  # disabled
previewlw_4 = CustomPreviewLineweights(Geometry=flatten(dash.Dashes), Shader=swatch_4, Thickness=number_slider_54, Absolute=False)  # disabled
preview_2 = CustomPreview(Geometry=geo_26, Material=material)  # disabled

geo_29 = Geometry(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)  # disabled
geo_30 = Geometry([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])  # disabled
geo_31 = Geometry([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])  # disabled

geo_32 = Geometry([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])  # disabled
type_5 = ValueList({"One": 1, "Two": 2, "Three": 3, "Four": 4}, selected="One")
pt_26 = Point(Point(1736.03472, -68.23604083, 47.5))
python_19 = GhPythonScript(points=pt_26, type=type_5)  # -> out, glass; inputs points: list of Point3d; same code as python_2
offset_2 = OffsetSurface(Surface=python_19.glass, Distance=Slider(2, range=0..10), Retrim=True)
crv_11 = Curve([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])
crv_12 = Curve([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])
brep_3 = Brep(offset_2)
brep_4 = Brep(offset_2)

# ---- group: test
crv_13 = Curve([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])
crv_14 = Curve([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])

# ----
python_20 = GhPythonScript(front_polys=crv_13, back_polys=crv_14, y=brep_4)  # -> out, test; inputs front_polys: list of Polyline, back_polys: list of Polyline, y: Brep
# ---------- python_20: Python ----------
import Rhino.Geometry as rg
import math
test = []
points = []
number_of_between_points = 4
step = 1.0 / ( number_of_between_points + 1 )

for k,p in enumerate(front_polys):
    
    c = p.ToNurbsCurve()
    event = rg.Intersect.Intersection.CurveBrep(c, y, 0.1)
    p1 = event[2][0]
    points.append(p1)
    p2 = event[2][1]
    
    line = rg.Line(p1,p2)
    betweens = [line.PointAt(i*step) for i in range(1, number_of_between_points+1)]
    
    #if under the bottle
    if k<8:
        #move as allowed by overhang
        allowed_distance_based_on_overhang = 5.0 / math.tan(0.25*math.pi)
        vec = rg.Vector3d(0,allowed_distance_based_on_overhang * (k+1), 0)
        trans = rg.Transform.Translation(vec)
        for b in betweens:
            b.Transform(trans)
    #if above the bottle
    else:
        #move the point to meet with geo
        event2 = rg.Intersect.Intersection.ProjectPointsToBreps([y], betweens, rg.Vector3d(0,1,0), 0.1)
        betweens = [poi for poi in event2]
    
    new_polyline = [p[0]] + [p1] + betweens + [p2] + [p[1]]
    test.append(rg.Polyline(new_polyline))
    
for k,p in enumerate(back_polys):
    
    c = p.ToNurbsCurve()
    event = rg.Intersect.Intersection.CurveBrep(c, y, 0.1)
    
    p1 = event[2][0]
    points.append(p1)
    p2 = event[2][1]
    
    line = rg.Line(p1,p2)
    betweens = [line.PointAt(i*0.33) for i in range(1, 3)]
    
    #move as allowed by overhang
    allowed_distance_based_on_overhang = 5.0 / math.tan(0.25*math.pi)
    vec = rg.Vector3d(0,-allowed_distance_based_on_overhang, 0)
    trans = rg.Transform.Translation(vec)
    for b in betweens:
        b.Transform(trans)
    
    new_polyline = [p[0]] + [p1] + betweens + [p2] + [p[1]]
    test.append(rg.Polyline(new_polyline))
# ---------- end python_20 ----------
python_21 = GhPythonScript(front_polys=crv_11, back_polys=crv_12, y=brep_3, center=pt_26, fac=Slider(2, range=0..10))  # -> scaled, out, test; inputs front_polys: list of Polyline, back_polys: list of Polyline, y: Brep, center: Point3d
# ---------- python_21: Python ----------
import Rhino.Geometry as rg
import math
from copy import deepcopy
test = []
points = []
number_of_between_points = 4
step = 1.0 / ( number_of_between_points + 1 )

length = len(front_polys)

plane = rg.Plane.WorldXY
plane.Origin = center
trans = rg.Transform.Scale(plane,1,1,fac)
scaled = deepcopy(y)
scaled.Transform(trans)


for k,p in enumerate(front_polys):
    
    c = p.ToNurbsCurve()
    
        
    event = rg.Intersect.Intersection.CurveBrep(c, scaled, 0.1)

    p1 = event[2][0]
    points.append(p1)
    p2 = event[2][1]
    
    line = rg.Line(p1,p2)
    betweens = [line.PointAt(i*0.33) for i in range(1, 3)]
    
    #if under the bottle
    if k<(0.5*length):
        vec = rg.Vector3d(0,0, -(k)*2.5)
        trans = rg.Transform.Translation(vec)
        for b in betweens:
            b.Transform(trans)
    else:
        vec = rg.Vector3d(0,0, (length-1-k)*2.5)
        trans = rg.Transform.Translation(vec)
        for b in betweens:
            b.Transform(trans)    
    new_polyline = [p[0]] + [p1] + betweens + [p2] + [p[1]]
    test.append(rg.Polyline(new_polyline))
        
for k,p in enumerate(back_polys):
    
    c = p.ToNurbsCurve()
    
        
    event = rg.Intersect.Intersection.CurveBrep(c, scaled, 0.1)

    p1 = event[2][0]
    points.append(p1)
    p2 = event[2][1]
    
    line = rg.Line(p1,p2)
    betweens = [line.PointAt(i*0.33) for i in range(1, 3)]
    
    #if under the bottle
    if k<(0.5*len(back_polys)):
        vec = rg.Vector3d(0,0, -(k)*2.5)
        trans = rg.Transform.Translation(vec)
        for b in betweens:
            b.Transform(trans)
    else:
        vec = rg.Vector3d(0,0, (len(back_polys)-1-k)*2.5)
        trans = rg.Transform.Translation(vec)
        for b in betweens:
            b.Transform(trans)    
    new_polyline = [p[0]] + [p1] + betweens + [p2] + [p[1]]
    test.append(rg.Polyline(new_polyline))
# ---------- end python_21 ----------
crv_15 = Curve(python_20.test)
brep_5 = Brep(python_21.scaled)
crv_16 = Curve(python_21.test)
lumbricid = Lumbricid(
    Curves=crv_15,
    SegmentLength=1,
    ProfileWidth=Slider(20, range=0..100),
    ProfileHeight=Slider(5, range=0..10),
    ProfileSegments=4,
    PathFraction=1,
    ColorByAge=False)
lumbricid_2 = Lumbricid(
    Curves=crv_16,
    SegmentLength=1,
    ProfileWidth=Slider(20, range=0..100),
    ProfileHeight=Slider(5, range=0..10),
    ProfileSegments=4,
    PathFraction=1,
    ColorByAge=False)
unifynormals = MeshUnifyNormals(Mesh=lumbricid)
unifynormals_2 = MeshUnifyNormals(Mesh=lumbricid_2)
flip_2 = MeshFlip(Mesh=unifynormals)
flip_3 = MeshFlip(Mesh=unifynormals_2)

number_slider_58 = Slider(5, range=0..10)
number_slider_59 = Slider(5, range=0..10)
height_4 = Data(height)
height_5 = Data(height)
pt_27 = Point(midpt)
division_5 = Division(A=height_4, B=number_slider_58)
division_6 = Division(A=height_5, B=number_slider_59)
back_5 = Geometry(back)
front_5 = Geometry(front)
Y_7 = UnitY(Factor=expr("-x", Slider(100, range=0..100)))
pt_28 = Point(midpt)
move_7 = Move(Geometry=pt_28, Motion=Y_7)  # -> Geometry, Transform
meshcp_7 = MeshClosestPoint(Point=pt_27, Mesh=back_5)  # -> Point, Index, Parameter
series_3 = Series(Start=0, Step=number_slider_58, Count=expr("x+1", division_5))
series_4 = Series(Start=0, Step=number_slider_59, Count=expr("x+1", division_6))
pdecon_9 = Deconstruct(Point=pt_27)  # -> XComponent, YComponent, ZComponent
ln_6 = Line(StartPoint=pt_28, EndPoint=move_7.Geometry)
pdecon_10 = Deconstruct(Point=meshcp_7.Point)  # -> XComponent, YComponent, ZComponent
pt_29 = ConstructPoint(XCoordinate=0, YCoordinate=0, ZCoordinate=series_3)
pt_30 = ConstructPoint(XCoordinate=0, YCoordinate=0, ZCoordinate=series_4)
mcx_3 = MeshCurve(Mesh=front_5, Curve=ln_6)  # -> flatten(Points), Faces
pt_31 = ConstructPoint(XCoordinate=pdecon_10.XComponent, YCoordinate=pdecon_10.YComponent, ZCoordinate=pdecon_9.ZComponent)
xy_3 = XYPlane(Origin=pt_29)
xy_4 = XYPlane(Origin=pt_30)
python_22 = GhPythonScript(input_mesh=front_5, planes=xy_3)  # -> out, section_crvs, selected_curves, selected_curves_ID; inputs input_mesh: Mesh, planes: list, pattern_crvs: list of Curve; same code as python_6
python_23 = GhPythonScript(input_mesh=back_5, planes=xy_4)  # -> out, section_crvs, selected_curves, selected_curves_ID; inputs input_mesh: Mesh, planes: list, pattern_crvs: list of Curve; same code as python_6
pt_32 = Point(pt_31)
pt_33 = Point(mcx_3.Points)
section_crv_3 = Curve(python_22.section_crvs)
section_crv_4 = Curve(python_23.section_crvs)
ghpython_script_11 = GhPythonScript(points=pt_32, layer_height=Slider(5, range=0..10), contours=section_crv_4)  # -> out, new_points; inputs points: list of Point3d, contours: list of Curve; same code as python
ghpython_script_12 = GhPythonScript(points=pt_33, layer_height=Slider(5, range=0..10), contours=section_crv_3)  # -> out, new_points; inputs points: list of Point3d, contours: list of Curve; same code as python
pt_34 = Point(ghpython_script_11.new_points)
pt_35 = Point(ghpython_script_12.new_points)
front_6 = Geometry(front_5)
back_6 = Geometry(back_5)
type_6 = ValueList({"One": 1, "Two": 2, "Three": 3, "Four": 4, "Five": 5, "Six": 6, "Seven": 7, "Eight": 8, "Nine": 9, "Ten": 10}, selected="Ten")

ln_7 = Line(StartPoint=pt_34, EndPoint=pt_35)
vec2pt_2 = Vector2Pt(PointA=pt_35, PointB=pt_34, Unitize=False)  # -> unitize(Vector), Length

crv_17 = Curve(ln_7)
midpt_4 = CurveMiddle(Curve=crv_17)
vec_4 = Vector(vec2pt_2.Vector)
python_24 = GhPythonScript(points=midpt_4, normal=vec_4, type=type_6)  # -> out, glass, planes, a, b; inputs points: list of Point3d, normal: list of Vector3d; same code as python_9
geo_33 = Geometry(python_24.glass)
lng_5 = ListLength(List=geo_33)
repeat_4 = RepeatData(Data="0", Length=lng_5)
geo_34 = Geometry(python_24.planes)
deplane_2 = DeconstructPlane(Plane=geo_34)  # -> Origin, XAxis, YAxis, ZAxis
geo_35 = Geometry(geo_33)
data_6 = Data(repeat_4)
vec_5 = Vector(flatten(deplane_2.ZAxis))
geo_36 = Geometry(deplane_2.Origin)

python_25 = GhPythonScript(bottle_type=data_6, bottle_center=geo_36, front_polys=pline_2, bottle=flatten(geo_35), vec=vec_5)  # -> out, print_points, new_front_polys, port, lines, moved_betweens, print_points_per_layer, print_points_2; inputs bottle_type: list of Int32, bottle_center: list of Point3d, front_polys: list of Polyline, bottle: list of Brep, vec: list of Vector3d
# ---------- python_25: Python ----------
import Rhino.Geometry as rg
import math
import itertools as iter

import compas
from compas_ghpython.utilities import list_to_ghtree
from compas.utilities import flatten

def flatten_list(data):
    flat_list =[]
    # iterating over the data
    for element in data:
        # checking for list
        if type(element) == list:
            # calling the same function with current element as new argument
            flatten_list(element)
        else:
            flat_list.append(element)
    return flat_list


number_of_between_points = 4
step = 1.0 / ( number_of_between_points + 1 )
allowed_distance_based_on_overhang = 20

points = []
betweens = []
print_points = [] 
lines =[] 
moved_betweens =[] 
 
for k,p in enumerate(front_polys):
    
    betweens_per_layer = [] 
    print_points_per_layer =[]
    removed_pts_per_layer = []
    events = []
    total_count = [0 for _ in bottle]
    for i, b in enumerate(bottle):
        # ornament
        if bottle_type[i] == 0:
            
            crv = p.ToPolylineCurve()
            event = rg.Intersect.Intersection.CurveBrep(crv, b, 0.0)
            
            # find the intersect with layer 
            if len(event[2]) != 0 :
                # create points for overhang
                p1 = event[2][0]
                p2 = event[2][1]
                points.append(p1)
                line = rg.Line(p1,p2)
                between =[]
                for bz in range(1, number_of_between_points+1):
                    between.append(line.PointAt(bz*step))
                    
                betweens.append(between)
                
                # move as allowed by overhang
                mid_between = (between[0] + between[3])/2
                vec[i].Unitize()
                
                # move inside on last layer for bottle
                if mid_between[2] <= bottle_center[i][2]:
                    vec_overhang = -vec[i]*allowed_distance_based_on_overhang
                else:
                    vec_overhang = vec[i]*0
                    
                trans = rg.Transform.Translation(vec_overhang)
                mid_between.Transform(trans)
                new_between = [p1, mid_between, p2]
                new_between = sorted(new_between, key= lambda pt:pt[0])
                moved_betweens.append(new_between)
                betweens_per_layer.extend(new_between)
                
                # remove the short path
                for j, pt in enumerate(p):
                    distance = line.DistanceTo(pt, 0.1)
                    if distance < 5:  
                        removed_pts_per_layer.append(j)
                events.append(line)
                
    lines.append(events)
    print_points_per_layer.extend(betweens_per_layer)
    # list the pt in section 
    for i in range(len(p)):
        if i not in removed_pts_per_layer:
            print_points_per_layer.append(p[i])
    
    print_points_per_layer = sorted(print_points_per_layer, key= lambda pt: pt[0])
    print_points.append(print_points_per_layer)

print_points = list_to_ghtree(print_points)
# ---------- end python_25 ----------
python_26 = GhPythonScript(bottle_type=data_6, bottle_center=geo_36, front_polys=section_crv_4, bottle=flatten(geo_35), vec=vec_5)  # -> out, print_points, new_front_polys, port, lines, moved_betweens, print_points_per_layer, print_points_2; inputs bottle_type: list of Int32, bottle_center: list of Point3d, front_polys: list of Polyline, bottle: list of Brep, vec: list of Vector3d
# ---------- python_26: Python ----------
import Rhino.Geometry as rg
import math
import itertools as iter

import compas
from compas_ghpython.utilities import list_to_ghtree
from compas.utilities import flatten

def flatten_list(data):
    flat_list =[]
    # iterating over the data
    for element in data:
        # checking for list
        if type(element) == list:
            # calling the same function with current element as new argument
            flatten_list(element)
        else:
            flat_list.append(element)
    return flat_list


number_of_between_points = 4
step = 1.0 / ( number_of_between_points + 1 )
allowed_distance_based_on_overhang = -20

points = []
betweens = []
print_points = [] 
lines =[] 
moved_betweens =[] 
 
for k,p in enumerate(front_polys):
    
    betweens_per_layer = [] 
    print_points_per_layer =[]
    removed_pts_per_layer = []
    events = []
    total_count = [0 for _ in bottle]
    for i, b in enumerate(bottle):
        # ornament
        if bottle_type[i] == 0:
            
            crv = p.ToPolylineCurve()
            event = rg.Intersect.Intersection.CurveBrep(crv, b, 0.0)
            
            # find the intersect with layer 
            if len(event[2]) != 0 :
                # create points for overhang
                p1 = event[2][0]
                p2 = event[2][1]
                points.append(p1)
                line = rg.Line(p1,p2)
                between =[]
                for bz in range(1, number_of_between_points+1):
                    between.append(line.PointAt(bz*step))
                    
                betweens.append(between)
                
                # move as allowed by overhang
                mid_between = (between[0] + between[3])/2
                vec[i].Unitize()
                
                # move inside on last layer for bottle
                if mid_between[2] <= bottle_center[i][2]:
                    vec_overhang = -vec[i]*allowed_distance_based_on_overhang
                else:
                    vec_overhang = vec[i]*0
                    
                trans = rg.Transform.Translation(vec_overhang)
                mid_between.Transform(trans)
                new_between = [p1, mid_between, p2]
                new_between = sorted(new_between, key= lambda pt:pt[0])
                moved_betweens.append(new_between)
                betweens_per_layer.extend(new_between)
                
                # remove the short path
                for j, pt in enumerate(p):
                    distance = line.DistanceTo(pt, 0.1)
                    if distance < 5:  
                        removed_pts_per_layer.append(j)
                events.append(line)
                
    lines.append(events)
    print_points_per_layer.extend(betweens_per_layer)
    # list the pt in section 
    for i in range(len(p)):
        if i not in removed_pts_per_layer:
            print_points_per_layer.append(p[i])
    
    print_points_per_layer = sorted(print_points_per_layer, key= lambda pt: pt[0])
    print_points.append(print_points_per_layer)

print_points = list_to_ghtree(print_points)
# ---------- end python_26 ----------
geo_37 = Geometry(simplify(python_25.print_points_2))
geo_38 = Geometry(simplify(python_26.print_points_2))
pline_3 = PolyLine(Vertices=geo_37, Closed=False)
pline_4 = PolyLine(Vertices=geo_38, Closed=False)
merge_3 = Merge(Data1=geo_37, Data2=reverse(geo_38))
pline_5 = PolyLine(Vertices=merge_3, Closed=invert(False))
crv_18 = Curve(flatten(pline_5))

graft = GraftTree(Tree=python_8.cls_pts, IncludeEmptyLists=True, IncludeNullItems=True)
tstat = TreeStatistics(Tree=graft)  # -> Paths, Length, Count
path = DataPath(python_8.curve_indices)
replace = ReplacePaths(Data=graft, Search=tstat.Paths, Replace=path)

split = SplitTree(Masks=flatten(path))  # -> Positive, Negative

cp = ClosestPoint(Point=replace, Cloud=split.Positive)  # -> ClosestPoint, CPIndex, Distance

replace_2 = ReplaceItems(List=split.Positive, Item=cp.ClosestPoint, Indices=cp.CPIndex, Wrap=False)
data_7 = Data(cp.CPIndex)
pline_6 = PolyLine(Vertices=replace_2, Closed=False)
pline_7 = PolyLine(Vertices=split.Negative, Closed=False)
merge_4 = Merge(Data1=pline_7, Data2=pline_6)  # -> flatten(Result)
tstat_2 = TreeStatistics(Tree=data_7)  # -> Paths, Length, Count
dpath = DeconstructPath(Branch=tstat_2.Paths)
python_27 = GhPythonScript(path=dpath, index=data_7)  # -> out, path; inputs path: tree, index: tree
# ---------- python_27: Python ----------
__author__ = "WeiTingChen"

import Rhino.Geometry as rg
import ghpythonlib.components as gh
import compas
from compas_ghpython.utilities import ghtree_to_list




# ghtree to list
path_list = [list(path.Branch(i)) for i in range(path.BranchCount)]
#path_list = ghtree_to_list(path)
index_list = [list(index.Branch(i)) for i in range(index.BranchCount)] 



path_dict = {}

for i, p in enumerate(path_list):
    path_dict[p[0]] = index_list[i]

class PathDict:
    pass


path = PathDict()
path.path_dict = path_dict
# ---------- end python_27 ----------
unflatten = UnflattenTree(Guide=data_7)
python_28 = GhPythonScript(back_polys=merge_4, path=python_27.path, bottle=unflatten, vec=vec_2)  # -> out, print_points, new_front_polys, port, events, moved_betweens, new_back_polys, betweens_per_layer; inputs front_polys: list of Polyline, back_polys: list of Curve, bottle: tree of Brep, vec: list of Vector3d
# ---------- python_28: Python ----------
import Rhino.Geometry as rg
import math
from itertools import chain
import Rhino as rc 

number_of_between_points = 4
step = 1.0 / ( number_of_between_points + 1 )
allowed_distance_based_on_overhang = 25 # 45 degree overhang

points = []
betweens = []
print_points = [] 

lines =[] 
print_points_b = [] 
new_back_polys = []
moved_betweens =[] 

bottle_list = [list(bottle.Branch(i)) for i in range(bottle.BranchCount)]

path_dict = path.path_dict
polys_crv = list(back_polys)
events = []

for k, p in enumerate(polys_crv):
    
    betweens_per_layer = [] 
    print_points_per_layer =[]
    removed_pts_per_layer = []
    
    if k in path_dict.keys():
        for i, bottle in enumerate(bottle_list):
            crv = p.ToNurbsCurve()
            # find the intersect with layer
            for c in range(1,2,1):
                event = rg.Intersect.Intersection.CurveBrep(polys_crv[k+c], b, 0.1)[2]
                events.append(event)
#                if len(event)>1:
#                    events.append(event)
#            for j, e in enumerate(events):
                # create points for overhang
#            p1 = event[0]
#            p2 = event[1]
#            points.append(p1)
#            line = rg.Line(p1,p2)
#            lines.append(line)
#            between =[]
#            for bz in range(1, number_of_between_points+1):
#                between.append(line.PointAt(bz*step))
#                between = sorted(between, key= lambda pt:pt[0])
#            betweens.append(between)
#            
#            # move as allowed by overhang
#            vec[i].Unitize()
#            
#            vec_overhang = -vec[i]*allowed_distance_based_on_overhang
#            trans = rg.Transform.Translation(vec_overhang)
#            mid_between = (between[0] + between[3])/2
#            mid_between.Transform(trans)
#            new_between = [between[0]] + [mid_between] + [between[3]]
##                elif j==2:
##                    vec_overhang = vec[i]*allowed_distance_based_on_overhang
##                    trans = rg.Transform.Translation(vec_overhang)
##                    mid_between = (between[0] + between[3])/2
##                    mid_between.Transform(trans)
##                
##                    new_between = [between[0]] + [mid_between] + [between[3]]
#            moved_betweens.append(new_between)            
#            betweens_per_layer.extend(moved_betweens)
#            
#            
#            for j, pt in enumerate(p):
#                distance = line.DistanceTo(pt, 0.1)
#                if distance < 0.1:  
#                    removed_pts_per_layer.append(j)
#    for i in range(len(p)):
#        if i not in removed_pts_per_layer:
#            print_points_per_layer.append(p[i])
#            
#    print_points_per_layer.extend(betweens_per_layer)
#    print_pts_per_layer = sorted(print_points_per_layer, key = lambda pt :pt[0])
#    print_points_b.append(print_pts_per_layer)
#    new_back_polys.append(rg.Polyline(print_pts_per_layer))
# ---------- end python_28 ----------
python_29 = GhPythonScript(x=python_28.events)  # -> out, a
# ---------- python_29: Python ----------
a = x
# ---------- end python_29 ----------
pline_8 = PolyLine(Vertices=python_29.a, Closed=False)
