# Grasshopper definition pick_and_place.gh (Grasshopper 1.0.7)

# ---- group: picking planes
number_slider = Slider(1, range=0..10)
pt = Point(Point(1349.351373, 3060.060791, -12))
xy = XYPlane(Origin=pt)
sqgrid = Square(Plane=xy, Size=Slider(159, range=0..1000), ExtentX=number_slider, ExtentY=number_slider)  # -> Cells, Points
pt_2 = Point(flatten(sqgrid.Points))

# ---- group: placing planes
number_slider_2 = Slider(1, range=0..10)
pt_3 = Point(Point(543.34344, 3051.264093, -12))
xy_2 = XYPlane(Origin=pt_3)
sqgrid_2 = Square(Plane=xy_2, Size=Slider(241, range=0..1000), ExtentX=number_slider_2, ExtentY=number_slider_2)  # -> Cells, Points
pt_4 = Point(flatten(sqgrid_2.Points))

# ----
split = TextSplit(Text="0,1,0", Separators=",")
split_2 = TextSplit(Text="-1,0,0", Separators=",")
pl = ConstructPlane(Origin=pt_4, XAxis="-1,0,0", YAxis="0,1,0")
xaxis = Data(split_2)
yaxis = Data(split)
export_to_json = GhPythonScript(file_name="pick_and_place_test", write_json=Toggle(False), picking_planes=pt_2, placing_planes=pt_4, Y=yaxis, X=xaxis)  # -> out, a; inputs picking_planes: list of Point3d, placing_planes: list of Point3d, Y: list, X: list
# ---------- export_to_json: Python ----------
from __future__ import division
import Rhino.Geometry as rg
from compas.geometry import Frame, Point, Vector
from datetime import datetime as dt
import math
import json


from json import encoder
encoder.FLOAT_REPR = lambda o: format(o, '.2f')

from compas.utilities import DataEncoder

class ProductionData(object):
    def __init__(self, actions=[]):
        self.actions = {action.id: action for action in actions}

    def append_action(self, namespace, action, action_id=None, dependency_ids=None):
        action_id = self.get_next_action_id() or action_id
        dependency_ids = [action_id - 1] if dependency_ids is None else dependency_ids
        partial_order_action = PartialOrderAction(action_id, namespace, action, dependency_ids)
        self.actions[action_id] = partial_order_action
    
    def get_next_action_id(self):
        if len(self.actions) == 0:
            return 1
        return sorted(self.actions.keys())[-1] + 1

    def get_namespaces(self):
        return set(a.namespace for a in self.actions.values())

    @property
    def data(self):
        return dict(
            actions=[p.to_data() for p in self.actions.values()]
        )
    
    @classmethod
    def from_data(cls, data):
        return cls([PartialOrderAction.from_data(d) for d in data['actions']])
    
    def to_data(self):
        return self.data

class PartialOrderAction(object):
    def __init__(self, action_id, namespace, action, dependency_ids):
        self.id = action_id
        self.namespace = namespace
        self.action = action
        self.dependency_ids = dependency_ids

    def __str__(self):
        return 'PartialOrderAction<id={}, namespace={}, action={}>'.format(self.id, self.namespace, self.action)

    @property
    def data(self):
        return dict(
            id=self.id,
            namespace=self.namespace,
            action=self.action.to_data(),
            dependency_ids=self.dependency_ids,
        )
    
    @classmethod
    def from_data(cls, data):
        return cls(data['id'], data['namespace'], Action.from_data(data['action']), data['dependency_ids'])
    
    def to_data(self):
        return self.data

class Action(object):
    def __init__(self, name, parameters={}):
        self.name = name
        self.parameters = parameters

    def __str__(self):
        return 'Action<name={}>'.format(self.name)

    @property
    def data(self):
        return dict(
            name=self.name,
            parameters={param_key: DataEncoder().default(p) if hasattr(p, 'to_data') else p for param_key, p in self.parameters.items()},
        )
    
    @classmethod
    def from_data(cls, data):
        return cls(data['name'], {param_key: DataDecoder().object_hook(p) if hasattr(p, '__iter__') else p for param_key, p in data['parameters'].items()})
    
    def to_data(self):
        return self.data  

class WriteJson():

    """
    export to JSON

    Attributes
    ----------
    dir_path : String
        Description
    file_name : String
        Description

    """

    def __init__(self, dir_path, file_name):

        self.dir_path = dir_path
        self.file_name = file_name

    def write_json_file(self, pick, place, namespace='/'):
        
        now = dt.now().strftime("%Y%m%d_")
        self.file_path = self.dir_path + now + self.file_name + ".json"

        print (self.file_path)

        production_data = ProductionData()
        
        # Reset signal
        #production_data.append_action(namespace, Action('SetDigital', dict(io_name = 'doGripperOn', value = 0)))
        
        production_data.append_action(namespace, Action('PrintText', dict(text='Gripper is off')))
        
        
        #Set Work Object (for now only one)
        production_data.append_action(namespace, Action('SetWorkObject', dict(wobj_name='ob_a032_ppce3dp_r21')))
        
        # Set tool        
        production_data.append_action(namespace, Action('SetTool', dict(tool_name='t_A032_T1_RFLTip')))
        
        
        production_data.append_action(namespace, Action('PrintText', dict(text='Tool and work object updated.')))
        
        #enumerate through both picking and placing frames
        for pick , place in zip(pick,place):
            
            # Define pick positions
            offset = 100
            speed = 200
            gantry = [ 33750.00, -4900.00, -2150.00 ]
            
            pre_pick_position = Frame(Point(pick.X, pick.Y, pick.Z + offset), X, Y)
            pick_position = Frame(Point(pick.X, pick.Y, pick.Z), X, Y)
            
            # Move over pick postion            
            production_data.append_action(namespace, Action('MoveToRobtarget', dict(frame=pre_pick_position, ext_axes = gantry , speed=speed, zone = 10)))
            
            # Move to pick postion
            production_data.append_action(namespace, Action('MoveToRobtarget', dict(frame=pick_position, ext_axes = gantry , speed=speed, zone = 10)))
            
            # Grab glass
            #production_data.append_action(namespace, Action('SetDigital', dict(io_name ='doGripperOn', value = 1)))
            
            production_data.append_action(namespace, Action('PrintText', dict(text='Grab glass.')))
            
            # Move over pick postion
            production_data.append_action(namespace, Action('MoveToRobtarget', dict(frame=pre_pick_position, ext_axes = gantry ,speed=speed, zone = -1)))
            
            # Define place positions
            pre_place_position = Frame(Point(place.X, place.Y, place.Z + offset), X, Y)
            place_position = Frame(Point(place.X, place.Y, place.Z), X, Y)

            # Move over place postion
            production_data.append_action(namespace, Action('MoveToRobtarget', dict(frame=pre_place_position, ext_axes = gantry ,speed=speed, zone = 10)))

            # Move to place postion
            production_data.append_action(namespace, Action('MoveToRobtarget', dict(frame=place_position, ext_axes = gantry , speed=speed, zone = -1)))

            # Leave glass
            #production_data.append_action(namespace, Action('SetDigital', dict(io_name ='doGripperOn', value = 0)))
            
            production_data.append_action(namespace, Action('PrintText', dict(text='Place glass.')))

            # Move over place postion
            production_data.append_action(namespace, Action('MoveToRobtarget', dict(frame=pre_place_position, ext_axes = gantry ,speed=speed, zone = 10)))
            
            
        with open(self.file_path, 'w') as fp:
            json.dump(production_data.to_data(), fp, indent=2, sort_keys=True)

        print('Generated JSON file: {}'.format(self.file_path))



HERE = ghenv.LocalScope.ghdoc.Path

dir_path = HERE[:-42] + "data/"
my_json_writer = WriteJson(dir_path, file_name)

if write_json:
    my_json_writer.write_json_file(picking_planes, placing_planes, namespace='/')
# ---------- end export_to_json ----------
panel = Panel(export_to_json.out)
