# Grasshopper definition pick_and_place_layout.gh (Grasshopper 1.0.7)
# plug-ins: Kangaroo2 Components

number_slider = Slider(600, range=0..1000)
pt = Point(Point(-742.5705458, 2710.342239, 0))
box = DomainBox(Base=pt, X=number_slider, Y=number_slider, Z=number_slider)
debrep = DeconstructBrep(Brep=box)  # -> Faces, Edges, Vertices
smesh = SimpleMesh(Brep=debrep.Faces)
item = ListItem(List=smesh, Index=0, Wrap=True)  # -> Item, Item1, Item2, Item3
clean = CombineClean(Meshes=[item.Item, item.Item1, item.Item2, item.Item3])
mesh = Mesh(clean)
# slicer with mesh input
mesh_2 = Mesh(mesh)

# ---- group: cuttung_planes
number_slider_2 = Slider(5, range=0..10)
series = Series(Start=number_slider_2, Step=number_slider_2, Count=Slider(50, range=0..1000))
pt_2 = ConstructPoint(XCoordinate=0, YCoordinate=0, ZCoordinate=series)
xy = XYPlane(Origin=pt_2)

# ----
seaming_point = Point(pt)

# ---- group: instantiate slice_object
list = ValueList({"Paralel": 0, "Crossing": 1}, selected="Crossing")
python = GhPythonScript(
    mode=list,
    imported_mesh=mesh_2,
    layer_height=Slider(0, range=0..10),
    layer_width=Slider(15, range=0..100),
    seaming_point=seaming_point,
    cutting_planes=xy,
    start_stop=Toggle(False),
    smoothing_distance=Slider(0, range=0..100))  # -> out, polyline, points, seaming_points, slice; inputs mode: Int32, imported_mesh: list, seaming_point: Point3d, cutting_planes: list of Plane
# ---------- python: Python ----------
import sys
import os
HERE = ghenv.LocalScope.ghdoc.Path

#add library reference
my_path = os.path.abspath(os.path.join(HERE, '..', '..'))

if not my_path in sys.path:
    sys.path.append(my_path)
    
import Rhino.Geometry as rg
from cSlicer import mesh_slicer

from compas_rhino import unload_modules
unload_modules('cSlicer')

from cSlicer.mesh_slicer import Mesh_slice
from cSlicer.print_param import Print_param

slice = Mesh_slice(imported_mesh, seaming_point, smoothing_distance, mode, start_stop,layer_height, layer_width, cutting_planes)

points = []

for i,layer in enumerate(slice.layers):
    
    points.extend([p.pt for p in layer.print_points])
    
#seaming_points = slice.seaming_points
polyline = rg.Curve.CreateInterpolatedCurve(points,1)
# ---------- end python ----------
crv = Curve(python.polyline)
pt_3 = Point(python.seaming_points)

# ---- group: color mesh faces depending on overhang
python_script = PythonScript(mesh=mesh_2)  # -> out, colors, a; inputs mesh: Mesh
# ---------- python_script: Python ----------
import sys
import Rhino.Geometry as rg
import math
import os
HERE = ghenv.LocalScope.ghdoc.Path

#add library reference
my_path = os.path.abspath(os.path.join(HERE, '..', '..'))

if not my_path in sys.path:
    sys.path.append(my_path)
    print "sucess"

#import library
from cSlicer import infill
import imp
imp.reload(infill)

from cSlicer.infill import Infill
from cSlicer.helper_functions import color_mesh_faces

myInfill = Infill(mesh)
colors = myInfill.colors
a = color_mesh_faces(mesh,colors)
# ---------- end python_script ----------

# ----
panel = Panel("209.52")
# create sequence of placing planes
panel_2 = Panel("1015.89")
pt_4 = ConstructPoint(XCoordinate=panel_2, YCoordinate="996.81", ZCoordinate="0")

# ----
# printability check
python_2 = GhPythonScript(polyline=crv)  # -> out, segments; inputs polyline: list of Polyline
# ---------- python_2: Python ----------
import sys
import os
HERE = ghenv.LocalScope.ghdoc.Path

#add library reference
my_path = os.path.abspath(os.path.join(HERE, '..', '..'))

if not my_path in sys.path:
    sys.path.append(my_path)

import Rhino.Geometry as rg
from cSlicer import evaluate_printability as ep

segments =[]

for poly in polyline:
    segments= ep.not_printable_segments(poly)
# ---------- end python_2 ----------

pt_5 = Point(pt_4)
crv_2 = Curve(python_2.segments)

# ---- group: design add-ons
add_ons = GhPythonScript(slice=python.slice)  # -> out, slice, glass
# ---------- add_ons: Python ----------
import sys
import os
import rhinoscriptsyntax as rs
from compas.data import json_dump

HERE = ghenv.LocalScope.ghdoc.Path

#add library reference
my_path = os.path.abspath(os.path.join(HERE, '..', '..'))
print my_path
if not my_path in sys.path:
    sys.path.append(my_path)
    #print "sucess"

from compas_rhino import unload_modules
unload_modules('cSlicer')
from cSlicer.addons import Add_on

glass = []

#design add-ons
for l,layer in enumerate(slice.layers):
    layer.add_ons = []
    if l%2==0:
        add_on = Add_on(layer.print_points[2].pt, layer)
        glass.append(layer.print_points[2].pt)
        layer.add_ons.append(add_on)
    print len(layer.add_ons)
# ---------- end add_ons ----------

# ----
sequence_grid = GhPythonScript(pt=pt_5, offset_z=Slider(75, range=0..100))  # -> out, pts_list; inputs pt: Point3d
# ---------- sequence_grid: Python ----------
__author__ = "WeiTingChen"

import Rhino.Geometry as rg

grid = []
step_x = 200
step_y = 200
count_x = 1
count_y = 1

pts_list = [] 
for i in range(0, step_x*count_x, step_x):
    for j in range(0, step_y*count_y, step_y):
        pts_list.append(rg.Point3d(pt[0]-i, pt[1]-j, pt[2] + offset_z))
# ---------- end sequence_grid ----------
layer_width = Slider(20, range=0..100)
layer_height = Slider(5, range=0..10)
pt_6 = Point(flatten(sequence_grid.pts_list))
crv_3 = Curve(crv)

# ----
# -organize add-ons per layer
# -compute dangeros zone per layer
# split printing to paths
# so that they alternate between
# being inside and outside a dangerous zone
section_into_paths = GhPythonScript(slice=add_ons.slice)  # -> slice, all_paths, boxes, dangerous_flags_by_path, all_paths_points
# ---------- section_into_paths: Python ----------
import Rhino.Geometry as rg
from copy import deepcopy
all_paths = []
all_paths_points = []
path_id = 0
last_pt_in_box = False
boxes = []
dangerous_flags_by_path = []

for i,layer in enumerate(slice.layers):
    
    #compute dangerous zone per layer
    points = [addon.center for addon in layer.add_ons]

    if len(points)== 0:
        interval0 = rg.Interval(-0.001, 0.001)
        box = rg.Box(rg.Plane.WorldXY, interval0, interval0, interval0)
    elif len(points)>1:
        box = rg.BoundingBox(points)
    else:
        plane = rg.Plane.WorldXY
        plane.Origin = points[0]
        interval = rg.Interval(-15,15)
        box = rg.Box(plane, interval, interval, interval)
    boxes.append(box)
    
    #change later
    if i==0 and box.Contains(layer.print_points[0].pt) is False:
        dangerous_flags_by_path.append(False)
    
    for p in layer.print_points:
        
        current_pt_in_box = box.Contains(p.pt)
        
        if last_pt_in_box != current_pt_in_box:
            path_id += 1
            
            
            item = " {} : {}".format(path_id, current_pt_in_box)
            dangerous_flags_by_path.append(current_pt_in_box)
            all_paths.append(item)
            
        p.path_id = path_id
        last_pt_in_box = current_pt_in_box
        
all_paths_points = [ [] for x in dangerous_flags_by_path]

for i,layer in enumerate(slice.layers):
    
    for p in layer.print_points:
        
        idx = p.path_id
        print idx
        all_paths_points[p.path_id].append(p.pt)
# ---------- end section_into_paths ----------

python_3 = GhPythonScript(x=section_into_paths.all_paths_points)  # -> out, a
# ---------- python_3: Python ----------
a =x
# ---------- end python_3 ----------
tstat = TreeStatistics(Tree=python_3.a)  # -> Paths, Length, Count
print_geometry = Curve(<curve referenced from the Rhino model>)

# ----
# concrete volume (L)
concrete_volume = GhPythonScript(layer_width=layer_width, layer_height=layer_height, curves=crv_3)  # -> out, volume; inputs curves: list of Curve
# ---------- concrete_volume: Python ----------
import sys
import System
import Grasshopper as GH

HERE = ghenv.LocalScope.ghdoc.Path

#add library reference
my_path = HERE[:-26] # + "cSlicer"

if not my_path in sys.path:
    sys.path.append(my_path)
    #print "sucess"

from compas_rhino import unload_modules
unload_modules('slicer')

from cSlicer.helper_functions import concrete_volume



volume = 0

for cv in curves:

    volume += concrete_volume (layer_width, layer_height, cv)
# ---------- end concrete_volume ----------
panel_3 = Panel(concrete_volume.volume)

item_2 = ListItem(List=tstat.Paths, Index=Slider(0, range=0..5), Wrap=True)
branch = TreeBranch(Tree=python_3.a, Path=item_2, MaintainPaths=True)
lng = ListLength(List=pt_6)
pl = ConstructPlane(Origin=pt_6, XAxis="-1,0,0", YAxis="0,1,0")
divide = DivideCurve(Curve=print_geometry, Count=lng, Kinks=False)  # -> Points, Tangents, Parameters
lng_2 = ListLength(List=branch)
slice = Data(python.slice)
panel_4 = Panel(branch)
split = TextSplit(Text="0,1,0", Separators=",")
split_2 = TextSplit(Text="-1,0,0", Separators=",")
panel_5 = Panel(lng_2)
target_plane = Plane(pl)
item_3 = ListItem(List=divide.Points, Index=0, Wrap=True)
xaxis = Data(split_2)
yaxis = Data(split)
pl_2 = ConstructPlane(Origin=item_3, XAxis="0,0,-1", YAxis="0,-1,0")
# print path visualization
panel_6 = Panel(section_into_paths.all_paths)
box_2 = Box(section_into_paths.boxes)
dispatch = Dispatch(List=box_2, DispatchPattern=section_into_paths.dangerous_flags_by_path)  # -> ListA, ListB
box_3 = Box(dispatch.ListB)
pt_7 = Point(Point(-572.4612461, 1067.27947, 0))
write_text_file = GhPythonScript(
    file_name="pick_place_test_01",
    write_json=Toggle(False),
    bucket_point=pt_7,
    gx="31000 To 31000",
    gy="-5000 To -5000",
    gz="-2800 To -2600",
    base_speed=Slider(70, range=0..1000),
    base_concrete=Slider(1, range=0..1000),
    base_accelerator=Slider(40, range=0..1000),
    base_zone=Slider(100, range=0..1000),
    slice=slice,
    addons=pl_2,
    picking_points=target_plane,
    xaxis=xaxis,
    yaxis=yaxis)  # -> out; inputs bucket_point: Point3d, addons: list of Plane, picking_points: list of Plane, xaxis: list, yaxis: list, dangerous_flags_by_path: list
# ---------- write_text_file: Python ----------
import sys
import os
import rhinoscriptsyntax as rs
from compas.data import json_dump
from compas.utilities import geometric_key

HERE = ghenv.LocalScope.ghdoc.Path

#add library reference
my_path = os.path.abspath(os.path.join(HERE, '..', '..'))

if not my_path in sys.path:
    sys.path.append(my_path)
    #print "sucess"

from compas_rhino import unload_modules
unload_modules('cSlicer')
from cSlicer.partial_order_plan import Action, ProductionData
from cSlicer.process_instructions import PickAndPlaceProcess

dir_path = DATA = os.path.abspath(os.path.join(HERE, '..', '..', '..','data'))

#update printing data
for l,layer in enumerate(slice.layers):
    for p,point in enumerate(layer.print_points):
        point.initialize_printing_parameters(slice.bbox, gx, gy, gz, base_speed, base_zone, base_concrete, base_accelerator)


production_data = ProductionData()
pnp_process = PickAndPlaceProcess()

#add a root action

root_action_id = production_data.append_action(pnp_process.namespace, Action('PrintText', dict(text='Starting process')))

for a_index, action in enumerate(pnp_process.setup()):
    last_action_id = production_data.append_action(pnp_process.namespace, action)
    
    # The first action of each process will depend on the root action instead
    if a_index == 0:
        production_data.actions[last_action_id].dependency_ids = [root_action_id]
        
for item, pick_item in zip (addons, picking_points):
    addon_plane, pick_point = item, pick_item.Origin
    pick_actions = pnp_process.pick(pick_point, xaxis, yaxis)
    place_actions = pnp_process.place((addon_plane.Origin[0], addon_plane.Origin[1], addon_plane.Origin[2]), xaxis, yaxis)
    
    for pick_action in pick_actions:
        last_action_id = production_data.append_action(pnp_process.namespace, pick_action, dependency_ids=[last_action_id])
        # print c 
    for place_action in place_actions:
        last_action_id =production_data.append_action(pnp_process.namespace, place_action, dependency_ids=[last_action_id])

if write_json:
    json_dump(production_data, dir_path + '/' + file_name +'.json', pretty=True)
    print "exported"
# ---------- end write_text_file ----------
panel_7 = Panel(write_text_file)
