# Grasshopper definition circlePackingDistrubution.gh (Grasshopper 1.0.7)
# plug-ins: Kangaroo2 Components

crv = Curve(<curve referenced from the Rhino model>)
crv_2 = Curve(<curve referenced from the Rhino model>)
loft = Loft(Curves=[crv_2, crv], Options={Adjust=False, Closed=False, LoftEnds=0, LoftSimp=0, LoftType=0, Rebuild=10, Refit=0.01})
srf = Surface(loft)
mesh = Geometry(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)
mesh_uv = MeshSurface(Surface=srf, UCount=Slider(200, range=0..1000), VCount=Slider(80, range=0..1000), Overhang=True, Equalize=False)
crv_3 = Curve(<curve referenced from the Rhino model>)
demesh = DeconstructMesh(Mesh=mesh)  # -> Vertices, Faces, Colours, Normals

# ---- group: here using z value, but you could replace this with any function that returns a value for each point
pdecon = Deconstruct(Point=demesh.Vertices)  # -> XComponent, YComponent, ZComponent

# ----
data = Data(pdecon.ZComponent)
crv_cp = CurveClosestPoint(Point=demesh.Vertices, Curve=crv_3)  # -> Point, Parameter, Distance
avr = Average(Input=data)

addition = Addition(A=avr, B=Slider(378.812, range=0..1000))

popgeo = PopulateGeometry(Geometry=mesh, Count=Slider(500, range=0..1000), Seed=1)

medges = MeshEdges(Mesh=mesh)  # -> NakedEdges, InteriorEdges, NonManifoldEdges
crv_4 = Curve(medges.NakedEdges)
join = JoinCurves(Curves=crv_4, Preserve=False)
pull = PullPoint(Point=popgeo, Geometry=join, ClosestOnly=True)  # -> ClosestPoint, Distance
smaller = SmallerThan(FirstNumber=pull.Distance, SecondNumber=Slider(50, range=0..100))  # -> SmallerThan, OrEqualTo
dispatch = Dispatch(List=popgeo, DispatchPattern=smaller.SmallerThan)  # -> ListA, ListB

subtraction = Subtraction(A=addition, B=data)
abs = Absolute(Value=subtraction)
data_2 = Data(abs)
bnd = Bounds(Numbers=data_2)
pt = Point(dispatch.ListB)
remap = RemapNumbers(Value=data_2, Source=bnd, Target="0 to 1")  # -> Mapped, Clipped
hsl = ColourHSL(Alpha=1, Hue=0, Saturation=1, Luminance=remap.Mapped)
conmesh = ConstructMesh(Vertices=demesh.Vertices, Faces=demesh.Faces, Colours=hsl)
onmesh = OnMesh(Points=pt, Mesh=conmesh, Strength=1)
imgcircles = ImageCircles(Points=pt, Mesh=conmesh, Min=Slider(25, range=0..100), Max=Slider(60, range=0..100), Strength=1)
entwine = Entwine(Branch00=imgcircles, Branch01=onmesh, FlattenInputs=True)  # -> simplify(Result)
solver = Solver(GoalObjects=entwine, Reset=Button(), Threshold=1e-15, Tolerance=0.0001, On=Toggle(False))  # -> I, V, O
meshcp = MeshClosestPoint(Point=solver.V, Mesh=conmesh)  # -> Point, Index, Parameter
meval = MeshEval(Mesh=conmesh, Parameter=meshcp.Parameter)  # -> Point, Normal, Colour
branch = TreeBranch(Tree=solver.O, Path="{0}", MaintainPaths=True)
medges_2 = MeshEdges(Mesh=mesh)  # -> NakedEdges, InteriorEdges, NonManifoldEdges
circle = CircleCNR(Center=meshcp.Point, Normal=meval.Normal, Radius=branch)  # disabled
crv_5 = Curve(medges_2.NakedEdges)
larger = LargerThan(FirstNumber=branch, SecondNumber=Slider(58, range=0..100))  # -> LargerThan, OrEqualTo
number_slider = Slider(20, range=0..100)
guilde_crvs = Curve([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])
dispatch_2 = Dispatch(List=meshcp.Point, DispatchPattern=invert(larger.LargerThan))  # -> ListA, ListB
dispatch_3 = Dispatch(List=branch, DispatchPattern=invert(larger.OrEqualTo))  # -> ListA, ListB
item = ListItem(List=guilde_crvs, Index=0, Wrap=True)  # -> Item, Item1, Item2
pt_2 = Point(meshcp.Point)
item_2 = ListItem(List=guilde_crvs, Index=0, Wrap=True)
geo = Geometry(dispatch_2.ListA)
pt_3 = Point(geo)

pull_2 = PullPoint(Point=pt_3, Geometry=crv_5, ClosestOnly=True)  # -> ClosestPoint, Distance
larger_2 = LargerThan(FirstNumber=pull_2.Distance, SecondNumber=Slider(50, range=0..1000))  # -> LargerThan, OrEqualTo

divide = DivideCurve(Curve=item.Item2, Count=number_slider, Kinks=False)  # -> Points, Tangents, Parameters
divide_2 = DivideCurve(Curve=item.Item1, Count=number_slider, Kinks=False)  # -> reverse(Points), Tangents, Parameters
divide_3 = DivideCurve(Curve=item.Item, Count=number_slider, Kinks=False)  # -> Points, Tangents, Parameters
dispatch_4 = Dispatch(List=dispatch_3.ListA, DispatchPattern=larger_2.OrEqualTo)  # -> ListA, ListB
dispatch_5 = Dispatch(List=pt_3, DispatchPattern=larger_2.OrEqualTo)  # -> ListA, ListB
geo_2 = Geometry(dispatch_5.ListA)
intcrv = Interpolate(Vertices=flatten([divide_3.Points, divide_2.Points]), Degree=3, Periodic=invert(False), KnotStyle=1)  # -> Curve, Length, Domain
intcrv_2 = Interpolate(Vertices=flatten([divide_2.Points, divide.Points]), Degree=3, Periodic=invert(False), KnotStyle=1)  # -> Curve, Length, Domain
larger_3 = LargerThan(FirstNumber=dispatch_4.ListA, SecondNumber=Slider(27, range=0..100))  # -> LargerThan, OrEqualTo
geo_3 = Geometry(dispatch_5.ListA)
dispatch_6 = Dispatch(List=geo_3, DispatchPattern=invert(larger_3.LargerThan))  # -> ListA, ListB
python = GhPythonScript(pts=geo_2, boundary_crv=intcrv.Curve, tol=Slider(1, range=0..1))  # -> out, pts_projected, pts_in_crv; inputs pts: list of Point3d, boundary_crv: Curve
# ---------- python: Python ----------
__author__ = "WeiTingChen"

import Rhino.Geometry as rg
import ghpythonlib.components as gh



pts_in_crv = []
for pt in pts:
    
    pts_projected = rg.Point3d(pt[0], 0, pt[2])
    pt_contain = boundary_crv.Contains(pts_projected, rg.Plane.WorldZX, tol)
    
    if pt_contain == rg.PointContainment.Inside:
        pts_in_crv.append(pt)
# ---------- end python ----------
python_2 = GhPythonScript(pts=geo_2, boundary_crv=intcrv_2.Curve, tol=Slider(1, range=0..1))  # -> out, pts_projected, pts_in_crv; inputs pts: list of Point3d, boundary_crv: Curve; same code as python
dispatch_7 = Dispatch(List=python_2.pts_in_crv, DispatchPattern=[True, False])  # -> ListA, ListB
dispatch_8 = Dispatch(List=python.pts_in_crv, DispatchPattern=[True, False])  # -> ListA, ListB
xz = XZPlane(Origin=dispatch_6.ListB)
xz_2 = XZPlane(Origin=dispatch_6.ListA)
geo_4 = Geometry(dispatch_7.ListA)
geo_5 = Geometry(dispatch_8.ListB)
cir = Circle(Plane=xz_2, Radius=Slider(12.25, range=0..100))
cir_2 = Circle(Plane=xz, Radius=Slider(8.75, range=0..10))
merge = Merge(Data1=cir_2, Data2=cir)  # disabled
pt_4 = Point(flatten(dispatch_6.ListB))
Y = UnitY(Factor=Slider(25, range=0..100))
pt_5 = Point(flatten(dispatch_6.ListA))
Y_2 = UnitY(Factor=Slider(25, range=0..100))
move = Move(Geometry=pt_4, Motion=Y)  # -> Geometry, Transform
move_2 = Move(Geometry=pt_5, Motion=Y_2)  # -> Geometry, Transform
type = ValueList({"One": 1, "Two": 2, "Three": 3, "Four": 4, "Five": 5, "Six": 6, "Seven": 7, "Eight": 8, "Nine": 9, "Ten": 10}, selected="Ten")
preview = CustomPreview(Geometry=[cir, cir_2], Material=ColourSwatch(SwatchColor=RGB(0, 0, 0)))
type_2 = ValueList({"One": 1, "Two": 2, "Three": 3, "Four": 4, "Five": 5, "Six": 6, "Seven": 7, "Eight": 8, "Nine": 9, "Ten": 10}, selected="Nine")
python_3 = GhPythonScript(points=move_2.Geometry, type=type)  # -> out, glass, a, b; inputs points: list of Point3d
# ---------- python_3: Python ----------
import rhinoscriptsyntax as rs
import Rhino.Geometry as rg

def glass_mk(centroid, type):
    
    if type == 1 :
        diameters = [20, 20, 20, 50, 60]
        length = [108, 98, 80, 20, 0]
    elif type ==2 :
        diameters = [32, 32, 32, 73, 83]
        length = [150, 140, 108, 20, 0]
    elif type ==3:
        diameters = [32, 32, 32, 82, 92]
        length = [180, 170, 142, 20, 0]
    elif type ==4 :
        diameters = [49, 49, 49, 118, 118]
        length = [223, 213, 170, 20, 0]
    elif type ==6 :
        diameters = [29, 29, 29, 125, 115]
        length = [300, 266, 131, 60, 0]   
    elif type ==8:
        diameters = [26, 26, 26, 102, 92]
        length = [250, 223, 108, 66, 0]
    elif type ==9 :
        diameters = [24.50, 24.50, 24.50, 24.50, 14.50]
        length = [150, 100, 80, 20, 0]   
    else :
        diameters = [17.50, 17.50, 17.50, 17.50, 7.50]
        length = [180, 150, 100, 20, 0]

    circles = []
    
    for d in diameters:
        cir = rg.Circle(rg.Plane.WorldZX,d/2)
        circles.append(cir)
    
    
    for cr, l in zip(circles,length):
        t = rg.Transform.Translation(rg.Vector3d.YAxis*l)
        cr.Transform(t)
    
    center_point = 0.5 * (circles[0].Center + circles[-1].Center)
    
    
    curves = [c.ToNurbsCurve(1, 20) for c in circles]
    loft = rg.Brep.CreateFromLoft(curves, rg.Point3d.Unset, rg.Point3d.Unset, rg.LoftType.Straight, False)[0]
    
    vec = centroid - center_point
    trans = rg.Transform.Translation(vec)
    loft.Transform(trans)
    
    return loft, length[0], diameters[-1]

glass = []

for p in points:
    
    gl = glass_mk(p, type)[0]
    glass.append(gl)

a = glass_mk(p, type)[1]
b = glass_mk(p, type)[2]
# ---------- end python_3 ----------
python_4 = GhPythonScript(points=move.Geometry, type=type_2)  # -> out, glass, a, b; inputs points: list of Point3d; same code as python_3
preview_2 = CustomPreview(Geometry=python_4.glass, Material=ColourSwatch(SwatchColor=RGB(255, 255, 255)))  # disabled
preview_3 = CustomPreview(Geometry=python_3.glass, Material=ColourSwatch(SwatchColor=RGB(255, 255, 255)))  # disabled
