# Grasshopper definition master_file.gh (Grasshopper 1.0.7)
# plug-ins: Lumbricid Info

crv = Curve(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)  # disabled
mesh = Mesh([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])
crv_2 = Curve([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])  # disabled
# Mesh Input
# slicer with mesh input
panel = Panel("robot postion")

# ---- group: cuttung_planes
number_slider = Slider(5, range=0..10)
series = Series(Start=number_slider, Step=number_slider, Count=Slider(200, range=0..1000))
pt = ConstructPoint(XCoordinate=0, YCoordinate=0, ZCoordinate=series)
xy = XYPlane(Origin=pt)

# ----
number_slider_2 = Slider(5, range=0..10)  # disabled
# Multiple Polyline Input
number_slider_3 = Slider(20, range=0..100)  # disabled
# Single Polyline Input
# slicer with one polyline input
crv_3 = Curve(crv)  # disabled
crv_4 = Curve(crv_2)  # disabled
pt_2 = Point(Point(4580.579014, 2022.909367, 0))  # disabled
python = GhPythonScript(imported_polyline=crv_3, layer_height=number_slider_2, layer_width=number_slider_3, seaming_point=pt_2)  # -> out, points, seaming_points, layer; inputs imported_polyline: Polyline, seaming_point: Point3d; disabled
# ---------- python: Python ----------
import sys
HERE = ghenv.LocalScope.ghdoc.Path

#add library reference
my_path = HERE[:-26] # + "cSlicer"

if not my_path in sys.path:
    sys.path.append(my_path)
    
import Rhino.Geometry as rg
import imp
from cSlicer.layer import Layer
from cSlicer.print_param import Print_param

layer = Layer(imported_polyline, layer_height, layer_width)
# ---------- end python ----------

# ----
# slicer with one polyline input
number_slider_4 = Slider(20, range=0..100)  # disabled
number_slider_5 = Slider(5, range=0..10)  # disabled
# slicer with polyline input
pt_3 = Point(Point(1769.21537, 1353.646888, 0))  # disabled
python_2 = GhPythonScript(imported_polylines=crv_4, layer_height=number_slider_5, layer_width=number_slider_4, seaming_point=pt_3)  # -> out, points, seaming_points, slice, polyline; inputs imported_polylines: list of Polyline, layer_height: list, seaming_point: Point3d; disabled
# ---------- python_2: Python ----------
import sys
HERE = ghenv.LocalScope.ghdoc.Path

#add library reference
my_path = HERE[:-26] # + "cSlicer"

if not my_path in sys.path:
    sys.path.append(my_path)
    
import Rhino.Geometry as rg
import imp
from cSlicer.layer import Layer
from cSlicer.print_param import Print_param
from cSlicer.mesh_slicer import Mesh_slice


#create layer objects to feed to Mesh_slice
layers = []

for p in imported_polylines:
    lay = Layer(p, layer_height, layer_width)
    layers.append(lay)


slice = Mesh_slice(None, seaming_point, 0, 0, False, 5, 20, [], layers)

points = []

for i,layer in enumerate(slice.layers):
    
    points.extend([p.pt for p in layer.print_points])
    
seaming_points = slice.seaming_points

polyline = rg.Curve.CreateInterpolatedCurve(points,1)
# ---------- end python_2 ----------

seaming_point = Point(Point(-128.7879483, 53.38247064, 0))

list = ValueList({"Paralel": 0, "Crossing": 1}, selected="Crossing")
python_3 = GhPythonScript(
    mode=list,
    imported_mesh=mesh,
    layer_height=Slider(0, range=0..10),
    layer_width=Slider(15, range=0..100),
    seaming_point=seaming_point,
    cutting_planes=xy,
    start_stop=Toggle(False),
    smoothing_distance=Slider(0, range=0..100))  # -> out, polyline, points, seaming_points, slice; inputs mode: Int32, imported_mesh: list, seaming_point: Point3d, cutting_planes: list of Plane
# ---------- python_3: Python ----------
import sys
HERE = ghenv.LocalScope.ghdoc.Path

#add library reference
my_path = HERE[:-26] # + "cSlicer"

if not my_path in sys.path:
    sys.path.append(my_path)
    
import Rhino.Geometry as rg
import imp
from cSlicer import mesh_slicer
imp.reload(mesh_slicer)

from cSlicer.mesh_slicer import Mesh_slice
from cSlicer.print_param import Print_param

slice = Mesh_slice(imported_mesh, seaming_point, smoothing_distance, mode, start_stop,layer_height, layer_width, cutting_planes)

points = []

for i,layer in enumerate(slice.layers):
    
    points.extend([p.pt for p in layer.print_points])
    
seaming_points = slice.seaming_points
sorted_planes = slice.planes

polyline = rg.Curve.CreateInterpolatedCurve(points,1)
# ---------- end python_3 ----------
crv_5 = Curve(python_3.polyline)  # disabled
pt_4 = Point(python_3.seaming_points)  # disabled

seaming_point_2 = Point(Point(-35.00065077, -65.65494038, 0))
number_slider_6 = Slider(5, range=0..10)  # disabled

# ---- group: color mesh faces depending on overhang
python_script = PythonScript(mesh=mesh)  # -> out, colors, a; inputs mesh: Mesh
# ---------- python_script: Python ----------
import sys
import Rhino.Geometry as rg
import math
HERE = ghenv.LocalScope.ghdoc.Path

#add library reference
my_path = HERE[:-26] # + "cSlicer"

if not my_path in sys.path:
    sys.path.append(my_path)
    print "sucess"

#import library
from cSlicer import infill
import imp
imp.reload(infill)

from cSlicer.infill import Infill
from cSlicer.helper_functions import color_mesh_faces

myInfill = Infill(mesh)
colors = myInfill.colors
a = color_mesh_faces(mesh,colors)
# ---------- end python_script ----------

# ----
redpline = Reduce(Polyline=crv_3, Tolerance=number_slider_6)  # -> Polyline, Reduction; disabled

# ----
# printability check
python_4 = GhPythonScript(polyline=redpline.Polyline)  # -> out, segments; inputs polyline: list of Polyline; disabled
# ---------- python_4: Python ----------
import sys
HERE = ghenv.LocalScope.ghdoc.Path

#add library reference
my_path = HERE[:-26] # + "cSlicer"

if not my_path in sys.path:
    sys.path.append(my_path)

import Rhino.Geometry as rg
from cSlicer import evaluate_printability as ep

segments =[]

for poly in polyline:
    segments= ep.not_printable_segments(poly)
# ---------- end python_4 ----------

# ----
# printability check
python_5 = GhPythonScript(polyline=crv_5)  # -> out, segments; inputs polyline: list of Polyline; same code as python_4

crv_6 = Curve(python_4.segments)  # disabled

# ----
# printability check
python_6 = GhPythonScript(polyline=python_2.polyline)  # -> out, segments; inputs polyline: list of Polyline; disabled; same code as python_4

crv_7 = Curve(python_5.segments)
crv_8 = Curve(python_6.segments)  # disabled
pt_5 = Point(Point(-572.4612461, 1067.27947, 0))

# ----
# Write txt file
toggle = BooleanToggle(False)
write_text_file = GhPythonScript(
    file_name="test",
    write_json=toggle,
    write_txt=Toggle(False),
    bucket_point=pt_5,
    gx="31000 To 31000",
    gy="-5000 To -5000",
    gz="-2800 To -2600",
    base_speed=Slider(200, range=0..1000),
    base_concrete=Slider(1, range=0..1000),
    base_accelerator=Slider(40, range=0..1000),
    base_zone=Slider(30, range=0..1000),
    slice=python_3.slice)  # -> out, print_path, printing, traveling; inputs bucket_point: Point3d
# ---------- write_text_file: Python ----------
import sys
import System
import Grasshopper as GH

HERE = ghenv.LocalScope.ghdoc.Path

#add library reference
my_path = HERE[:-26] # + "cSlicer"

if not my_path in sys.path:
    sys.path.append(my_path)
    #print "sucess"

from compas_rhino import unload_modules
unload_modules('slicer')

from cSlicer.txt_export import WriteTxt
from cSlicer.json_export import WriteJson

dir_path = HERE[:-39] + "data/"
my_txt_writer = WriteTxt(dir_path, file_name)
my_json_writer = WriteJson(dir_path, file_name)

#update printing data
for l,layer in enumerate(slice.layers):
    for p,point in enumerate(layer.print_points):
        if l == 0 and p == 0:
            #print type(point.pt)
            pass
        point.initialize_printing_parameters(slice.bbox, gx, gy, gz, base_speed, base_zone, base_concrete, base_accelerator)
        #first and last point

        if (l==0 and p == 0)  or ( (l == len(slice.layers)-1) and (p == len(layer.print_points)-1)):
            pass
            #print "first or last point"
        elif p == 0:
            previous = slice.layers[l-1].print_points[-1]
            next = layer.print_points[p+1]
            point.update_printing_parameters(previous, next, layer.get_length())
            
        elif (p == len(layer.print_points)-1):
            previous = layer.print_points[p-1]
            next = slice.layers[l+1].print_points[0]
            point.update_printing_parameters(previous, next, layer.get_length())
        else:
            previous = layer.print_points[p-1]
            next = layer.print_points[p+1]
            point.update_printing_parameters(previous, next, layer.get_length())
        #print layer.get_length()
        
#flatten all points
pParams = []

for l,layer in enumerate(slice.layers):
    pParams.extend(layer.print_points)


if write_json:
    my_json_writer.write_json_file(pParams)
    
if write_txt:
    my_txt_writer.write_txt_file(pParams)
    
    print_path = my_txt_writer.print_path
    material = my_txt_writer.material_status
    Mats = []
    printing = [print_path[i] for i in range(len(print_path)) if material[i]== "on"]
    
    traveling = [print_path[i] for i in range(len(print_path)) if material[i]== "off"]
# ---------- end write_text_file ----------

number_slider_7 = Slider(200, range=0..1000)  # disabled
number_slider_8 = Slider(1, range=0..1000)  # disabled
number_slider_9 = Slider(40, range=0..1000)  # disabled
number_slider_10 = Slider(10, range=0..1000)  # disabled
polyline = Panel("test")  # disabled
number_slider_11 = Slider(1, range=0..1000)  # disabled
number_slider_12 = Slider(200, range=0..1000)  # disabled
number_slider_13 = Slider(40, range=0..1000)  # disabled
number_slider_14 = Slider(30, range=0..1000)  # disabled
pt_6 = Point(Point(-572.4612461, 1067.27947, 0))  # disabled
panel_2 = Panel("-2300 To -2300")  # disabled
panel_3 = Panel("31000 To 31000")  # disabled
panel_4 = Panel("-2600 To -3600")  # disabled
toggle_2 = BooleanToggle(True)  # disabled
panel_5 = Panel("test")  # disabled
pt_7 = Point(Point(-572.4612461, 1067.27947, 0))  # disabled
panel_6 = Panel("-5000 To -5000")  # disabled
panel_7 = Panel("-2800 To -2600")  # disabled
panel_8 = Panel("31000 To 31000")  # disabled
toggle_3 = BooleanToggle(True)  # disabled

# ----
# Write txt file
toggle_4 = BooleanToggle(True)  # disabled
write_text_file_2 = GhPythonScript(
    file_name=polyline,
    write_json=toggle_4,
    write_txt=toggle_3,
    bucket_point=pt_6,
    gx=panel_3,
    gy=panel_2,
    gz=panel_4,
    base_speed=number_slider_7,
    base_concrete=number_slider_8,
    base_accelerator=number_slider_9,
    base_zone=number_slider_10,
    layer=python.layer,
    bbox=crv_3)  # -> out, print_path; inputs bucket_point: Point3d, bbox: Curve; disabled
# ---------- write_text_file_2: Python ----------
import sys
import System
import Grasshopper as GH

HERE = ghenv.LocalScope.ghdoc.Path

#add library reference
my_path = HERE[:-26] # + "cSlicer"

if not my_path in sys.path:
    sys.path.append(my_path)
    print "sucess"

from compas_rhino import unload_modules
unload_modules('cSlicer')


from cSlicer.txt_export import WriteTxt
from cSlicer.json_export import WriteJson

dir_path = HERE[:-39] + "data/"
my_txt_writer = WriteTxt(dir_path, file_name)
my_json_writer = WriteJson(dir_path, file_name)

bbox = bbox.GetBoundingBox(True)

print len(layer.print_points),'////'

for i in range(len(layer.print_points)):

    layer.print_points[i].initialize_printing_parameters(bbox, gx, gy, gz, base_speed, base_zone, base_concrete, base_accelerator)


#flatten all points
pParams = []


pParams.extend(layer.print_points)

if write_json:
    my_json_writer.write_json_file(pParams)
    
if write_txt:
    my_txt_writer.write_txt_file(pParams)
    
print_path = my_txt_writer.print_path
material = my_txt_writer.material_status
# ---------- end write_text_file_2 ----------

crv_9 = Curve(python_2.polyline)  # disabled

# ----
# Write txt file
toggle_5 = BooleanToggle(False)  # disabled
write_text_file_3 = GhPythonScript(
    file_name=panel_5,
    write_json=toggle_5,
    write_txt=toggle_2,
    bucket_point=pt_7,
    gx=panel_8,
    gy=panel_6,
    gz=panel_7,
    base_speed=number_slider_12,
    base_concrete=number_slider_11,
    base_accelerator=number_slider_13,
    base_zone=number_slider_14,
    slice=python_2.slice,
    bbox=crv_9)  # -> out, print_path; inputs bucket_point: Point3d, bbox: Curve; disabled
# ---------- write_text_file_3: Python ----------
import sys
import System
import Grasshopper as GH

HERE = ghenv.LocalScope.ghdoc.Path

#add library reference
my_path = HERE[:-26] # + "cSlicer"

if not my_path in sys.path:
    sys.path.append(my_path)
    #print "sucess"

from compas_rhino import unload_modules
unload_modules('slicer')

from cSlicer.txt_export import WriteTxt
from cSlicer.json_export import WriteJson


bbox = bbox.GetBoundingBox(True)

dir_path = HERE[:-39] + "data/"
my_txt_writer = WriteTxt(dir_path, file_name)
my_json_writer = WriteJson(dir_path, file_name)

pParams = []

#update printing data
for l,layer in enumerate(slice.layers):
    for p,point in enumerate(layer.print_points):
        point.initialize_printing_parameters(bbox, gx, gy, gz, base_speed, base_zone, base_concrete, base_accelerator)
        
    pParams.extend(layer.print_points)
        
#flatten all points




if write_json:
    my_json_writer.write_json_file(pParams)
    
if write_txt:
    my_txt_writer.write_txt_file(pParams)
    
print_path = my_txt_writer.print_path
material = my_txt_writer.material_status
# ---------- end write_text_file_3 ----------

join = JoinCurves(Curves=write_text_file.printing, Preserve=False)  # disabled
explode = Explode(Curve=join, Recursive=True)  # -> Segments, Vertices; disabled
nurbs = NurbsCurve(Vertices=explode.Vertices, Degree=3, Periodic=False)  # -> Curve, Length, Domain; disabled
crv_10 = Curve(nurbs.Curve)  # disabled

crv_11 = Curve(write_text_file.print_path)
layer_width = Slider(20, range=0..100)
layer_height = Slider(5, range=0..10)
# print path visualization
lumbricid = Lumbricid(
    SegmentLength=1,
    ProfileWidth=layer_width,
    ProfileHeight=layer_height,
    ProfileSegments=4,
    PathFraction=1,
    ColorByAge=False)  # disabled

# ----
# concrete volume (L)
concrete_volume = GhPythonScript(layer_width=layer_width, layer_height=layer_height, curves=crv_11)  # -> out, volume; inputs curves: list of Curve
# ---------- concrete_volume: Python ----------
import sys
import System
import Grasshopper as GH

HERE = ghenv.LocalScope.ghdoc.Path

#add library reference
my_path = HERE[:-26] # + "cSlicer"

if not my_path in sys.path:
    sys.path.append(my_path)
    #print "sucess"

from compas_rhino import unload_modules
unload_modules('slicer')

from cSlicer.helper_functions import concrete_volume



volume = 0

for cv in curves:

    volume += concrete_volume (layer_width, layer_height, cv)
# ---------- end concrete_volume ----------
panel_9 = Panel(concrete_volume.volume)
