# Grasshopper definition production_layout.gh (Grasshopper 1.0.7)
# plug-ins: Lumbricid Info, Kangaroo2 Components, Weaverbird, Human

pt = Point("0,0,0")
pt_2 = Point(Point(384.9444888, 99.40549807, 0))

crv = Curve(flatten([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]))
pt_3 = Point([Point(481.2772719, -38, 165), Point(691.8588279, -38, 235), Point(835.0548464, -38, 275), Point(867.2757567, -38, 425), Point(616.0795007, -38, 165), Point(553.0805763, -38, 135), Point(105.0162949, -38, 435), Point(459.4452923, -38, 85), Point(775.7991291, -38, 215), Point(822.2906016, -38, 350), Point(120.1453768, -38, 335), Point(86.92340464, -38, 275), Point(347.9555866, -38, 60), Point(380.0028443, -38, 135), Point(172.4199863, -38, 135), Point(271.3262375, -38, 160), Point(129.2132284, -38, 505), Point(693.0173639, -38, 165), Point(147.3252206, -38, 235)])

crv_2 = Curve([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])
pt_4 = Point([Point(481.2772719, -60.89114448, 165), Point(691.8588279, -60.89114448, 235), Point(835.0548464, -60.89114448, 275), Point(867.2757567, -60.89114448, 425), Point(616.0795007, -60.89114448, 165), Point(553.0805763, -60.89114448, 135)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])

# ---- group: 210805
crv_3 = Curve(flatten([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]))
pt_5 = Point([Point(207.2907189, -30.01404966, 205), Point(867.2757567, -30.01404966, 425), Point(459.4452923, -30.01404966, 85), Point(822.2906016, -30.01404966, 350), Point(120.1453768, -30.01404966, 335), Point(693.0173639, -30.01404966, 165)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])

# ----
crv_4 = Curve([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])

# ---- group: 210805
crv_5 = Curve(flatten([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]))  # disabled
pt_6 = Point([Point(268.6369895, -30.01404968, 70), Point(691.8588279, -30.01404968, 235), Point(182.9015907, -30.01404968, 400), Point(207.2907189, -30.01404968, 205), Point(867.2757567, -30.01404968, 425), Point(616.0795007, -30.01404968, 165), Point(105.0162949, -30.01404968, 435), Point(459.4452923, -30.01404968, 85), Point(218.1337104, -30.01404968, 500), Point(822.2906016, -30.01404968, 350), Point(120.1453768, -30.01404968, 335), Point(347.9555866, -30.01404968, 60), Point(380.0028443, -30.01404968, 135), Point(271.3262375, -30.01404968, 160), Point(553.0805763, -30.01404968, 135), Point(129.2132284, -30.01404968, 505), Point(693.0173639, -30.01404968, 165), Point(147.3252206, -30.01404968, 235)])  # disabled

# ---- group: 0806_small_test
crv_6 = Curve(flatten([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]))
pt_7 = Point([Point(190, -30.01404965, 75), Point(287, -30.01404965, 135), Point(131, -30.01404965, 190)])

# ----
crv_7 = Curve(flatten([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]))
pt_8 = Point([Point(268.6369895, -30.01404966, 70), Point(691.8588279, -30.01404966, 235), Point(182.9015907, -30.01404966, 400), Point(207.2907189, -30.01404966, 205), Point(867.2757567, -30.01404966, 425), Point(187.4393873, -30.01404966, 300), Point(616.0795007, -30.01404966, 165), Point(105.0162949, -30.01404966, 435), Point(459.4452923, -30.01404966, 85), Point(218.1337104, -30.01404966, 500), Point(775.7991291, -30.01404966, 215), Point(822.2906016, -30.01404966, 350), Point(120.1453768, -30.01404966, 335), Point(347.9555866, -30.01404966, 60), Point(380.0028443, -30.01404966, 135), Point(271.3262375, -30.01404966, 160), Point(129.2132284, -30.01404966, 505), Point(86.92340464, -30.01404966, 275)])

# ---- group: 2021_0812
crv_8 = Curve(flatten([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]))
pt_9 = Point([Point(413.6237867, -60, 325), Point(1659.475369, -60, 360), Point(1087.550873, -60, 270), Point(1339.6667, -60, 345), Point(1218.808516, -60, 165), Point(291.0150505, -60, 95)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])

# ---- group: 0806_test
crv_9 = Curve(flatten([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]))
pt_10 = Point([Point(268.6369895, -30.01404968, 70), Point(691.8588279, -30.01404968, 235), Point(182.9015907, -30.01404968, 400), Point(207.2907189, -30.01404968, 205), Point(867.2757567, -30.01404968, 425), Point(616.0795007, -30.01404968, 165), Point(105.0162949, -30.01404968, 435), Point(459.4452923, -30.01404968, 85), Point(218.1337104, -30.01404968, 500), Point(822.2906016, -30.01404968, 350), Point(120.1453768, -30.01404968, 335), Point(347.9555866, -30.01404968, 60), Point(380.0028443, -30.01404968, 135), Point(271.3262375, -30.01404968, 160), Point(553.0805763, -30.01404968, 135), Point(129.2132284, -30.01404968, 505), Point(693.0173639, -30.01404968, 165), Point(147.3252206, -30.01404968, 235)])

# ---- group: simple_two_bottle
crv_10 = Curve([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])
pt_11 = Point([Point(123.21198, -38, 185), Point(344.6924502, -38, 85)])

# ---- group: layer height adjustment
Z = UnitZ(Factor=expr("X*-1", Slider(5, range=0..10)))
move = Move(Geometry=crv_8, Motion=Z)  # -> Geometry, Transform
move_2 = Move(Geometry=pt_9, Motion=Z)  # -> Geometry, Transform

# ---- group: imporve print path
explode = Explode(Curve=move.Geometry, Recursive=True)  # -> Segments, Vertices
crv_11 = Curve(<curve referenced from the Rhino model>)
pull = PullPoint(Point=explode.Vertices, Geometry=crv_11, ClosestOnly=True)  # -> ClosestPoint, Distance
crv_12 = Curve(<curve referenced from the Rhino model>)
smaller = SmallerThan(FirstNumber=pull.Distance, SecondNumber=Slider(1, range=0..1))  # -> SmallerThan, OrEqualTo
pt_12 = Point(move_2.Geometry)
dispatch = Dispatch(List=explode.Vertices, DispatchPattern=smaller.SmallerThan)  # -> ListA, ListB
pt_13 = Point(dispatch.ListB)
pull_2 = PullPoint(Point=pt_13, Geometry=crv_12, ClosestOnly=True)  # -> ClosestPoint, Distance
smaller_2 = SmallerThan(FirstNumber=pull_2.Distance, SecondNumber=Slider(1, range=0..1))  # -> SmallerThan, OrEqualTo
dispatch_2 = Dispatch(List=pt_13, DispatchPattern=smaller_2.SmallerThan)  # -> ListA, ListB
pt_14 = Point("0,0,0")
pt_15 = Point(Point(384.9444888, 99.40549807, 0))
pt_16 = Point(dispatch_2.ListB)
pline = PolyLine(Vertices=pt_16, Closed=invert(False))
crv_13 = Curve(flatten(pline))
pl = ConstructPlane(Origin=pt_15, XAxis="0,1,0", YAxis="-1,0,0")
xy = XYPlane(Origin=pt_14)
orient = Orient(Geometry=crv_13, Source=xy, Target=pl)  # -> Geometry, Transform
item = ListItem(List=orient.Transform, Index=0, Wrap=True)
transform = Transform(Geometry=pt_12, Transform=item)
crv_14 = Curve(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)
merge = Merge(Data1=crv_14, Data2=orient.Geometry)

# ---- group: imporve print path / move points
Z_2 = UnitZ(Factor=Slider(10, range=0..10))
move_3 = Move(Geometry=transform, Motion=Z_2)  # -> Geometry, Transform
pt_17 = Point(flatten(move_3.Geometry))

# ---- group: cuttung_planes
# slicer with polyline input
number_slider = Slider(100, range=0..1000)  # disabled
number_slider_2 = Slider(5, range=0..10)  # disabled
series = Series(Start=number_slider_2, Step=number_slider_2, Count=number_slider)  # disabled
pt_18 = ConstructPoint(XCoordinate=0, YCoordinate=0, ZCoordinate=series)  # disabled
xy_2 = XYPlane(Origin=pt_18)  # disabled

# ----
pdecon = Deconstruct(Point=pt_17)  # -> XComponent, YComponent, ZComponent
smaller_3 = SmallerThan(FirstNumber=pdecon.YComponent, SecondNumber=Slider(1232, range=0..10000))  # -> SmallerThan, OrEqualTo
dispatch_3 = Dispatch(List=pt_17, DispatchPattern=invert(smaller_3.SmallerThan))  # -> ListA, ListB
seaming_point = Point(Point(433.3428427, 2103.074493, 1.050239776))
# slicer with one polyline input
crv_15 = Curve(orient.Geometry)
geo = Geometry(dispatch_3.ListB)
add_on_pts = Point(geo)
python = GhPythonScript(
    imported_polylines=crv_15,
    layer_height=Slider(5, range=0..10),
    layer_width=Slider(20, range=0..100),
    seaming_point=seaming_point)  # -> out, points, seaming_points, slice, polyline; inputs imported_polylines: list of Polyline, layer_height: list, seaming_point: Point3d
# ---------- python: Python ----------
import sys
import os
HERE = ghenv.LocalScope.ghdoc.Path

#add library reference
my_path = os.path.abspath(os.path.join(HERE, '..', '..'))

if not my_path in sys.path:
    sys.path.append(my_path)
    
import Rhino.Geometry as rg
from cSlicer import mesh_slicer

from compas_rhino import unload_modules
unload_modules('cSlicer')

from cSlicer.layer import Layer
from cSlicer.print_param import Print_param
from cSlicer.mesh_slicer import Mesh_slice


#create layer objects to feed to Mesh_slice
layers = []

for p in imported_polylines:
    lay = Layer(p, layer_height, layer_width)
    layers.append(lay)
# print(layers[0].points)
slice = Mesh_slice(None, seaming_point, 0, 0, False, layer_height, layer_width, [], layers)
points = []

for i,layer in enumerate(slice.layers):
    
    points.extend([p.pt for p in layer.print_points])
    
seaming_points = slice.seaming_points

polyline = rg.Curve.CreateInterpolatedCurve(points,1)
# ---------- end python ----------
slice = Data(python.slice)
add_on = GhPythonScript(slice=slice, add_on_pts=add_on_pts)  # -> out, slice, add_on, c_frames, layer_index, add_on_pt; inputs add_on_pts: list
# ---------- add_on: Python ----------
__author__ = "WeiTingChen"

import Rhino.Geometry as rg
import ghpythonlib.components as gh
import compas
import os 
import sys

# add path of libraries
HERE = ghenv.LocalScope.ghdoc.Path

library_path = os.path.abspath(os.path.join(HERE, "..", ".."))
# print(library_path)

if not library_path in sys.path:
    sys.path.append(library_path)
    print(" Loading path successfully")

from compas_rhino import unload_modules
unload_modules('cSlicer')
from cSlicer.addons import Add_on

from compas.geometry import Point


center_pts = [ Point(pt[0], pt[1], pt[2]) for pt in add_on_pts]

add_on = Add_on(center_pts, slice.layers, rg.Plane.WorldXY)

c_frames = add_on.planes_per_layer
layer_index = add_on.addon_layer
add_on_pt = add_on.add_on_pt
print(len(add_on_pt))

print(layer_index)
for i, layer in enumerate(slice.layers):
    layer.add_ons_pt = []
    layer.add_ons_layer_ID = [] 
    layer.add_ons_layer_plane = []
    for j in range(len(layer_index)):
        if i == layer_index[j]:
            layer.add_ons_pt.append(add_on_pt[j])
            layer.add_ons_layer_ID.append(i)
            layer.add_ons_layer_plane.append(add_on.layer_plane[j])
    print(i, layer.add_ons_pt)
# ---------- end add_on ----------
pt_19 = Point(python.points)
crv_16 = Curve(python.polyline)

panel = Panel("209.52")
pt_20 = ConstructPoint(XCoordinate="1015.89+200", YCoordinate="996.81", ZCoordinate="0")

item_2 = ListItem(List=pt_19, Index=0, Wrap=True)

# ---- group: cull the same layer
sort = SortList(Keys=add_on.layer_index, ValuesA=add_on_pts)  # -> Keys, ValuesA
cset = CreateSet(List=sort.Keys)  # -> Set, Map
mindex = MemberIndex(Set=sort.Keys, Member=cset.Set)  # -> Index, Count
unflatten = UnflattenTree(Tree=sort.ValuesA, Guide=mindex.Index)
item_3 = ListItem(List=unflatten, Index=0, Wrap=True)  # -> flatten(Item)
add_on_pts_2 = Point(item_3)

# ----
type = ValueList({"One": 1, "Two": 2, "Three": 3, "Four": 4, "five": 5, "big_tube": 9, "small_tube": 10}, selected="small_tube")

panel_2 = Panel("108")
pt_21 = Point(pt_20)
sequence_grid = GhPythonScript(ref_pt=pt_21, add_on_pts=add_on_pts_2, offset_z=Slider(65, range=0..100))  # -> out, pts_list; inputs ref_pt: Point3d, add_on_pts: list
# ---------- sequence_grid: Python ----------
__author__ = "WeiTingChen"

import Rhino.Geometry as rg

grid = []
step_x = 200
step_y = 200
count_x = 1
count_y = 2

print(len(add_on_pts))
pt = ref_pt
pts_list = [] 
for i in range(0, step_x*count_x, step_x):
    for j in range(0, step_y*count_y, step_y):
        pts_list.append(rg.Point3d(pt[0]+i, pt[1]-j, pt[2] + offset_z))
# ---------- end sequence_grid ----------
lng = ListLength(List=add_on_pts_2)
repeat = RepeatData(Data=sequence_grid.pts_list, Length=lng)
pt_22 = Point(flatten(repeat))
pl_2 = ConstructPlane(Origin=pt_22, XAxis="-1,0,0", YAxis="0,1,0")
split = TextSplit(Text="-1,0,0", Separators=",")
split_2 = TextSplit(Text="0,1,0", Separators=",")

ghpython_script = GhPythonScript(frame=add_on.c_frames)  # -> out, out_g; inputs frame: list
# ---------- ghpython_script: Python ----------
__author__ = "WeiTingChen"

import sys
import os

# add path of libraries
HERE = ghenv.LocalScope.ghdoc.Path

library_path = os.path.abspath(os.path.join(HERE, "..",".."))
print(library_path)
if not library_path in sys.path:
    sys.path.append(library_path)

# load the library 
import imp
from utilities import util
imp.reload(util)

out_g = [util.cFrame2rFrame(f) for f in frame] 
print(out_g)
# ---------- end ghpython_script ----------
item_4 = ListItem(List=ghpython_script.out_g, Index=add_on.layer_index, Wrap=True)
glass_maker = GhPythonScript(add_on=add_on.add_on, type=type)  # -> out, glass, length, diameters
# ---------- glass_maker: Python ----------
__author__ = "WeiTingChen"

import Rhino.Geometry as rg
import ghpythonlib.components as gh
import compas
import os 
import sys

# add path of libraries
HERE = ghenv.LocalScope.ghdoc.Path

library_path = os.path.abspath(os.path.join(HERE, "..", ".."))
# print(library_path)

if not library_path in sys.path:
    sys.path.append(library_path)
    print(" Loading path successfully")

from compas_rhino import unload_modules
unload_modules('cSlicer')
from cSlicer.addons import Add_on

glass_dict = add_on.glass_mk(type)
print(glass_dict)
glass = [v for k, v in enumerate(glass_dict['glass'])]
length = [v for k, v in enumerate(glass_dict['length'])]
diameters = [v for k, v in enumerate(glass_dict['diameters'])]
# ---------- end glass_maker ----------
crv_17 = Curve(crv_16)

# ----
# printability check
python_2 = GhPythonScript(polyline=crv_17)  # -> out, segments; inputs polyline: list of Polyline
# ---------- python_2: Python ----------
import sys
import os
HERE = ghenv.LocalScope.ghdoc.Path

#add library reference
my_path = os.path.abspath(os.path.join(HERE, '..', '..'))

if not my_path in sys.path:
    sys.path.append(my_path)

import Rhino.Geometry as rg
from cSlicer import evaluate_printability as ep

segments =[]

for poly in polyline:
    segments= ep.not_printable_segments(poly)
# ---------- end python_2 ----------

# ----
# -organize add-ons per layer
# -compute dangeros zone per layer
# split printing to paths
# so that they alternate between
# being inside and outside a dangerous zone
crv_18 = Curve(python_2.segments)
section_into_paths = GhPythonScript(slice=add_on.slice)  # -> slice, all_paths, boxes, dangerous_flags_by_path, all_paths_points
# ---------- section_into_paths: Python ----------
import Rhino.Geometry as rg
from copy import deepcopy


all_paths = []
all_paths_points = []


last_pt_in_box = False
boxes = []
dangerous_flags_by_path = []

# path_id = [0 for layer in slice.layers for p in layer.add_ons_pt]
path_id = 0
for i,layer in enumerate(slice.layers):
    box_per_layer = []
    #compute dangerous zone per layer
    
    points = [rg.Point3d(pt[0], pt[1], pt[2]) for pt in layer.add_ons_pt]
    
#    planes = [rg.Plane(rg.Point3d(400, 600, pl[0][2]), rg.Vector3d(1,0,0), rg.Vector3d(0,1,0)) for pl in layer.add_ons_layer_plane]
    
#    if i not in layer.add_ons_layer_ID:
#        interval = rg.Interval(-0.001, 0.001)
#        box = rg.Box(rg.Plane.WorldXY, interval, interval, interval) # change 
#    else:
        # change to glass boundary box
#        box_plane = planes[0]
#        box = rg.Box(box_plane, rg.Interval(-100,100), rg.Interval(-800,800), rg.Interval(-7.5,7.5))
    plane = rg.Plane(rg.Point3d(400, 600, 0), rg.Vector3d(1,0,0), rg.Vector3d(0,1,0)) 
    box = rg.Box(plane, rg.Interval(-200,200), rg.Interval(-600,500), rg.Interval(-15,800))
    boxes.append(box)
    if i==0 and box.Contains(layer.print_points[0].pt) is False:
        dangerous_flags_by_path.append(False)
        
    for p in layer.print_points:
        current_pt_in_box = box.Contains(p.pt)
        #change later
        if last_pt_in_box != current_pt_in_box:
            path_id += 1
            
            item = " {} : {}".format(path_id, current_pt_in_box)
            dangerous_flags_by_path.append(current_pt_in_box)
            all_paths.append(item)
            
        p.path_id = path_id
        last_pt_in_box = current_pt_in_box
            
all_paths_points = [ [] for x in dangerous_flags_by_path]

for i,layer in enumerate(slice.layers):
    for p in layer.print_points:
        idx = p.path_id
        #print idx
        all_paths_points[p.path_id].append(p.pt)
# ---------- end section_into_paths ----------
python_3 = GhPythonScript(x=add_on_pts_2, y=pt_19)  # -> out, temp_points; inputs x: list of Point3d, y: list of Point3d
# ---------- python_3: Python ----------
__author__ = "WeiTingChen"

import Rhino.Geometry as rg
import ghpythonlib.components as gh


def cls_pt(points, cloud_pts):
    """
    """
    cls_pt = [] 
    for pt in points:
        min_dist = float('inf')
        min_pt = rg.Point3d(0,0,0)
        for cloud_pt in cloud_pts:
            dist = pt.DistanceTo(cloud_pt)
            if min_dist > dist:
                min_dist = dist
                min_pt  = cloud_pt
        cls_pt.append(min_pt)
    return cls_pt

temp_points = cls_pt(x, y)
# ---------- end python_3 ----------
python_4 = GhPythonScript(x=section_into_paths.all_paths_points)  # -> out, a
# ---------- python_4: Python ----------
a = x
# ---------- end python_4 ----------
layer_width = Slider(20, range=0..100)
layer_height = Slider(5, range=0..10)
tstat = TreeStatistics(Tree=python_4.a)  # -> Paths, Length, Count
box = Box(section_into_paths.boxes)
dispatch_4 = Dispatch(List=tstat.Paths, DispatchPattern=section_into_paths.dangerous_flags_by_path)  # -> ListA, ListB
branch = TreeBranch(Tree=simplify(python_4.a), Path=Slider(1, range=0..100), MaintainPaths=True)
branch_2 = TreeBranch(Tree=python_4.a, Path=dispatch_4.ListA, MaintainPaths=True)
branch_3 = TreeBranch(Tree=python_4.a, Path=dispatch_4.ListB, MaintainPaths=True)

# ----
# concrete volume (L)
concrete_volume = GhPythonScript(layer_width=layer_width, layer_height=layer_height, curves=crv_17)  # -> out, volume; inputs curves: list of Curve
# ---------- concrete_volume: Python ----------
import sys
import System
import Grasshopper as GH

HERE = ghenv.LocalScope.ghdoc.Path

#add library reference
my_path = HERE[:-26] # + "cSlicer"

if not my_path in sys.path:
    sys.path.append(my_path)
    #print "sucess"

from compas_rhino import unload_modules
unload_modules('slicer')

from cSlicer.helper_functions import concrete_volume



volume = 0

for cv in curves:

    volume += concrete_volume (layer_width, layer_height, cv)
# ---------- end concrete_volume ----------
panel_3 = Panel(concrete_volume.volume)

add_on_pts_3 = Point(python_3.temp_points)
wires = BrepWireframe(Brep=box, Density=-1)
cset_2 = CreateSet(List=branch_3)  # -> Set, Map
pl_3 = ConstructPlane(Origin=add_on_pts_3, XAxis="0,0,-1", YAxis="0,-1,0")
cset_3 = CreateSet(List=branch_2)  # -> Set, Map
pl_4 = ConstructPlane(Origin=add_on_pts_2, XAxis="0,0,-1", YAxis="0,-1,0")
dash = DashPattern(Curve=wires, Pattern=Slider(20, range=0..100))  # -> Dashes, Gaps
number_slider_3 = Slider(1, range=0..10)
pline_2 = PolyLine(Vertices=cset_2.Set, Closed=False)
pline_3 = PolyLine(Vertices=cset_3.Set, Closed=False)
preview = CustomPreview(Geometry=dash.Gaps, Material=ColourSwatch(SwatchColor=RGB(255, 0, 0)))
previewlw = CustomPreviewLineweights(Geometry=pline_3, Shader=ColourSwatch(SwatchColor=RGB(0, 0, 0)), Thickness=number_slider_3, Absolute=False)
previewlw_2 = CustomPreviewLineweights(Geometry=pline_2, Shader=ColourSwatch(SwatchColor=RGB(138, 138, 138)), Thickness=number_slider_3, Absolute=False)
# print path visualization
lumbricid = Lumbricid(
    SegmentLength=1,
    ProfileWidth=layer_width,
    ProfileHeight=layer_height,
    ProfileSegments=4,
    PathFraction=1,
    ColorByAge=False)  # disabled
add_on_plane = Plane(pl_3)
slice_2 = Data(section_into_paths.slice)
dangerous_flags_by_path = Data(section_into_paths.dangerous_flags_by_path)
xaxis = Data(split)
yaxis = Data(split_2)
placing__plane = Plane(pl_4)
picking_plane = Plane(pl_2)
pt_23 = Point(picking_plane)
# Production with two robots
panel_4 = Panel("pp_test01_d")
# Production with pick and place
toggle = BooleanToggle(False)
button = Button()
pt_24 = Point(Point(-572.4612461, 1067.27947, 0))
pt_25 = Point(Point(-572.4612461, 1067.27947, 0))
write_text_file = GhPythonScript(
    file_name=panel_4,
    write_json=Toggle(False),
    bucket_point=pt_24,
    gx="31000 To 31000",
    gy="-5000 To -5000",
    gz="-2800 To -2600",
    base_speed=Slider(150, range=0..1000),
    base_concrete=Slider(1, range=0..1000),
    base_accelerator=Slider(40, range=0..1000),
    base_zone=Slider(100, range=0..1000),
    slice=slice_2,
    addons=add_on_plane,
    placing_points=placing__plane,
    picking_points=pt_23,
    xaxis=xaxis,
    yaxis=yaxis,
    dangerous_flags_by_path=dangerous_flags_by_path)  # -> out; inputs bucket_point: Point3d, addons: list of Plane, placing_points: list of Plane, picking_points: list of Point3d, xaxis: list, yaxis: list, dangerous_flags_by_path: list
# ---------- write_text_file: Python ----------
import sys
import os
from compas.data import json_dump
from datetime import datetime as dt
import Rhino.Geometry as rg

HERE = ghenv.LocalScope.ghdoc.Path

#add library reference
my_path = os.path.abspath(os.path.join(HERE, '..', '..'))

if not my_path in sys.path:
    sys.path.append(my_path)
    #print "sucess"

from compas_rhino import unload_modules
unload_modules('cSlicer')
from cSlicer.process_instructions import MergedProcess

dir_path = DATA = os.path.abspath(os.path.join(HERE, '..', '..', '..','data'))
date = dt.now().strftime("%Y%m%d") + '_'



# add to layer 
print_pts = [pts for layer in slice.layers for pts in layer.points ]
slice_bbox = rg.BoundingBox(print_pts)
# print type(slice_bbox)

#update printing data
for l,layer in enumerate(slice.layers):
    for p,point in enumerate(layer.print_points):
        # print point.pt
        point.initialize_printing_parameters(slice_bbox, gx, gy, gz, base_speed, base_zone, base_concrete, base_accelerator)

merged_process = MergedProcess()
production_data = merged_process.prepare_production_data(slice, addons, placing_points, picking_points, xaxis, yaxis, dangerous_flags_by_path)
#print (addons, placing_points, picking_points)


if write_json:
    json_dump(production_data, dir_path + '/' + date + file_name +'.json', pretty=True)
    print "exported"
# ---------- end write_text_file ----------
write_text_file_2 = GhPythonScript(
    file_name="pick_place_test_01",
    write_json=toggle,
    bucket_point=pt_25,
    gx="31000 To 31000",
    gy="-5000 To -5000",
    gz="-2800 To -2600",
    base_speed=Slider(70, range=0..1000),
    base_concrete=Slider(1, range=0..1000),
    base_accelerator=Slider(40, range=0..1000),
    base_zone=Slider(100, range=0..1000))  # -> out; inputs bucket_point: Point3d, addons: list of Plane, picking_points: list of Plane, xaxis: list, yaxis: list, dangerous_flags_by_path: list
# ---------- write_text_file_2: Python ----------
import sys
import os
import rhinoscriptsyntax as rs
from compas.data import json_dump
from compas.utilities import geometric_key

HERE = ghenv.LocalScope.ghdoc.Path

#add library reference
my_path = os.path.abspath(os.path.join(HERE, '..', '..'))

if not my_path in sys.path:
    sys.path.append(my_path)
    #print "sucess"

from compas_rhino import unload_modules
unload_modules('cSlicer')
from cSlicer.partial_order_plan import Action, ProductionData
from cSlicer.process_instructions import PickAndPlaceProcess

dir_path = DATA = os.path.abspath(os.path.join(HERE, '..', '..', '..','data'))

#update printing data
for l,layer in enumerate(slice.layers):
    for p,point in enumerate(layer.print_points):
        point.initialize_printing_parameters(slice.bbox, gx, gy, gz, base_speed, base_zone, base_concrete, base_accelerator)


production_data = ProductionData()
pnp_process = PickAndPlaceProcess()

#add a root action

root_action_id = production_data.append_action(pnp_process.namespace, Action('PrintText', dict(text='Starting process')))

for a_index, action in enumerate(pnp_process.setup()):
    last_action_id = production_data.append_action(pnp_process.namespace, action)
    
    # The first action of each process will depend on the root action instead
    if a_index == 0:
        production_data.actions[last_action_id].dependency_ids = [root_action_id]
        
for item, pick_item in zip (addons, picking_points):
    addon_plane, pick_point = item, pick_item.Origin
    pick_actions = pnp_process.pick(pick_point, xaxis, yaxis)
    place_actions = pnp_process.place((addon_plane.Origin[0], addon_plane.Origin[1], addon_plane.Origin[2]), xaxis, yaxis)
    
    for pick_action in pick_actions:
        last_action_id = production_data.append_action(pnp_process.namespace, pick_action, dependency_ids=[last_action_id])
        # print c 
    for place_action in place_actions:
        last_action_id =production_data.append_action(pnp_process.namespace, place_action, dependency_ids=[last_action_id])

if write_json:
    json_dump(production_data, dir_path + '/' + file_name +'.json', pretty=True)
    print "exported"
# ---------- end write_text_file_2 ----------
panel_5 = Panel(write_text_file)
panel_6 = Panel(write_text_file_2)

# ----
# slicer with mesh input
number_slider_4 = Slider(120, range=0..1000)  # disabled
number_slider_5 = Slider(1000, range=0..1000)  # disabled
number_slider_6 = Slider(300, range=0..1000)  # disabled
pt_26 = Point(Point(446.0375867, 109.5995792, 0))  # disabled
number_slider_7 = Slider(1, range=0..10)  # disabled
box_2 = DomainBox(Base=pt_26, X=number_slider_4, Y=number_slider_5, Z=number_slider_6)  # disabled
debrep = DeconstructBrep(Brep=box_2)  # -> Faces, Edges, Vertices; disabled
number_slider_8 = Slider(2, range=0..10)  # disabled
smesh = SimpleMesh(Brep=debrep.Faces)  # disabled
wbcatmullclark = WeaverbirdsCatmullClarkSubdivision(MeshCurves=smesh, Level=number_slider_7, SmoothNakedEdges=0)  # -> flatten(OutputMeshCurves); disabled
item_5 = ListItem(List=wbcatmullclark, Index=0, Wrap=True)  # -> Item, Item1, Item2, Item3; disabled
wbcatmullclark_2 = WeaverbirdsCatmullClarkSubdivision(MeshCurves=item_5.Item1, Level=number_slider_8, SmoothNakedEdges=0)  # -> flatten(OutputMeshCurves); disabled
wbcatmullclark_3 = WeaverbirdsCatmullClarkSubdivision(MeshCurves=item_5.Item3, Level=number_slider_8, SmoothNakedEdges=0)  # -> flatten(OutputMeshCurves); disabled
clean = CombineClean(Meshes=[item_5.Item, wbcatmullclark_2, item_5.Item2, wbcatmullclark_3])  # disabled
mesh = Mesh(clean)  # disabled
mesh_2 = Mesh(mesh)  # disabled
point = Point(Point(0, 944, -427))  # disabled
section_into_paths_2 = GhPythonScript(slice=add_on.slice)  # -> slice, all_paths, boxes, dangerous_flags_by_path, all_paths_points; disabled
# ---------- section_into_paths_2: Python ----------
import Rhino.Geometry as rg
from copy import deepcopy
all_paths = []
all_paths_points = []
path_id = 0
last_pt_in_box = False
boxes = []
dangerous_flags_by_path = []

for i,layer in enumerate(slice.layers):
    
    #compute dangerous zone per layer
    points = [addon.center for addon in layer.add_ons]

    if len(points)== 0:
        interval0 = rg.Interval(-0.001, 0.001)
        box = rg.Box(rg.Plane.WorldXY, interval0, interval0, interval0)
    elif len(points)>1:
        box = rg.BoundingBox(points)
    else:
        plane = rg.Plane.WorldXY
        plane.Origin = points[0]
        interval = rg.Interval(-15,15)
        box = rg.Box(plane, interval, interval, interval)
    boxes.append(box)
    
    #change later
    if i==0 and box.Contains(layer.print_points[0].pt) is False:
        dangerous_flags_by_path.append(False)
    
    for p in layer.print_points:
        
        current_pt_in_box = box.Contains(p.pt)
        
        if last_pt_in_box != current_pt_in_box:
            path_id += 1
            
            
            item = " {} : {}".format(path_id, current_pt_in_box)
            dangerous_flags_by_path.append(current_pt_in_box)
            all_paths.append(item)
            
        p.path_id = path_id
        last_pt_in_box = current_pt_in_box
        
all_paths_points = [ [] for x in dangerous_flags_by_path]

for i,layer in enumerate(slice.layers):
    
    for p in layer.print_points:
        
        idx = p.path_id
        print idx
        all_paths_points[p.path_id].append(p.pt)
# ---------- end section_into_paths_2 ----------

# ---- group: color mesh faces depending on overhang
python_script = PythonScript(mesh=mesh_2)  # -> out, colors, a; inputs mesh: Mesh; disabled
# ---------- python_script: Python ----------
import sys
import Rhino.Geometry as rg
import math
import os
HERE = ghenv.LocalScope.ghdoc.Path

#add library reference
my_path = os.path.abspath(os.path.join(HERE, '..', '..'))

if not my_path in sys.path:
    sys.path.append(my_path)
    print "sucess"

#import library
from cSlicer import infill
import imp
imp.reload(infill)

from cSlicer.infill import Infill
from cSlicer.helper_functions import color_mesh_faces

myInfill = Infill(mesh)
colors = myInfill.colors
a = color_mesh_faces(mesh,colors)
# ---------- end python_script ----------

# ---- group: instantiate slice_object
toggle_2 = BooleanToggle(False)  # disabled
list = ValueList({"Paralel": 0, "Crossing": 1}, selected="Crossing")  # disabled
number_slider_9 = Slider(15, range=0..100)  # disabled
number_slider_10 = Slider(0, range=0..100)  # disabled
number_slider_11 = Slider(5, range=0..10)  # disabled
slicer = GhPythonScript(
    mode=list,
    imported_mesh=mesh_2,
    layer_height=number_slider_11,
    layer_width=number_slider_9,
    seaming_point=point,
    cutting_planes=xy_2,
    start_stop=toggle_2,
    smoothing_distance=number_slider_10)  # -> out, polyline, points, seaming_points, slice; inputs mode: Int32, imported_mesh: list, seaming_point: Point3d, cutting_planes: list of Plane; disabled
# ---------- slicer: Python ----------
import sys
import os
HERE = ghenv.LocalScope.ghdoc.Path

#add library reference
my_path = os.path.abspath(os.path.join(HERE, '..', '..'))

if not my_path in sys.path:
    sys.path.append(my_path)
    
import Rhino.Geometry as rg
from cSlicer import mesh_slicer

from compas_rhino import unload_modules
unload_modules('cSlicer')

from cSlicer.mesh_slicer import Mesh_slice
from cSlicer.print_param import Print_param

slice = Mesh_slice(imported_mesh, seaming_point, smoothing_distance, mode, start_stop,layer_height, layer_width, cutting_planes)

points = []

for i,layer in enumerate(slice.layers):
    
    points.extend([p.pt for p in layer.print_points])
    
#seaming_points = slice.seaming_points
polyline = rg.Curve.CreateInterpolatedCurve(points,1)
# ---------- end slicer ----------
crv_19 = Curve(slicer.polyline)  # disabled
pt_27 = Point(slicer.points)  # disabled

# ----
add_ons = GhPythonScript(slice=slicer.slice)  # -> out, slice, glass; disabled
# ---------- add_ons: Python ----------
import sys
import os
import rhinoscriptsyntax as rs
from compas.data import json_dump

HERE = ghenv.LocalScope.ghdoc.Path

#add library reference
my_path = os.path.abspath(os.path.join(HERE, '..', '..'))
print my_path
if not my_path in sys.path:
    sys.path.append(my_path)
    #print "sucess"

from compas_rhino import unload_modules
unload_modules('cSlicer')
from cSlicer.addons import Add_on

glass = []

#design add-ons
for l,layer in enumerate(slice.layers):
    layer.add_ons = []
    if l%2==0:
        add_on = Add_on(layer.print_points[2].pt, layer)
        glass.append(layer.print_points[2].pt)
        layer.add_ons.append(add_on)
print len(layer.add_ons)
# ---------- end add_ons ----------

section_into_paths_3 = GhPythonScript(slice=add_on.slice)  # -> slice, all_paths, boxes, dangerous_flags_by_path, all_paths_points; disabled
# ---------- section_into_paths_3: Python ----------
import Rhino.Geometry as rg
from copy import deepcopy


all_paths = []
all_paths_points = []


last_pt_in_box = False
boxes = []
dangerous_flags_by_path = []

# path_id = [0 for layer in slice.layers for p in layer.add_ons_pt]
path_id = 0
for i,layer in enumerate(slice.layers):
    box_per_layer = []
    #compute dangerous zone per layer
    points = [rg.Point3d(pt[0], pt[1], pt[2]) for pt in layer.add_ons_pt]
    for j in range(len(points)):
        if i not in layer.add_ons_layer_ID:
            interval = rg.Interval(-0.001, 0.001)
            box = rg.Box(rg.Plane.WorldXY, interval, interval, interval) # change 
        else:
            # change to glass boundary box
            box_plane = rg.Plane(points[j], rg.Vector3d.XAxis, rg.Vector3d.YAxis)
            box = rg.Box(box_plane, rg.Interval(-100,100), rg.Interval(-150,150), rg.Interval(-2.5,2.5))
        box_per_layer.append(box)
        
        if i==0 and box_per_layer[j].Contains(layer.print_points[0].pt) is False:
            dangerous_flags_by_path.append(False)
            
        for k, p in enumerate(layer.print_points):
            current_pt_in_box = box_per_layer[j].Contains(p.pt)
            #change later
            if last_pt_in_box != current_pt_in_box:
                path_id += 1
                item = " {} : {}".format(path_id, current_pt_in_box)
                dangerous_flags_by_path.append(current_pt_in_box)
                all_paths.append(item)
            p.path_id = path_id
            last_pt_in_box = current_pt_in_box
    boxes.extend(box_per_layer)
    
all_paths_points = [ [] for x in dangerous_flags_by_path]

for i,layer in enumerate(slice.layers):
    for p in layer.print_points:
        idx = p.path_id
        print idx
        all_paths_points[p.path_id-1].append(p.pt)
# ---------- end section_into_paths_3 ----------
number_slider_12 = Slider(10, range=0..100)  # disabled
box_3 = Box(section_into_paths_3.boxes)

python_5 = GhPythonScript(x=section_into_paths_3.all_paths_points)  # -> out, a; disabled; same code as python_4
tstat_2 = TreeStatistics(Tree=python_5.a)  # -> Paths, Length, Count; disabled
dispatch_5 = Dispatch(List=tstat_2.Paths, DispatchPattern=section_into_paths_3.dangerous_flags_by_path)  # -> ListA, ListB; disabled
number_slider_13 = Slider(10, range=0..10)  # disabled
branch_4 = TreeBranch(Tree=python_5.a, Path=dispatch_5.ListB, MaintainPaths=True)  # disabled
points = PointList(Points=branch_4, Size=number_slider_13)

branch_5 = TreeBranch(Tree=simplify(python_5.a), Path=number_slider_12, MaintainPaths=True)  # disabled
