# Grasshopper definition slide_diagrams.gh (Grasshopper 1.0.7)
# plug-ins: Human, Kangaroo Components

crv = Curve(flatten([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]))
pt = Point([Point(481.2772719, -38, 165), Point(691.8588279, -38, 235), Point(835.0548464, -38, 275), Point(867.2757567, -38, 425), Point(616.0795007, -38, 165), Point(553.0805763, -38, 135), Point(105.0162949, -38, 435), Point(459.4452923, -38, 85), Point(775.7991291, -38, 215), Point(822.2906016, -38, 350), Point(120.1453768, -38, 335), Point(86.92340464, -38, 275), Point(347.9555866, -38, 60), Point(380.0028443, -38, 135), Point(172.4199863, -38, 135), Point(271.3262375, -38, 160), Point(129.2132284, -38, 505), Point(693.0173639, -38, 165), Point(147.3252206, -38, 235)])

crv_2 = Curve([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])
pt_2 = Point([Point(481.2772719, -60.89114448, 165), Point(691.8588279, -60.89114448, 235), Point(835.0548464, -60.89114448, 275), Point(867.2757567, -60.89114448, 425), Point(616.0795007, -60.89114448, 165), Point(553.0805763, -60.89114448, 135)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])

# ---- group: 210805
crv_3 = Curve(flatten([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]))  # disabled
pt_3 = Point([Point(268.6369895, -30.01404968, 70), Point(691.8588279, -30.01404968, 235), Point(182.9015907, -30.01404968, 400), Point(207.2907189, -30.01404968, 205), Point(867.2757567, -30.01404968, 425), Point(616.0795007, -30.01404968, 165), Point(105.0162949, -30.01404968, 435), Point(459.4452923, -30.01404968, 85), Point(218.1337104, -30.01404968, 500), Point(822.2906016, -30.01404968, 350), Point(120.1453768, -30.01404968, 335), Point(347.9555866, -30.01404968, 60), Point(380.0028443, -30.01404968, 135), Point(271.3262375, -30.01404968, 160), Point(553.0805763, -30.01404968, 135), Point(129.2132284, -30.01404968, 505), Point(693.0173639, -30.01404968, 165), Point(147.3252206, -30.01404968, 235)])  # disabled

# ---- group: 0806_test
crv_4 = Curve(flatten([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]))
pt_4 = Point([Point(268.6369895, -30.01404968, 70), Point(691.8588279, -30.01404968, 235), Point(182.9015907, -30.01404968, 400), Point(207.2907189, -30.01404968, 205), Point(867.2757567, -30.01404968, 425), Point(616.0795007, -30.01404968, 165), Point(105.0162949, -30.01404968, 435), Point(459.4452923, -30.01404968, 85), Point(218.1337104, -30.01404968, 500), Point(822.2906016, -30.01404968, 350), Point(120.1453768, -30.01404968, 335), Point(347.9555866, -30.01404968, 60), Point(380.0028443, -30.01404968, 135), Point(271.3262375, -30.01404968, 160), Point(553.0805763, -30.01404968, 135), Point(129.2132284, -30.01404968, 505), Point(693.0173639, -30.01404968, 165), Point(147.3252206, -30.01404968, 235)])

# ---- group: 0806_small_test
crv_5 = Curve(flatten([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]))
pt_5 = Point([Point(190, -30.01404965, 75), Point(287, -30.01404965, 135), Point(131, -30.01404965, 190)])

# ----
crv_6 = Curve(flatten([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]))
pt_6 = Point([Point(268.6369895, -30.01404966, 70), Point(691.8588279, -30.01404966, 235), Point(182.9015907, -30.01404966, 400), Point(207.2907189, -30.01404966, 205), Point(867.2757567, -30.01404966, 425), Point(187.4393873, -30.01404966, 300), Point(616.0795007, -30.01404966, 165), Point(105.0162949, -30.01404966, 435), Point(459.4452923, -30.01404966, 85), Point(218.1337104, -30.01404966, 500), Point(775.7991291, -30.01404966, 215), Point(822.2906016, -30.01404966, 350), Point(120.1453768, -30.01404966, 335), Point(347.9555866, -30.01404966, 60), Point(380.0028443, -30.01404966, 135), Point(271.3262375, -30.01404966, 160), Point(129.2132284, -30.01404966, 505), Point(86.92340464, -30.01404966, 275)])

crv_7 = Curve(flatten([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]))
crv_8 = Curve([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])
crv_9 = Curve([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])

# ---- group: 210805
crv_10 = Curve(flatten([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]))
pt_7 = Point([Point(207.2907189, -30.01404966, 205), Point(867.2757567, -30.01404966, 425), Point(459.4452923, -30.01404966, 85), Point(822.2906016, -30.01404966, 350), Point(120.1453768, -30.01404966, 335), Point(693.0173639, -30.01404966, 165)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])

# ----
crv_11 = Curve([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])
test_02_same_size = Curve([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])
test_01_same_size = Curve([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])
crv_different_layerhight = Curve(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)

# ---- group: mutil-polyline
test_01 = Curve(flatten([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]))

# ----
curve = Curve(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)
crv_12 = Curve(crv_7)

# ---- group: mutil-polyline
test_02 = Curve(flatten([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]))

# ----
bbox = BoundingBox(Content=test_02, Plane=PlaneXY(0, 0, 0), UnionBox=True)  # -> Box, Box_2
bbox_2 = BoundingBox(Content=crv_12, Plane=PlaneXY(0, 0, 0), UnionBox=True)  # -> Box, Box_2
debrep = DeconstructBrep(Brep=bbox.Box)  # -> Faces, Edges, Vertices
debrep_2 = DeconstructBrep(Brep=bbox_2.Box)  # -> Faces, Edges, Vertices
pt_8 = Point(Point(0, 0, 0))
item = ListItem(List=debrep.Vertices, Index=0, Wrap=True)
item_2 = ListItem(List=debrep_2.Vertices, Index=0, Wrap=True)
orient = Orient(Geometry=crv_12, Source=item_2, Target=item)  # -> Geometry, Transform
crv_13 = Curve(orient.Geometry)
sqgrid = Square(Plane=pt_8, Size=Slider(25, range=0..100), ExtentX=Slider(24, range=0..100), ExtentY=Slider(40, range=0..100))  # -> Cells, flatten(Points)
image_sampler = ImageSampler(sqgrid.Points, Filter="Value", Interpolate=False, Umax=1750, Umin=0, Vmax=875, Vmin=0, Wrap=1)
dispatch = Dispatch(List=crv_13, DispatchPattern=[True, False])  # -> ListA, ListB
dispatch_2 = Dispatch(List=dispatch.ListA, DispatchPattern=[True, False])  # -> ListA, ListB
previewlw = CustomPreviewLineweights(
    Geometry=dispatch_2.ListA,
    Shader=ColourSwatch(SwatchColor=RGB(255, 255, 255)),
    Thickness=Slider(1, range=0..10),
    Absolute=False)
bnd = Bounds(Numbers=image_sampler)
rectangle = Rectangle(flatten(sqgrid.Cells))
region_union = RegionUnion(Curves=rectangle)
number_slider = Slider(5, range=0..10)  # disabled
geo = Geometry([<brep referenced from the Rhino model> x2])
geo_2 = Geometry(<brep referenced from the Rhino model>)
number_slider_2 = Slider(2, range=0..10)  # disabled
crv_14 = Curve([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])
number_slider_3 = Slider(3, range=0..10)  # disabled
number_slider_4 = Slider(2, range=0..10)  # disabled
crv_15 = Curve(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)
crv_16 = Curve([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])
crv_17 = Curve([<curve referenced from the Rhino model> x7])  # disabled
crv_18 = Curve([<curve referenced from the Rhino model> x5])  # disabled
crv_19 = Curve([<curve referenced from the Rhino model> x3])  # disabled
crv_20 = Curve([<curve referenced from the Rhino model> x3])  # disabled
swatch = ColourSwatch(SwatchColor=RGB(0, 0, 0))  # disabled
swatch_2 = ColourSwatch(SwatchColor=RGB(115, 115, 115))  # disabled
swatch_3 = ColourSwatch(SwatchColor=RGB(0, 0, 0))  # disabled
dash = DashPattern(Curve=crv_15, Pattern=Slider(5, range=0..10))  # -> Dashes, Gaps
dash_2 = DashPattern(Curve=crv_19, Pattern=number_slider)  # -> Dashes, Gaps; disabled
preview = CustomPreview(Geometry=geo, Material=ColourSwatch(SwatchColor=RGBA(255, 255, 255, 251)))
preview_2 = CustomPreview(Geometry=geo_2, Material=ColourSwatch(SwatchColor=RGBA(255, 255, 255, 251)))
dom = ConstructDomain(DomainStart=Slider(0.7, range=0..1), DomainEnd=Slider(2, range=0..10))
previewlw_2 = CustomPreviewLineweights(
    Geometry=flatten(dash.Dashes),
    Shader=ColourSwatch(SwatchColor=RGB(115, 115, 115)),
    Thickness=Slider(3, range=0..10),
    Absolute=False)
previewlw_3 = CustomPreviewLineweights(
    Geometry=flatten(crv_16),
    Shader=ColourSwatch(SwatchColor=RGB(0, 0, 0)),
    Thickness=Slider(2, range=0..10),
    Absolute=False)
previewlw_4 = CustomPreviewLineweights(Geometry=flatten(crv_20), Shader=swatch_3, Thickness=number_slider_4, Absolute=False)  # disabled
previewlw_5 = CustomPreviewLineweights(Geometry=flatten([crv_17, crv_18]), Shader=swatch, Thickness=number_slider_2, Absolute=False)  # disabled
previewlw_6 = CustomPreviewLineweights(
    Geometry=flatten(crv_14),
    Shader=ColourSwatch(SwatchColor=RGB(0, 0, 0)),
    Thickness=Slider(2, range=0..10),
    Absolute=False)
previewlw_7 = CustomPreviewLineweights(Geometry=flatten(dash_2.Dashes), Shader=swatch_2, Thickness=number_slider_3, Absolute=False)  # disabled
wires = BrepWireframe(Brep=geo_2, Density=-1)
crv_21 = Curve([<curve referenced from the Rhino model> x12])
remap = RemapNumbers(Value=image_sampler, Source=bnd, Target=dom)  # -> Mapped, Clipped
previewlw_8 = CustomPreviewLineweights(
    Geometry=flatten([wires, crv_21]),
    Shader=ColourSwatch(SwatchColor=RGB(28, 28, 28)),
    Thickness=Slider(0, range=0..10),
    Absolute=False)
mesh = Geometry(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)
crv_22 = Curve(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)
crv_23 = Curve(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)
crv_24 = Curve(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)
crv_25 = Curve(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)
crv_26 = Curve(region_union)
crv_27 = Curve()
divide = DivideCurve(Curve=crv_23, Count=Slider(10, range=0..1000), Kinks=False)  # -> Points, Tangents, Parameters
divide_2 = DivideCurve(Curve=crv_25, Count=Slider(45, range=0..1000), Kinks=False)  # -> Points, Tangents, Parameters
divide_3 = DivideCurve(Curve=crv_24, Count=Slider(50, range=0..1000), Kinks=False)  # -> Points, Tangents, Parameters
bbox_3 = BoundingBox(Content=mesh, Plane=PlaneXY(0, 0, 0))  # -> Box, Box_2
divide_4 = DivideCurve(Curve=crv_22, Count=Slider(30, range=0..1000), Kinks=False)  # -> Points, Tangents, Parameters
python = GhPythonScript(
    boundaryCurve=crv_26,
    time=Slider(300, range=0..1000),
    basicCollisionDistance=Slider(50, range=0..1000),
    numPoints=Slider(30, range=0..1000),
    factors=remap.Mapped,
    points=sqgrid.Points,
    centers=divide_3.Points)  # -> out, totalPoints, centers, radiuses; inputs boundaryCurve: Curve, time: Int32, numPoints: Int32, factors: list, points: list of Point3d, centers: list of Point3d
# ---------- python: Python ----------
def SearchCallback(sender, data):
    sData = data.Tag
    sData.points.add(data.Id)

class SearchData:
    
    # make a SearchData object with two attributes (a set of vertices and a boolean addedVert)
    def __init__(self):
        self.points = set() #initialize vertices as an empty set


totalPoints = []

import Rhino.Geometry as rg
from copy import deepcopy

pointCloud = rg.PointCloud(points)
boundaryCurve.Domain = rg.Interval(0,1)

for t in range(time):
    
    totalMoves = []
    collisionCounts = []
    
    #i am making a new RTree for every moment
    tree = rg.RTree()
    #make a list  of 0.0 and zero Vectors 
    for k in range( len(centers)):
        totalMoves.append(rg.Vector3d(0,0,0))
        collisionCounts.append(0.0)
        
        #i am inserting all the points
        tree.Insert(centers[k], k)
    
    radiuses = []
    for i in range(len(centers)):
        
        closestIdx = pointCloud.ClosestPoint(centers[i])
        collisionDistance = basicCollisionDistance * factors[closestIdx]
        radiuses.append(collisionDistance)
        #i don't want to look in Aaaalll the centers
        
        radius = collisionDistance
        sphere = rg.Sphere(centers[i], radius)
        sData = SearchData()
            
        #if intersection is found, SearchCallback is called, data.Id is added to sData.vertices
        tree.Search(sphere, SearchCallback, sData) #sData = data.Tag
        intersect = sData.points #intersections for every vertice
        
        
        for j in intersect:
            d = centers[i].DistanceTo(centers[j])
            if (d > collisionDistance):
                continue
            move = centers[i] - centers[j]
            if (move.Length < 0.001):
                 continue
            move.Unitize();
            move *= (collisionDistance - d)
            totalMoves[i] += move
            totalMoves[j] -= move
            collisionCounts[i] += 1.0
            collisionCounts[j] += 1.0
            
    
    #average all moving vectors
    for i in range(len(centers)):
        
     
        if (collisionCounts[i] != 0.0):
            
            vec = 0.5*(totalMoves[i] / collisionCounts[i])
            centers[i] += vec
        
        closestIdx = pointCloud.ClosestPoint(centers[i])
        collisionDistance = 0.25*basicCollisionDistance * factors[closestIdx]
        
        #checking for boundaries
        if centers[i].X < collisionDistance:
            centers[i] += rg.Vector3d(collisionDistance,0,0)
        
        if centers[i].X > 600 - collisionDistance:
            centers[i] -= rg.Vector3d(collisionDistance,0,0)
        
        if centers[i].Y < collisionDistance:
            centers[i] += rg.Vector3d(0,collisionDistance,0)
        
        if centers[i].Y > 1000 - 10:
            centers[i] -= rg.Vector3d(0,collisionDistance,0)
        
            
    
        
    temp = deepcopy(centers)    
    totalPoints.append(temp)
# ---------- end python ----------
area = Area(Geometry=bbox_3.Box)  # -> Area, Centroid
geo_3 = Geometry(<brep referenced from the Rhino model>)
scale_nu = ScaleNU(
    Geometry=bbox_3.Box,
    Plane=area.Centroid,
    ScaleX=Slider(2.131, range=0..10),
    ScaleY=Slider(1.113, range=0..10),
    ScaleZ=Slider(0.661, range=0..10))  # -> Geometry, Transform
wires_2 = BrepWireframe(Brep=geo_3, Density=-1)
pt_9 = Point(python.centers)
geo_4 = Geometry(scale_nu.Geometry)
ghpython_script = GhPythonScript(x=python.totalPoints)  # -> out, a
# ---------- ghpython_script: Python ----------
a=x
# ---------- end ghpython_script ----------
timer = Timer(Interval=20, TimerInterval=20, Target=counter)  # disabled
previewlw_9 = CustomPreviewLineweights(
    Geometry=flatten(wires_2),
    Shader=ColourSwatch(SwatchColor=RGB(0, 0, 0)),
    Thickness=Slider(1, range=0..10),
    Absolute=False)
preview_3 = CustomPreview(Geometry=geo_3, Material=ColourSwatch(SwatchColor=RGB(255, 255, 255)))
wires_3 = BrepWireframe(Brep=geo_4, Density=-1)
number_slider_5 = Slider(300, range=300..380)
tree_statistics = TreeStatistics(Tree=ghpython_script.a)  # -> Paths, Length, Count
counter = Counter(Reset=Toggle(False))
previewlw_10 = CustomPreviewLineweights(
    Geometry=flatten(wires_3),
    Shader=ColourSwatch(SwatchColor=RGB(28, 28, 28)),
    Thickness=Slider(1, range=0..10),
    Absolute=False)
preview_4 = CustomPreview(Geometry=geo_4, Material=ColourSwatch(SwatchColor=RGBA(255, 255, 255, 251)))  # disabled
panel = Panel(counter)
item_3 = ListItem(List=tree_statistics.Paths, Index=counter, Wrap=True)
mesh_2 = Mesh(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)
mesh_3 = Mesh(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)
pt_10 = Point([Point(336.1855385, 327.6323325, -10095.75296), Point(287.657164, 327.6323325, -10200.75296), Point(278.2920242, 327.6323325, -10305.75296), Point(206.6834675, 327.6323325, -10395.75296), Point(138.5483231, 327.6323325, -10460.75296), Point(86.55127455, 327.6323325, -10770.75296)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])
pt_11 = Point([<point referenced from the Rhino model> x274])
num = Number([108, 108, 108, 108, 108, 108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])
tree_branch = TreeBranch(Tree=ghpython_script.a, Path=item_3, MaintainPaths=True)  # -> flatten(Branch)
Y = UnitY(Factor=num)  # -> expr("x*-1", UnitVector)
move = Move(Geometry=pt_11, Motion=Y)  # -> Geometry, Transform
cir = Circle(Plane=tree_branch, Radius=Slider(15, range=0..100))
ln = Line(StartPoint=pt_11, EndPoint=move.Geometry)
crv_28 = Curve(crv_24)
crv_29 = Curve(cir)
dash_3 = DashPattern(Curve=crv_28, Pattern=Slider(5, range=0..10))  # -> Dashes, Gaps
bbox_4 = BoundingBox(Content=mesh_3, Plane=PlaneXY(0, 0, 0))  # -> Box, Box_2
medges = MeshEdges(Mesh=mesh_3)  # -> NakedEdges, InteriorEdges, NonManifoldEdges
previewlw_11 = CustomPreviewLineweights(
    Geometry=flatten(crv_29),
    Shader=ColourSwatch(SwatchColor=RGB(0, 0, 0)),
    Thickness=Slider(2, range=0..10),
    Absolute=False)
previewlw_12 = CustomPreviewLineweights(
    Geometry=flatten(dash_3.Dashes),
    Shader=ColourSwatch(SwatchColor=RGB(115, 115, 115)),
    Thickness=Slider(3, range=0..10),
    Absolute=False)
wires_4 = BrepWireframe(Brep=bbox_4.Box, Density=-1)
previewlw_13 = CustomPreviewLineweights(
    Geometry=flatten(ln),
    Shader=ColourSwatch(SwatchColor=RGB(156, 156, 156)),
    Thickness=Slider(1, range=0..10),
    Absolute=False)
previewlw_14 = CustomPreviewLineweights(
    Geometry=flatten(wires_4),
    Shader=ColourSwatch(SwatchColor=RGB(99, 99, 99)),
    Thickness=Slider(5, range=0..10),
    Absolute=False)
preview_5 = CustomPreview(Geometry=mesh_3, Material=ColourSwatch(SwatchColor=RGBA(255, 255, 255, 251)))  # disabled
